# Grasshopper definition ASSIGNMENT02_CDDF_2024.gh (Grasshopper 1.0.7)
# plug-ins: GH_MinSurf, Pufferfish

c__winding_for_4_frames = CSharpScript()  # -> out, A, B, C, D, E, F; inputs iShift: Int32, iPointsA: list of Point3d, iPointsB: list of Point3d, iPointsC: list of Point3d, iPointsD: list of Point3d
# ---------- c__winding_for_4_frames: C# ----------
  
      int iPointsACount = iPointsA.Count;
      int iPointsBCount = iPointsB.Count;
      int iPointsCCount = iPointsC.Count;
      int iPointsDCount = iPointsD.Count;
      int maxPoints = iPointsACount;

      // create frame objects

      Frame frameA = new Frame(iPointsA);
      Frame frameB = new Frame(iPointsB);
      Frame frameC = new Frame(iPointsC);
      Frame frameD = new Frame(iPointsD);

      // determine smaller frame

      if (iPointsACount < iPointsBCount && iPointsACount < iPointsCCount && iPointsBCount > iPointsCCount)
      {
        // a is the smallest and b is the biggest
        frameA.isSmaller = true;
        maxPoints = iPointsBCount;
        frameA.maxPoints = maxPoints;
        frameA.insertPoints();
        Print("Frame A is smaller and B bigger");
      }

      if (iPointsACount < iPointsBCount && iPointsACount < iPointsCCount && iPointsCCount > iPointsBCount)
      {
        // a is the smallest and c is the biggest
        frameA.isSmaller = true;
        maxPoints = iPointsCCount;
        frameA.maxPoints = maxPoints;
        frameA.insertPoints();
        Print("Frame A is smaller and C bigger");
      }

      if (iPointsBCount < iPointsACount && iPointsBCount < iPointsCCount && iPointsCCount > iPointsACount)
      {
        // b is the smallest and c is the biggest
        frameB.isSmaller = true;
        maxPoints = iPointsCCount;
        frameB.maxPoints = maxPoints;
        frameB.insertPoints();
        Print("Frame B is smaller and C bigger");
      }

      if (iPointsBCount < iPointsACount && iPointsBCount < iPointsCCount && iPointsACount > iPointsCCount)
      {
        // b is the smallest and a is the biggest
        frameB.isSmaller = true;
        maxPoints = iPointsACount;
        frameB.maxPoints = maxPoints;
        frameB.insertPoints();
        Print("Frame B is smaller and A bigger");
      }

      if (iPointsCCount < iPointsACount && iPointsCCount < iPointsBCount && iPointsACount > iPointsBCount)
      {
        // c is the smallest and a is the biggest
        frameC.isSmaller = true;
        maxPoints = iPointsACount;
        frameC.maxPoints = maxPoints;
        frameC.insertPoints();
        Print("Frame C is smaller and A bigger");
      }

      else if (iPointsCCount < iPointsACount && iPointsCCount < iPointsBCount && iPointsBCount > iPointsACount)
      {
        // c is the smallest and b is the biggest
        frameC.isSmaller = true;
        maxPoints = iPointsBCount;
        frameC.maxPoints = maxPoints;
        frameC.insertPoints();
        Print("Frame C is smaller and B bigger");
      }

      List<int> selectA = new List<int>() { 0 };
      List<int> selectB = new List<int>() { iShift };
      List<int> selectC = new List<int>() { iShift * 2 };
      List<int> selectD = new List<int>() { iShift * 3 };
      List<int> selectC2 = new List<int>() { iShift * 4 };
      List<int> selectB2 = new List<int>() { iShift * 5 };





      int selectorA = 0;
      int selectorB = iShift;
      int selectorC = iShift * 2;
      int selectorD = iShift * 3;
      int selectorC2 = iShift * 4;
      int selectorB2 = iShift * 5;





      for (int i = 0; i < maxPoints; i++)
      {
        selectorA = (selectorA + iShift * 6) % maxPoints;

        if (selectA.Contains(selectorA))
          selectorA += 1;

        selectA.Add(selectorA);

        selectorB = (selectorB + iShift * 6) % maxPoints;

        if (selectB.Contains(selectorB))
          selectorB += 1;

        selectB.Add(selectorB);

        selectorC = (selectorC + iShift * 6) % maxPoints;

        if (selectC.Contains(selectorC))
          selectorC += 1;

        selectC.Add(selectorC);

        selectorD = (selectorD + iShift * 6) % maxPoints;

        if (selectD.Contains(selectorD))
          selectorD += 1;

        selectD.Add(selectorD);

        selectorC2 = (selectorC2 + iShift * 6) % maxPoints;

        if (selectC2.Contains(selectorC2))
          selectorC2 += 1;

        selectC2.Add(selectorC2);

        selectorB2 = (selectorB2 + iShift * 6) % maxPoints;

        if (selectB2.Contains(selectorB2))
          selectorB2 += 1;

        selectB2.Add(selectorB2);
      }


      // select and weave points

      List<Point3d> finalPoints = new List<Point3d>();

      for (int i = 0; i < maxPoints; i++)
      {

        finalPoints.Add(frameA.windingPins[selectA[i]]);

        finalPoints.Add(frameB.windingPins[selectB[i]]);

        finalPoints.Add(frameC.windingPins[selectC[i]]);

        finalPoints.Add(frameD.windingPins[selectD[i]]);

        finalPoints.Add(frameC.windingPins[selectC2[i]]);

        finalPoints.Add(frameB.windingPins[selectB2[i]]);

      }

      A = frameA.windingPins;
      B = frameB.windingPins;
      C = frameC.windingPins;
      D = frameD.windingPins;
      E = finalPoints;
      F = selectB;
# ---------- c__winding_for_4_frames: C# additional code ----------
  class Frame
  {

    public bool isSmaller;
    public int maxPoints;
    int length;
    public List<int> duplicatePositions;
    public List<Point3d> windingPins;

    // constructor
    public Frame(List<Point3d> _windingPins)
    {

      isSmaller = false;
      windingPins = _windingPins;
      length = windingPins.Count;

    }

    public void insertPoints()
    {

      // generate list of positions

      int space = 5;
      duplicatePositions = new List<int>();

      for (int i = 0; i < length; i++)
      {

        if (i % space == 0)
        {
          duplicatePositions.Add(i);
        }
      }

      for (int i = 0; i < duplicatePositions.Count; i++)
      {

        int pos = duplicatePositions[i] + i;
        Point3d dupValue = windingPins[pos];
        windingPins.Insert(pos, dupValue);

      }
    }




  }
# ---------- end c__winding_for_4_frames ----------
c__winding_for_3_frames = CSharpScript()  # -> out, A, B, C, D, E; inputs iShift: Int32, iPointsA: list of Point3d, iPointsB: list of Point3d, iPointsC: list of Point3d
# ---------- c__winding_for_3_frames: C# ----------
    int iPointsACount = iPointsA.Count;
    int iPointsBCount = iPointsB.Count;
    int iPointsCCount = iPointsC.Count;
    int maxPoints = iPointsACount;

    // create frame objects

    Frame frameA = new Frame(iPointsA);
    Frame frameB = new Frame(iPointsB);
    Frame frameC = new Frame(iPointsC);

    // determine smaller frame

    if (iPointsACount < iPointsBCount && iPointsACount < iPointsCCount && iPointsBCount > iPointsCCount)
    {
      // a is the smallest and b is the biggest
      frameA.isSmaller = true;
      maxPoints = iPointsBCount;
      frameA.maxPoints = maxPoints;
      frameA.insertPoints();
      Print("Frame A is smaller and B bigger");
    }

    if (iPointsACount < iPointsBCount && iPointsACount < iPointsCCount && iPointsCCount > iPointsBCount)
    {
      // a is the smallest and c is the biggest
      frameA.isSmaller = true;
      maxPoints = iPointsCCount;
      frameA.maxPoints = maxPoints;
      frameA.insertPoints();
      Print("Frame A is smaller and C bigger");
    }

    if (iPointsBCount < iPointsACount && iPointsBCount < iPointsCCount && iPointsCCount > iPointsACount)
    {
      // b is the smallest and c is the biggest
      frameB.isSmaller = true;
      maxPoints = iPointsCCount;
      frameB.maxPoints = maxPoints;
      frameB.insertPoints();
      Print("Frame B is smaller and C bigger");
    }

    if (iPointsBCount < iPointsACount && iPointsBCount < iPointsCCount && iPointsACount > iPointsCCount)
    {
      // b is the smallest and a is the biggest
      frameB.isSmaller = true;
      maxPoints = iPointsACount;
      frameB.maxPoints = maxPoints;
      frameB.insertPoints();
      Print("Frame B is smaller and A bigger");
    }

    if (iPointsCCount < iPointsACount && iPointsCCount < iPointsBCount && iPointsACount > iPointsBCount)
    {
      // c is the smallest and a is the biggest
      frameC.isSmaller = true;
      maxPoints = iPointsACount;
      frameC.maxPoints = maxPoints;
      frameC.insertPoints();
      Print("Frame C is smaller and A bigger");
    }

    else if (iPointsCCount < iPointsACount && iPointsCCount < iPointsBCount && iPointsBCount > iPointsACount)
    {
      // c is the smallest and b is the biggest
      frameC.isSmaller = true;
      maxPoints = iPointsBCount;
      frameC.maxPoints = maxPoints;
      frameC.insertPoints();
      Print("Frame C is smaller and B bigger");
    }

    List<int> selectA = new List<int>() { 0 };
    List<int> selectB = new List<int>() { iShift };
    List<int> selectC = new List<int>(){ iShift * 2 };
    List<int> selectB2 = new List<int>(){ iShift * 3 };


    int selectorA = 0;
    int selectorB = iShift;
    int selectorC = iShift * 2;
    int selectorB2 = iShift * 3;

    for (int i = 0; i < maxPoints; i++)
    {
      selectorA = (selectorA + iShift * 4) % maxPoints;

      if (selectA.Contains(selectorA))
        selectorA += 1;

      selectA.Add(selectorA);

      selectorB = (selectorB + iShift * 4) % maxPoints;

      if (selectB.Contains(selectorB))
        selectorB += 1;

      selectB.Add(selectorB);

      selectorC = (selectorC + iShift * 4) % maxPoints;

      if (selectC.Contains(selectorC))
        selectorC += 1;

      selectC.Add(selectorC);

      selectorB2 = (selectorB2 + iShift * 4) % maxPoints;

      if (selectB2.Contains(selectorB2))
        selectorB2 += 1;

      selectB2.Add(selectorB2);
    }


    // select and weave points

    List<Point3d> finalPoints = new List<Point3d>();

    for (int i = 0; i < maxPoints; i++)
    {

      finalPoints.Add(frameA.windingPins[selectA[i]]);


      finalPoints.Add(frameB.windingPins[selectB[i]]);

      finalPoints.Add(frameC.windingPins[selectC[i]]);

      finalPoints.Add(frameB.windingPins[selectB2[i]]);

    }

    A = frameA.windingPins;
    B = frameB.windingPins;
    C = frameC.windingPins;
    D = finalPoints;
    E = selectB;
# ---------- c__winding_for_3_frames: C# additional code ----------
  class Frame
  {

    public bool isSmaller;
    public int maxPoints;
    int length;
    public List<int> duplicatePositions;
    public List<Point3d> windingPins;

    // constructor
    public Frame(List<Point3d> _windingPins)
    {

      isSmaller = false;
      windingPins = _windingPins;
      length = windingPins.Count;

    }

    public void insertPoints()
    {

      // generate list of positions

      int space = 5;
      duplicatePositions = new List<int>();

      for (int i = 0; i < length; i++)
      {

        if (i % space == 0)
        {
          duplicatePositions.Add(i);
        }
      }

      for (int i = 0; i < duplicatePositions.Count; i++)
      {

        int pos = duplicatePositions[i] + i;
        Point3d dupValue = windingPins[pos];
        windingPins.Insert(pos, dupValue);

      }
    }




  }
# ---------- end c__winding_for_3_frames ----------

# ---- group: Input Curves
# Gradient
curve = Curve(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)
# - Defines a gradient for the selection of
# anchors from an initial list.
# - Min % value defines how sparse the
# center is.
# - Number of sections defines in how many
#  percentage groups are you spliting your
# gradient.
# - The shift moves the gradient along the
# curve.
curve_2 = Curve(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)

# ---- group: Parameters
anchors_count = Slider(44, range=0..1000)

# ---- group: Input Curves
# X Approach
curve_3 = Curve(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)
# - Fills up a surface with a X pattern.
# Attention to the bridges formed on the
# edges of curved geometries.
curve_4 = Curve(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)

# ---- group: Parameters
anchors_count_2 = Slider(52, range=0..1000)
shift = Slider(13, range=0..20)

# SHIFT 2D
polygon_sides = Slider(6, range=0..12)
# Syntax Workflow
# CDDF_ 2024
# Rebeca Duque Estrada _ ICD
radius = Slider(8, range=0..100)
count = Slider(100, range=0..100)
# - In this case, if ou only use shift you go back
# from the same point to the next,
# creating V (double) segments,
# and if you use weave you you jump to
# the next point in the same list, creating
# single segments with anchor bridges.
# - the weaving pattern will define the
# spacing between anchors, creating
# more sparce or dense syntaxes
shift_2 = Slider(30, range=-1..50)

# ---- group: Anchors
upper_points = Point([Point(79.830136, 2.096805502, 3.225055567), Point(80.77761732, 2.096805502, 2.93722603), Point(81.72509864, 2.096805502, 2.649396493), Point(82.67257996, 2.096805502, 2.361566956), Point(83.62006128, 2.096805502, 2.073737419), Point(84.56754261, 2.096805502, 1.785907882), Point(85.51502393, 2.096805502, 1.498078345), Point(86.46250525, 2.096805502, 1.210248809), Point(87.40998657, 2.096805502, 0.9224192717), Point(88.35746789, 2.096805502, 0.6345897348), Point(89.30494921, 2.096805502, 0.3467601979), Point(90.25243054, 2.096805502, 0.05893066104), Point(91.19991186, 2.096805502, -0.2288988758), Point(92.14739318, 2.096805502, -0.5167284127), Point(93.0948745, 2.096805502, -0.8045579496)])
# SHIFT 2,5D
#  [Hypar]
lower_points = Point([Point(93.19091724, -25.41856365, 3.225055567), Point(92.24343648, -25.41753541, 2.93722603), Point(91.29595571, -25.41650716, 2.649396493), Point(90.34847495, -25.41547892, 2.361566956), Point(89.40099419, -25.41445067, 2.073737419), Point(88.45351342, -25.41342243, 1.785907882), Point(87.50603266, -25.41239418, 1.498078345), Point(86.5585519, -25.41136593, 1.210248809), Point(85.61107113, -25.41033769, 0.9224192717), Point(84.66359037, -25.40930944, 0.6345897348), Point(83.71610961, -25.4082812, 0.3467601979), Point(82.76862884, -25.40725295, 0.05893066104), Point(81.82114808, -25.4062247, -0.2288988758), Point(80.87366731, -25.40519646, -0.5167284127), Point(79.92618655, -25.40416821, -0.8045579496)])
# - In this case, you connect two lists
# of points and reverse one of them
# generating this typical corner syntax
# - For the crossings, you can weave
# two halves of each list
right_points = Point([Point(94.63083549, -24.44899556, 3.42078235), Point(94.63083549, -23.47502576, 3.242038038), Point(94.63083549, -22.50105596, 3.063293726), Point(94.63083549, -21.52708617, 2.884549414), Point(94.63083549, -20.55311637, 2.705805102), Point(94.63083549, -19.57914657, 2.527060791)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])
left_points = Point([Point(78.39097038, 1.139957043, 3.422989219), Point(78.39097038, 0.165987245, 3.244244907), Point(78.39097038, -0.8079825533, 3.065500595), Point(78.39097038, -1.781952352, 2.886756283), Point(78.39097038, -2.75592215, 2.708011971), Point(78.39097038, -3.729891948, 2.52926766)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])

# ----
pattern = Panel("""0
1
1
0""")

# ----
# SHIFT 3D
#  [Body]
height = Slider(20, range=0..20)

# ---- group: Parameters
shift_3 = Slider(9, range=-1..50)
radius_2 = Slider(19, range=0..100)
polygon_sides_2 = Slider(3, range=0..12)
anchors_count_3 = Slider(40, range=0..100)
# - In this case, if ou only use shift you go back
# from the same point
# to the next on the opposite frame
# creating V (double) segments without
# forming a lattice, and if you use weave
#  you jump to the next point in the same list,
#  creating single segments.
# - the weaving pattern will define the
# spacing between anchors, creating more
#  sparce or dense syntaxes
# - if you use the continuous shift tool, it will
# go from point 0 in the first list to the n+shift in
#  the next and n+shift on the way back,
# forming a polyline
component_height = Slider(8, range=0..10)

# ----
points = PointList(Points=lower_points)
points_2 = PointList(Points=left_points)

# ---- group: Divide Curves
divide_curve = DivideCurve(Curve=curve_3, Count=anchors_count_2, Kinks=False)  # -> simplify(Points), Tangents, Parameters
divide_curve_2 = DivideCurve(Curve=curve_4, Count=anchors_count_2, Kinks=False)  # -> simplify(Points), Tangents, Parameters

# ----
division = Division(A=height, B=4)
Z = UnitZ(Factor=division)
Z_2 = UnitZ(Factor=height)

c__x_approach = CSharpScript(AnchorsCount=anchors_count_2, Anchors_A=divide_curve.Points, Anchors_B=divide_curve_2.Points, shift=shift)  # -> out, finalList; inputs AnchorsCount: Int32, Anchors_A: list of Point3d, Anchors_B: list of Point3d, shift: Int32
# ---------- c__x_approach: C# ----------
    List<Point3d> FinalAnchors = new List<Point3d>();


    for (int i = 0; i < AnchorsCount - shift; i++){

      Point3d a = Anchors_A[i];
      Point3d b = Anchors_B[i + shift];
      Point3d c = Anchors_B[i];
      Point3d d = Anchors_A[i + shift];
      FinalAnchors.Add(a);
      FinalAnchors.Add(b);
      FinalAnchors.Add(c);
      FinalAnchors.Add(d);

    }

    finalList = FinalAnchors;
# ---------- end c__x_approach ----------
polyline = PolyLine(Vertices=c__x_approach.finalList, Closed=False)
sub_curve = SubCurve(BaseCurve=reparameterize(polyline), Domain=Slider(1, range=0..1))

division_2 = Division(A=anchors_count_3, B=2)
point = Point(Point(0, 0, 0))

number_of_sections_defines_the_gradient = Slider(5, range=0..40)  # "Number of Sections (defines the gradient resolution)"
shift_list_to_move_along_curve = Slider(6, range=0..40)
min_value = Slider(0.31, range=0..1)
divide_curve_3 = DivideCurve(Curve=curve, Count=anchors_count, Kinks=False)  # -> simplify(Points), Tangents, Parameters
divide_curve_4 = DivideCurve(Curve=curve_2, Count=anchors_count, Kinks=False)  # -> simplify(Points), Tangents, Parameters

# ---- group: Creates the secList
construct_domain = ConstructDomain(DomainStart=1, DomainEnd=min_value)
range = Range(Domain=construct_domain, Steps=number_of_sections_defines_the_gradient)
reverse_list = ReverseList(List=range)
cull_index = CullIndex(List=reverse_list, Indices=0, Wrap=True)
merge = Merge(Data1=range, Data2=cull_index)  # -> flatten(Result)
shift_list = ShiftList(List=merge, Shift=shift_list_to_move_along_curve, Wrap=True)

# ----
c__gradientanchorselection = CSharpScript(initPointsA=divide_curve_3.Points, initPointsB=divide_curve_4.Points, secList=shift_list)  # -> out, oSelectedIndicesA, oSelectedPointsA, oSelectedIndicesB, oSelectedPointsB; inputs initPointsA: list of Point3d, initPointsB: list of Point3d, secList: list of Double
# ---------- c__gradientanchorselection: C# usings ----------
using System.IO;
using System.Text.RegularExpressions;
using System.Linq;
# ---------- c__gradientanchorselection: C# ----------
    //___________ This script selects two lists of points based on a gradient list defined by the user_________
    //___________ re_duque_11/04/22___________________________________________________________________________


    double numPoints = initPointsA.Count(); //total number of points in initPoints
    double numSection = secList.Count(); // total number of sections (gradient resolution)
    List<int> SelectedPointsIndicesA = new List<int>();
    List<Point3d> SelectedPointsA = new List<Point3d>();
    List<int> SelectedPointsIndicesB = new List<int>();
    List<Point3d> SelectedPointsB = new List<Point3d>();
    int i = 0;

    Print("numSection=" + numSection.ToString());

    while (i < numPoints) // go through the list until reaches its end without defining the step size
    {

      Print("i=" + i.ToString());

      // add the i to the list
      SelectedPointsA.Add(initPointsA[i]); //adds current Point in A
      SelectedPointsIndicesA.Add(i); // adds current index in A
      SelectedPointsB.Add(initPointsB[i]); //adds current Point in B
      SelectedPointsIndicesB.Add(i); // adds current index in B

      // which section are we in? Remap the indexes to their respective sections
      int mySection = (int) Math.Floor(i / numPoints * numSection); // i/numPoints gives the relative position of the index in the list. (Math.Floor rounds down the number)

      Print("mySection=" + mySection.ToString());

      //what is the section density? calculate the skip factor: Density/1
      int skip = (int) Math.Round(1 / secList[mySection]); // secList[mySection] gives the skip value based on the list you defined with the densitity ratios

      // gets i value

      i = i + skip;


    }


    oSelectedPointsA = SelectedPointsA;
    oSelectedIndicesA = SelectedPointsIndicesA;

    oSelectedPointsB = SelectedPointsB;
    oSelectedIndicesB = SelectedPointsIndicesB;
# ---------- end c__gradientanchorselection ----------
final_seclist = Panel(shift_list)

lng = ListLength(List=c__gradientanchorselection.oSelectedPointsA)
shift_4 = Slider(6, range=0..20)
# + X Approach
c__x_approach_2 = CSharpScript(
    AnchorsCount=lng,
    Anchors_A=c__gradientanchorselection.oSelectedPointsA,
    Anchors_B=c__gradientanchorselection.oSelectedPointsB,
    shift=shift_4)  # -> out, finalList; inputs AnchorsCount: Int32, Anchors_A: list of Point3d, Anchors_B: list of Point3d, shift: Int32; same code as c__x_approach
polyline_2 = PolyLine(Vertices=c__x_approach_2.finalList, Closed=False)
sub_curve_2 = SubCurve(BaseCurve=reparameterize(polyline_2), Domain=Slider(1, range=0..1))

number_slider = Slider(6, range=0..10)
panel = Panel("""0
1
1
0""")
# +Weaving
shift_list_2 = ShiftList(List=c__gradientanchorselection.oSelectedPointsB, Shift=number_slider, Wrap=False)
shift_list_3 = ShiftList(List=c__gradientanchorselection.oSelectedPointsA, Shift=number_slider, Wrap=False)
weave = Weave(Pattern=panel, Stream0=c__gradientanchorselection.oSelectedPointsA, Stream1=shift_list_2, NullGaps=False)
weave_2 = Weave(Pattern=panel, Stream0=shift_list_3, Stream1=c__gradientanchorselection.oSelectedPointsB, NullGaps=False)
polyline_3 = PolyLine(Vertices=weave, Closed=False)
polyline_4 = PolyLine(Vertices=weave_2, Closed=False)

curve_5 = Curve(polyline_2)
curve_6 = Curve([polyline_3, polyline_4])

# ----
# [Reinforcement]
# - Important to consider here which are your connection points.
# - It will normally be used for CFRP.
panel_2 = Panel("""FALSE
FALSE
FALSE
FALSE
FALSE
FALSE
FALSE
TRUE
TRUE
TRUE""")
shift_5 = Slider(6, range=-1..50)

# ---- group: Crossings
list_length = ListLength(List=left_points)
list_length_2 = ListLength(List=right_points)
division_3 = Division(A=list_length, B=2)
division_4 = Division(A=list_length_2, B=2)
split_list = SplitList(List=left_points, Index=division_3)  # -> ListA, ListB
split_list_2 = SplitList(List=right_points, Index=division_4)  # -> ListA, ListB

# ----
pt = Point(split_list_2.ListA)
pt_2 = Point(split_list_2.ListB)
pt_3 = Point(split_list.ListB)
pt_4 = Point(split_list.ListA)

# ---- group: Corner Reinforcements
weave_3 = Weave(Pattern=pattern, Stream0=reverse(pt), Stream1=lower_points, NullGaps=False)
weave_4 = Weave(Pattern=pattern, Stream0=pt_2, Stream1=reverse(upper_points), NullGaps=False)
weave_5 = Weave(Pattern=pattern, Stream0=reverse(pt_4), Stream1=upper_points, NullGaps=False)
weave_6 = Weave(Pattern=pattern, Stream0=pt_3, Stream1=reverse(lower_points), NullGaps=False)
polyline_5 = PolyLine(Vertices=flatten(weave_3), Closed=False)
polyline_6 = PolyLine(Vertices=flatten(weave_4), Closed=False)
polyline_7 = PolyLine(Vertices=flatten(weave_5), Closed=False)
polyline_8 = PolyLine(Vertices=flatten(weave_6), Closed=False)

# ----
polygon = Polygon(Plane=PlaneXY(0, 0, 0), Radius=radius, Segments=polygon_sides, FilletRadius=0)  # -> Polygon, Length
# DESIGN
divide_curve_5 = DivideCurve(Curve=polygon.Polygon, Count=count, Kinks=False)  # -> Points, Tangents, Parameters
shift_list_4 = ShiftList(List=divide_curve_5.Points, Shift=shift_2, Wrap=True)
# FINAL POLYLINES
sub_curve_3 = SubCurve(BaseCurve=reparameterize(polyline_5), Domain=Slider(0.915, range=0..1))

# ---- group: Crossings (continued)
weave_7 = Weave(Pattern=pattern, Stream0=reverse(pt_4), Stream1=pt, NullGaps=False)
weave_8 = Weave(Pattern=pattern, Stream0=pt_3, Stream1=reverse(pt_2), NullGaps=False)
polyline_9 = PolyLine(Vertices=flatten(weave_7), Closed=False)
polyline_10 = PolyLine(Vertices=flatten(weave_8), Closed=False)

# ---- group: Pure Shift
line = Line(StartPoint=divide_curve_5.Points, EndPoint=shift_list_4)
explode = Explode(Curve=line, Recursive=True)  # -> Segments, Vertices
polyline_11 = PolyLine(Vertices=flatten(explode.Vertices), Closed=False)

# ---- group: Weaving
panel_3 = Panel("""0
1
1
0""")
weave_9 = Weave(Pattern=panel_3, Stream0=divide_curve_5.Points, Stream1=shift_list_4, NullGaps=False)
polyline_12 = PolyLine(Vertices=flatten(weave_9), Closed=False)

# ----
polygon_2 = Polygon(Plane=PlaneXY(0, 0, 0), Radius=radius_2, Segments=polygon_sides_2, FilletRadius=0)  # -> Polygon, Length
unit_z = UnitZ(Factor=component_height)
move = Move(Geometry=polygon_2.Polygon, Motion=unit_z)  # -> Geometry, Transform

pcen = PolygonCenter(Polyline=polygon_2.Polygon)  # -> CenterV, CenterE, CenterA
move_2 = Move(Geometry=pcen.CenterV, Motion=Z_2)  # -> Geometry, Transform
move_3 = Move(Geometry=pcen.CenterV, Motion=Z)  # -> Geometry, Transform
divide = DivideCurve(Curve=polygon_2.Polygon, Count=polygon_sides_2, Kinks=False)  # -> Points, Tangents, Parameters
ln = Line(StartPoint=move_2.Geometry, EndPoint=divide.Points)
explode_2 = Explode(Curve=polygon_2.Polygon, Recursive=True)  # -> Segments, Vertices
shift_6 = ShiftList(List=divide.Points, Shift=1, Wrap=True)
pl_3pt = Plane3Pt(PointA=move_2.Geometry, PointB=divide.Points, PointC=shift_6)
sph = Sphere(Base=move_3.Geometry, Radius=Slider(9.1, range=0..10))
item = ListItem(List=pl_3pt, Index=0, Wrap=True)
item_2 = ListItem(List=pl_3pt, Index=1, Wrap=True)
item_3 = ListItem(List=pl_3pt, Index=2, Wrap=True)

line_2 = Line([explode_2.Segments, ln])
sec = BrepPlane(Brep=sph, Plane=item_3)  # -> Curves, Points
sec_2 = BrepPlane(Brep=sph, Plane=item)  # -> Curves, Points
sec_3 = BrepPlane(Brep=sph, Plane=item_2)  # -> Curves, Points

divide_curve_6 = DivideCurve(Curve=sec.Curves, Count=anchors_count_3, Kinks=False)  # -> reverse(Points), Tangents, Parameters
crvprox = CurveProximity(CurveA=sec_3.Curves, CurveB=sec.Curves)  # -> PointA, PointB, Distance
offcrv = OffsetCurve(
    Curve=[sec_2.Curves, sec_3.Curves, sec.Curves],
    Plane=[item, item_2, sec_3.Curves, item_3],
    Distance=-0.3,
    BothSides=0,
    Kinks=0,
    CapType=1)
crvprox_2 = CurveProximity(CurveA=sec_2.Curves, CurveB=[sec_3.Curves, sec.Curves])  # -> PointA, PointB, Distance
shift_7 = ShiftList(List=divide_curve_6.Points, Shift=shift_3, Wrap=True)
ln_2 = Line(StartPoint=crvprox.PointA, EndPoint=crvprox.PointB)
ln_3 = Line(StartPoint=crvprox_2.PointA, EndPoint=crvprox_2.PointB)
split = SplitList(List=divide_curve_6.Points, Index=division_2)  # -> ListA, ListB
split_2 = SplitList(List=shift_7, Index=division_2)  # -> ListA, ListB
ext = ExtendCurve(Curve=[ln_3, ln_2], Type=0, Start=0.5, End=0.5)
pt_5 = Point(split.ListA)
pt_6 = Point(split.ListB)
pt_7 = Point(split_2.ListA)
pt_8 = Point(split_2.ListB)
pipe = Pipe(Curve=[offcrv, ext], Radius=0.2, Caps=0)

divide_curve_7 = DivideCurve(Curve=sec_2.Curves, Count=anchors_count_3, Kinks=False)  # -> reverse(Points), Tangents, Parameters
divide_curve_8 = DivideCurve(Curve=sec_3.Curves, Count=anchors_count_3, Kinks=False)  # -> Points, Tangents, Parameters
shift_list_5 = ShiftList(List=divide_curve_7.Points, Shift=reverse(shift_3), Wrap=True)

cull_pattern = CullPattern(List=divide_curve_7.Points, CullPattern=panel_2)
cull_pattern_2 = CullPattern(List=divide_curve_8.Points, CullPattern=panel_2)
c__shift_approach = CSharpScript(iShift=shift_5, iPointsA=flatten(cull_pattern), iPointsB=flatten(cull_pattern_2))  # -> out, oFinalPoints; inputs iShift: Int32, iPointsA: list of Point3d, iPointsB: list of Point3d
# ---------- c__shift_approach: C# ----------
    int iPointsACount = iPointsA.Count;
    int iPointsBCount = iPointsB.Count;
    int maxPoints = iPointsACount;

    // create frame objects

    Frame frameA = new Frame(iPointsA);
    Frame frameB = new Frame(iPointsB);


    // determine smaller frame

    if (iPointsACount < iPointsBCount){
      // a is smaller
      frameA.isSmaller = true;
      maxPoints = iPointsBCount;
      frameA.maxPoints = maxPoints;
      frameA.insertPoints();
      Print("Frame A is smaller");
    }

    else if (iPointsBCount < iPointsACount){
      // b is smaller
      frameB.isSmaller = true;
      maxPoints = iPointsACount;
      frameB.maxPoints = maxPoints;
      frameB.insertPoints();
      Print("Frame B is smaller");
    }

    // create selectors

    List < int > selectA = new List<int>(){0};
    List < int> selectB = new List<int>(){iShift};

    int selectorA = 0;
    int selectorB = 0;

    for (int i = 0; i < maxPoints; i++){

      selectorA = (selectorA + iShift * 2) % maxPoints;

      if(selectA.Contains(selectorA))
        selectorA += 1;

      selectA.Add(selectorA);

      selectorB = (selectorA + iShift) % maxPoints;

      if(selectB.Contains(selectorB))
        selectorB += 1;

      selectB.Add(selectorB);

    }


    // select and weave points

    List<Point3d> finalPoints = new List<Point3d>();

    for (int i = 0; i < maxPoints; i++){

      finalPoints.Add(frameA.windingPins[selectA[i]]);
      finalPoints.Add(frameB.windingPins[selectB[i]]);
    }


    oFinalPoints = finalPoints;
# ---------- c__shift_approach: C# additional code ----------
  class Frame{

    public bool isSmaller;
    public int maxPoints;
    int length;
    public List<int>duplicatePositions;
    public List<Point3d> windingPins;

    // constructor
    public Frame(List<Point3d>_windingPins){

      isSmaller = false;
      windingPins = _windingPins;
      length = windingPins.Count;

    }

    public void insertPoints(){

      // generate list of positions

      int space = 5;
      duplicatePositions = new List<int>();

      for (int i = 0; i < length; i++){

        if(i % space == 0){
          duplicatePositions.Add(i);
        }
      }

      for(int i = 0; i < duplicatePositions.Count; i++){

        int pos = duplicatePositions[i] + i;
        Point3d dupValue = windingPins[pos];
        windingPins.Insert(pos, dupValue);

      }
    }
  }
# ---------- end c__shift_approach ----------
polyline_13 = PolyLine(Vertices=c__shift_approach.oFinalPoints, Closed=False)
sub_curve_4 = SubCurve(BaseCurve=reparameterize(polyline_13), Domain=Slider(1, range=0..1))

points_3 = PointList(Points=cull_pattern_2)
points_4 = PointList(Points=cull_pattern)
shift_8 = ShiftList(List=divide_curve_7.Points, Shift=expr("-x+4", shift_3), Wrap=True)
split_3 = SplitList(List=divide_curve_8.Points, Index=division_2)  # -> ListA, ListB
shift_9 = ShiftList(List=divide_curve_7.Points, Shift=expr("-x", shift_3), Wrap=True)
pt_9 = Point(split_3.ListA)
pt_10 = Point(split_3.ListB)
split_4 = SplitList(List=shift_8, Index=division_2)  # -> ListA, ListB
split_5 = SplitList(List=shift_9, Index=division_2)  # -> ListA, ListB
pt_11 = Point(split_4.ListA)
pt_12 = Point(split_4.ListB)
pt_13 = Point(split_5.ListB)
pt_14 = Point(split_5.ListA)

# ---- group: Continuous Shift
c__shift_approach_2 = CSharpScript(iShift=shift_3, iPointsA=flatten(divide_curve_7.Points), iPointsB=flatten(divide_curve_8.Points))  # -> out, oFinalPoints; inputs iShift: Int32, iPointsA: list of Point3d, iPointsB: list of Point3d
# ---------- c__shift_approach_2: C# ----------
    int iPointsACount = iPointsA.Count;
    int iPointsBCount = iPointsB.Count;
    int maxPoints = iPointsACount;

    // create frame objects

    Frame frameA = new Frame(iPointsA);
    Frame frameB = new Frame(iPointsB);


    // determine smaller frame

    if (iPointsACount < iPointsBCount){
      // a is smaller
      frameA.isSmaller = true;
      maxPoints = iPointsBCount;
      frameA.maxPoints = maxPoints;
      frameA.insertPoints();
      Print("Frame A is smaller");
    }

    else if (iPointsBCount < iPointsACount){
      // b is smaller
      frameB.isSmaller = true;
      maxPoints = iPointsACount;
      frameB.maxPoints = maxPoints;
      frameB.insertPoints();
      Print("Frame B is smaller");
    }

    // create selectors

    List < int > selectA = new List<int>(){0};
    List < int> selectB = new List<int>(){iShift};

    int selectorA = 0;
    int selectorB = 0;

    for (int i = 0; i < maxPoints; i++){

      selectorA = (selectorA + iShift * 2) % maxPoints; // % remainder: Computes the remainder after dividing its left operand by its right operand 

      if(selectA.Contains(selectorA))
        selectorA += 1;

      selectA.Add(selectorA);

      selectorB = (selectorA + iShift) % maxPoints;

      if(selectB.Contains(selectorB))
        selectorB += 1;

      selectB.Add(selectorB);

    }


    // select and weave points

    List<Point3d> finalPoints = new List<Point3d>();

    for (int i = 0; i < maxPoints; i++){

      finalPoints.Add(frameA.windingPins[selectA[i]]);
      finalPoints.Add(frameB.windingPins[selectB[i]]);
    }


    oFinalPoints = finalPoints;
# ---------- c__shift_approach_2: C# additional code ----------
  class Frame{

    public bool isSmaller;
    public int maxPoints;
    int length;
    public List<int>duplicatePositions;
    public List<Point3d> windingPins;

    // constructor
    public Frame(List<Point3d>_windingPins){

      isSmaller = false;
      windingPins = _windingPins;
      length = windingPins.Count;

    }

    public void insertPoints(){

      // generate list of positions

      int space = 5;
      duplicatePositions = new List<int>();

      for (int i = 0; i < length; i++){

        if(i % space == 0){
          duplicatePositions.Add(i);
        }
      }

      for(int i = 0; i < duplicatePositions.Count; i++){

        int pos = duplicatePositions[i] + i;
        Point3d dupValue = windingPins[pos];
        windingPins.Insert(pos, dupValue);

      }
    }
  }
# ---------- end c__shift_approach_2 ----------
polyline_14 = PolyLine(Vertices=flatten(c__shift_approach_2.oFinalPoints), Closed=True)

# ----
line_3 = Line(StartPoint=pt_6, EndPoint=pt_9)
line_4 = Line(StartPoint=pt_8, EndPoint=pt_9)
sph_2 = Sphere(Base=pt_13, Radius=0.3)
line_5 = Line(StartPoint=pt_13, EndPoint=pt_10)
explode_3 = Explode(Curve=line_3, Recursive=True)  # -> Segments, Vertices
explode_4 = Explode(Curve=line_4, Recursive=True)  # -> Segments, Vertices
polyline_15 = PolyLine(Vertices=flatten(explode_4.Vertices), Closed=False)
polyline_16 = PolyLine(Vertices=flatten(explode_3.Vertices), Closed=False)

# ---- group: BODY
# LAYERS AND FRAMES
curve_7 = Curve(polyline_14)

# ---- group: REINFORCEMENT
curve_8 = Curve(polyline_13)

# ---- group: FRAME A
point_2 = Point(divide_curve_7.Points)

# ---- group: FRAME B
point_3 = Point(divide_curve_8.Points)

# ---- group: Frame B
list_indices = ListIndices(List=point_3)
concatenate = Concatenate(FragmentA=list_indices, FragmentB="B")
concatenate_2 = Concatenate(FragmentA=concatenate, FragmentB=point_3)

# ---- group: Frame A
list_indices_2 = ListIndices(List=point_2)
concatenate_3 = Concatenate(FragmentA=list_indices_2, FragmentB="A")
concatenate_4 = Concatenate(FragmentA=concatenate_3, FragmentB=point_2)

# ----
# SYNTAX  LIST AND
# ANCHOR'S POSITIONS
body = BODY(syntax_pline=curve_7, point=point_2, point_2=point_3)
reinf = BODY(syntax_pline=curve_8, point=point_2, point_2=point_3)

anchors_coordinates_frame_a = Panel(concatenate_4)
anchors_coordinates_frame_b = Panel(concatenate_2)

body_syntax = Panel(body)
reinf_syntax = Panel(reinf)

shift_list_6 = ShiftList(List=split_3.ListB, Shift=expr("x/2", shift_3), Wrap=True)
sub_curve_5 = SubCurve(BaseCurve=reparameterize(polyline_14), Domain=Slider(1, range=0..1))

# ---- group: Weaving
panel_4 = Panel("""0
1
1
1
0
0""")
weave_10 = Weave(Pattern=panel_4, Stream0=divide_curve_7.Points, Stream1=shift_list_6, NullGaps=False)
weave_11 = Weave(Pattern=panel_4, Stream0=divide_curve_8.Points, Stream1=shift_list_5, NullGaps=False)
polyline_17 = PolyLine(Vertices=flatten(weave_10), Closed=False)
polyline_18 = PolyLine(Vertices=flatten(weave_11), Closed=False)

# ---- group: Double Way Shift (no crossing)
line_6 = Line(StartPoint=pt_12, EndPoint=pt_10)
explode_5 = Explode(Curve=line_5, Recursive=True)  # -> Segments, Vertices

# ----
explode_6 = Explode(Curve=line_6, Recursive=True)  # -> Segments, Vertices

# ---- group: Double Way Shift (no crossing) (continued)
polyline_19 = PolyLine(Vertices=flatten(explode_6.Vertices), Closed=False)

# ----
polyline_20 = PolyLine(Vertices=flatten(explode_5.Vertices), Closed=False)

sub_curve_6 = SubCurve(BaseCurve=reparameterize(polyline_20), Domain=Slider(1, range=0..1))

curve_9 = Curve([polyline_9, polyline_10])
curve_10 = Curve([polyline_5, polyline_6, polyline_7, polyline_8])
curve_11 = Curve(polyline_11)
curve_12 = Curve(polyline_12)
curve_13 = Curve(polyline_13)
curve_14 = Curve(polyline)
curve_15 = Curve(polyline_14)
curve_16 = Curve([polyline_19, polyline_20])
curve_17 = Curve([polyline_17, polyline_18])

number_slider_2 = Slider(20, range=0..100)
interpolate = Interpolate(Vertices=divide_curve_7.Points, Degree=3, Periodic=True, KnotStyle=1)  # -> Curve, Length, Domain
interpolate_2 = Interpolate(Vertices=divide_curve_8.Points, Degree=3, Periodic=True, KnotStyle=1)  # -> Curve, Length, Domain
minimal_surface = MinimalSurface(
    C0Curve=interpolate.Curve,
    C1Curve=interpolate_2.Curve,
    UCount=number_slider_2,
    VCount=number_slider_2,
    Itteration=20,
    SurfaceUDegree=3,
    SurfaceVDegree=3)  # -> UVPointGrid, ResultingSurface
# Geodesic Curves
# [Quick Visualization]
control_points = ControlPoints(Curve=interpolate.Curve)  # -> Points, Weights, Knots
md_slider = MDSlider(
    SliderMode=0,
    slider_value=Point(0.502368927, 0.5028657913, 0.5),
    x_domain=Domain(0, 1),
    y_domain=Domain(0, 1),
    z_domain=Domain(0, 1))
list_length_3 = ListLength(List=control_points.Points)
iso_curve = IsoCurve(Surface=reparameterize(minimal_surface.ResultingSurface), UVPoint=md_slider)  # -> UIsocurve, VIsocurve

minimal_surface_2 = MinimalSurface(
    C0Curve=interpolate.Curve,
    C1Curve=interpolate_2.Curve,
    UCount=number_slider_2,
    VCount=number_slider_2,
    Itteration=20,
    SurfaceUDegree=3,
    SurfaceVDegree=3)  # -> UVPointGrid, ResultingSurface
rebuild_curve = RebuildCurve(Curve=iso_curve.VIsocurve, Count=list_length_3, EndTangents=False)

polyline_21 = PolyLine(Vertices=c__shift_approach_2.oFinalPoints, Closed=False)
explode_7 = Explode(Curve=polyline_21, Recursive=True)  # -> Segments, Vertices
end_points = EndPoints(Curve=explode_7.Segments)  # -> Start, End

entwine = Entwine(Branch00=interpolate.Curve, Branch01=rebuild_curve, Branch02=interpolate_2.Curve, FlattenInputs=True)  # -> flatten(Result)

align_curve_seams = AlignCurveSeams(Curves=entwine, Guide=point, Snap=False, Iterative=True)  # -> Aligned, Points, ResultBoolean

loft = Loft(
    Curves=align_curve_seams.Aligned,
    Options={Adjust=False, Closed=False, LoftEnds=0, LoftSimp=1, LoftType=0, Rebuild=2, Refit=0.01})

geodesic = Geodesic(Surface=loft, Start=end_points.Start, End=end_points.End)

curve_18 = Curve(geodesic)

# ==== cluster BODY
syntax_pline = ClusterInput()
point = ClusterInput()
point_2 = ClusterInput()
syntax_pline_2 = Curve(syntax_pline)
point_3 = Point(point)
point_4 = Point(point_2)
lng = ListLength(List=point_4)
lng_2 = ListLength(List=point_3)
c_script = CSharpScript(lengthA=lng, lengthB=lng_2)  # -> out, outA, outB; inputs lengthA: Int32, lengthB: Int32
# ---------- c_script: C# ----------
    List<string> valA = new List<string>();
    List<string> valB = new List<string>();


    for (int i = 0; i < lengthA; i++){
      valA.Add("A");

    }

    for (int i = 0; i < lengthB; i++){
      valB.Add("B");

    }


    outA = valA;
    outB = valB;
# ---------- end c_script ----------
series = Series(Start=0, Step=1, Count=lng)
series_2 = Series(Start=0, Step=1, Count=lng_2)
cp = ControlPoints(Curve=syntax_pline_2)  # -> Points, Weights, Knots
points = Entwine(Branch00=point_4, Branch01=point_3, FlattenInputs=True)  # -> flatten(Result)
indices = Entwine(Branch00=series, Branch01=series_2, FlattenInputs=True)  # -> flatten(Result)
identifiers = Entwine(Branch00=c_script.outA, Branch01=c_script.outB, FlattenInputs=True)  # -> flatten(Result)
cp_2 = ClosestPoint(Point=cp.Points, Cloud=points)  # -> ClosestPoint, CPIndex, Distance
item = ListItem(List=identifiers, Index=cp_2.CPIndex, Wrap=True)
item_2 = ListItem(List=indices, Index=cp_2.CPIndex, Wrap=True)
concat = Concatenate(FragmentA=item_2, FragmentB=item)
R = ClusterOutput(concat)
