# Grasshopper definition Tensegrity_fiber_cubicframe.gh (Grasshopper 1.0.7)
# plug-ins: Kangaroo Components, Kangaroo2 Components

polygon = Polygon(Plane=PlaneXY(0, 0, 0), Radius=Slider(0.89, range=0..10), Segments=Slider(3, range=0..10), FilletRadius=0)  # -> Polygon, Length
Z = UnitZ(Factor=Slider(2.23, range=0..10))
move = Move(Geometry=polygon.Polygon, Motion=Z)  # -> Geometry, Transform
cp = ControlPoints(Curve=polygon.Polygon)  # -> Points, Weights, Knots
cp_2 = ControlPoints(Curve=move.Geometry)  # -> Points, Weights, Knots
duppt = RemoveDuplicatePts(Points=cp_2.Points, Tolerance=0.01)
duppt_2 = RemoveDuplicatePts(Points=cp.Points, Tolerance=0.01)
shift = ShiftList(List=duppt, Shift=1, Wrap=True)
explode = Explode(Curve=move.Geometry, Recursive=True)  # -> Segments, Vertices
explode_2 = Explode(Curve=polygon.Polygon, Recursive=True)  # -> Segments, Vertices
ln = Line(StartPoint=duppt_2, EndPoint=duppt)
ln_2 = Line(StartPoint=duppt_2, EndPoint=shift)
merge = Merge(Data1=ln, Data2=explode_2.Segments, Data3=explode.Segments)  # -> flatten(Result)
merge_2 = Merge(Data1=flatten(polygon.Polygon), Data2=flatten(move.Geometry), Data3=flatten(ln), Data4=flatten(ln_2))
len = Length(Curve=merge)
multiplication = Multiplication(A=len, B=Slider(0.582, range=0..1))
length_line = LengthLine(Line=merge, Length=multiplication, Strength=10)
length_line_2 = LengthLine(Line=ln_2, Length=ln_2, Strength=Slider(1000, range=0..1000))
show = Show(G=merge_2)
merge_3 = Merge(Data1=flatten(show), Data2=flatten(length_line_2), Data3=flatten(length_line))
solver = Solver(
    GoalObjects=merge_3,
    Reset=Button(),
    Restart=False,
    Parallel=True,
    Threshold=1e-15,
    Tolerance=0.01,
    AddCurrent=False,
    On=Toggle(True))  # -> V, O
lng = ListLength(List=merge_2)  # -> expr("x-1", Length)
subset = SubList(List=solver.O, Domain=lng, Wrap=True)  # -> List, Index
split = SplitList(List=subset.List, Index=Slider(5, range=0..10))  # -> ListA, ListB
list_item = ListItem(List=split.ListA, Index=0, Wrap=True)  # -> Item, Item1, Item2, Item3, Item4
curve = Curve(list_item.Item2)
curve_2 = Curve(list_item.Item3)
curve_3 = Curve(list_item.Item4)
curve_4 = Curve(list_item.Item)
explode_3 = Explode(Curve=curve_4, Recursive=True)  # -> Segments, Vertices
end_points = EndPoints(Curve=curve)  # -> Start, End
end_points_2 = EndPoints(Curve=curve_2)  # -> Start, End
end_points_3 = EndPoints(Curve=curve_3)  # -> Start, End
list_item_2 = ListItem(List=explode_3.Vertices, Index=0, Wrap=True)  # -> Item, Item1, Item2
point = Point(list_item_2.Item1)
point_2 = Point(list_item_2.Item2)
point_3 = Point(list_item_2.Item)
pipe = Pipe(Curve=split.ListB, Radius=Slider(0.046, range=0..1), Caps=0)
preview = CustomPreview(Geometry=pipe, Shader=ColourSwatch(SwatchColor=RGB(255, 56, 56)))
preview_2 = CustomPreview(Geometry=split.ListA, Shader=ColourSwatch(SwatchColor=RGB(0, 0, 0)))
plane_3pt = Plane3Pt(PointA=end_points.Start, PointB=end_points.End, PointC=point)

plane_3pt_2 = Plane3Pt(PointA=end_points_2.Start, PointB=end_points_2.End, PointC=point_2)

plane_3pt_3 = Plane3Pt(PointA=end_points_3.Start, PointB=end_points_3.End, PointC=point_3)

item = ListItem(List=split.ListB, Index=0, Wrap=True)
crv = Curve(item)
item_2 = ListItem(List=split.ListB, Index=1, Wrap=True)
item_3 = ListItem(List=split.ListB, Index=2, Wrap=True)

# ---- group: Input Curves
curve_5 = Curve(item_2)
curve_6 = Curve(item_3)

# ---- group: Parameters
anchors_count = Slider(30, range=0..1000)

# ---- group: Input Curves
curve_7 = Curve(item)
# - Defines a gradient for the selection of
# anchors from an initial list.
# - Min % value defines how sparse the
# center is.
# - Number of sections defines in how many
#  percentage groups are you spliting your
# gradient.
# - The shift moves the gradient along the
# curve.
curve_8 = Curve(item_2)

curve_9 = Curve(item)
curve_10 = Curve(item_3)

# ---- group: Parameters
anchors_count_2 = Slider(30, range=0..1000)

anchors_count_3 = Slider(30, range=0..1000)

# ----
xy_plane = XYPlane(Origin=Point(0, 0, 0))
deconstruct_plane = DeconstructPlane(Plane=xy_plane)  # -> Origin, XAxis, YAxis, ZAxis
amplitude = Amplitude(Vector=deconstruct_plane.YAxis, Amplitude=Slider(-1, range=-12..0))
construct_plane = ConstructPlane(Origin=Point(0, 0, 0), XAxis=amplitude, YAxis=deconstruct_plane.XAxis)

curve_11 = Curve(item_2)

crv_2 = Curve(item_3)

origin_pt = Point(point_3)

pln = Plane(plane_3pt)
curve_12 = Curve(crv)

origin_pt_2 = Point(point)

pln_2 = Plane(plane_3pt_2)
curve_13 = Curve(curve_11)

origin_pt_3 = Point(point_2)

pln_3 = Plane(plane_3pt_3)
curve_14 = Curve(crv_2)

plane_normal = PlaneNormal(Origin=pln, ZAxis=Vector(0, 0, 1))
offset_curve = OffsetCurve(Curve=curve_12, Distance=1, Plane=plane_normal, Corners=1)
extend_curve = ExtendCurve(Curve=offset_curve, Type=0, Start=expr("0.5*X", 1), End=expr("0.5*X", 1))

plane_normal_2 = PlaneNormal(Origin=pln_2, ZAxis=Vector(0, 0, 1))
offset_curve_2 = OffsetCurve(Curve=curve_13, Distance=1, Plane=plane_normal_2, Corners=1)
extend_curve_2 = ExtendCurve(Curve=offset_curve_2, Type=0, Start=expr("0.5*X", 1), End=expr("0.5*X", 1))

plane_normal_3 = PlaneNormal(Origin=pln_3, ZAxis=Vector(0, 0, 1))
offset_curve_3 = OffsetCurve(Curve=curve_14, Distance=1, Plane=plane_normal_3, Corners=1)
extend_curve_3 = ExtendCurve(Curve=offset_curve_3, Type=0, Start=expr("0.5*X", 1), End=expr("0.5*X", 1))

shift_list_to_move_along_curve = Slider(3, range=0..40)
min_value = Slider(0.4, range=0..1)
number_of_sections_defines_the_gradient = Slider(34, range=0..40)  # "Number of Sections (defines the gradient resolution)"
divide_curve = DivideCurve(Curve=curve_5, Count=anchors_count, Kinks=False)  # -> simplify(Points), Tangents, Parameters
divide_curve_2 = DivideCurve(Curve=curve_6, Count=anchors_count, Kinks=False)  # -> simplify(Points), Tangents, Parameters

# ---- group: Creates the secList
construct_domain = ConstructDomain(DomainStart=1, DomainEnd=min_value)
range = Range(Domain=construct_domain, Steps=number_of_sections_defines_the_gradient)
reverse_list = ReverseList(List=range)
cull_index = CullIndex(List=reverse_list, Indices=0, Wrap=True)
merge_4 = Merge(Data1=range, Data2=cull_index)  # -> flatten(Result)
shift_list = ShiftList(List=merge_4, Shift=shift_list_to_move_along_curve, Wrap=True)

# ----
c__gradientanchorselection = CSharpScript(initPointsA=divide_curve.Points, initPointsB=divide_curve_2.Points, secList=shift_list)  # -> out, oSelectedIndicesA, oSelectedPointsA, oSelectedIndicesB, oSelectedPointsB; inputs initPointsA: list of Point3d, initPointsB: list of Point3d, secList: list of Double
# ---------- c__gradientanchorselection: C# usings ----------
using System.IO;
using System.Text.RegularExpressions;
using System.Linq;
# ---------- c__gradientanchorselection: C# ----------
    //___________ This script selects two lists of points based on a gradient list defined by the user_________
    //___________ re_duque_11/04/22___________________________________________________________________________


    double numPoints = initPointsA.Count(); //total number of points in initPoints
    double numSection = secList.Count(); // total number of sections (gradient resolution)
    List<int> SelectedPointsIndicesA = new List<int>();
    List<Point3d> SelectedPointsA = new List<Point3d>();
    List<int> SelectedPointsIndicesB = new List<int>();
    List<Point3d> SelectedPointsB = new List<Point3d>();
    int i = 0;

    Print("numSection=" + numSection.ToString());

    while (i < numPoints) // go through the list until reaches its end without defining the step size
    {

      Print("i=" + i.ToString());

      // add the i to the list
      SelectedPointsA.Add(initPointsA[i]); //adds current Point in A
      SelectedPointsIndicesA.Add(i); // adds current index in A
      SelectedPointsB.Add(initPointsB[i]); //adds current Point in B
      SelectedPointsIndicesB.Add(i); // adds current index in B

      // which section are we in? Remap the indexes to their respective sections
      int mySection = (int) Math.Floor(i / numPoints * numSection); // i/numPoints gives the relative position of the index in the list. (Math.Floor rounds down the number)

      Print("mySection=" + mySection.ToString());

      //what is the section density? calculate the skip factor: Density/1
      int skip = (int) Math.Round(1 / secList[mySection]); // secList[mySection] gives the skip value based on the list you defined with the densitity ratios

      // gets i value

      i = i + skip;


    }


    oSelectedPointsA = SelectedPointsA;
    oSelectedIndicesA = SelectedPointsIndicesA;

    oSelectedPointsB = SelectedPointsB;
    oSelectedIndicesB = SelectedPointsIndicesB;
# ---------- end c__gradientanchorselection ----------
final_seclist = Panel(shift_list)

pt = Point(c__gradientanchorselection.oSelectedPointsA)

pt_2 = Point(pt)

curve_closest_point = CurveClosestPoint(Point=pt_2, Curve=extend_curve_2)  # -> Point, Parameter, Distance
line = Line(StartPoint=pt_2, EndPoint=curve_closest_point.Point)
list_item_3 = ListItem(List=line, Index=0, Wrap=True)
extrude_along = ExtrudeAlong(Base=curve_13, Curve=list_item_3)
deconstruct_plane_2 = DeconstructPlane(Plane=extrude_along)  # -> Origin, XAxis, YAxis, ZAxis
amplitude_2 = Amplitude(Vector=deconstruct_plane_2.XAxis, Amplitude=Slider(-1, range=-12..0))
construct_plane_2 = ConstructPlane(Origin=origin_pt_2, XAxis=amplitude_2, YAxis=deconstruct_plane_2.YAxis)

pln_4 = Plane(construct_plane_2)

lng_2 = ListLength(List=c__gradientanchorselection.oSelectedPointsA)
shift_2 = Slider(10, range=0..20)
# + X Approach
c__x_approach = CSharpScript(
    AnchorsCount=lng_2,
    Anchors_A=c__gradientanchorselection.oSelectedPointsA,
    Anchors_B=c__gradientanchorselection.oSelectedPointsB,
    shift=shift_2)  # -> out, finalList; inputs AnchorsCount: Int32, Anchors_A: list of Point3d, Anchors_B: list of Point3d, shift: Int32
# ---------- c__x_approach: C# ----------
    List<Point3d> FinalAnchors = new List<Point3d>();


    for (int i = 0; i < AnchorsCount - shift; i++){

      Point3d a = Anchors_A[i];
      Point3d b = Anchors_B[i + shift];
      Point3d c = Anchors_B[i];
      Point3d d = Anchors_A[i + shift];
      FinalAnchors.Add(a);
      FinalAnchors.Add(b);
      FinalAnchors.Add(c);
      FinalAnchors.Add(d);

    }

    finalList = FinalAnchors;
# ---------- end c__x_approach ----------
polyline = PolyLine(Vertices=c__x_approach.finalList, Closed=False)
sub_curve = SubCurve(BaseCurve=reparameterize(polyline), Domain=Slider(1, range=0..1))

number_slider = Slider(6, range=0..10)
panel = Panel("""0
1
1
0""")
# +Weaving
shift_list_2 = ShiftList(List=c__gradientanchorselection.oSelectedPointsB, Shift=number_slider, Wrap=False)
shift_list_3 = ShiftList(List=c__gradientanchorselection.oSelectedPointsA, Shift=number_slider, Wrap=False)
weave = Weave(Pattern=panel, Stream0=c__gradientanchorselection.oSelectedPointsA, Stream1=shift_list_2, NullGaps=False)
weave_2 = Weave(Pattern=panel, Stream0=shift_list_3, Stream1=c__gradientanchorselection.oSelectedPointsB, NullGaps=False)
polyline_2 = PolyLine(Vertices=weave, Closed=False)
polyline_3 = PolyLine(Vertices=weave_2, Closed=False)

curve_15 = Curve(polyline)
curve_16 = Curve([polyline_2, polyline_3])

shift_list_to_move_along_curve_2 = Slider(3, range=0..40)
min_value_2 = Slider(0.4, range=0..1)
number_of_sections_defines_the_gradient_2 = Slider(34, range=0..40)  # "Number of Sections (defines the gradient resolution)"
divide_curve_3 = DivideCurve(Curve=curve_7, Count=anchors_count_2, Kinks=False)  # -> simplify(Points), Tangents, Parameters
divide_curve_4 = DivideCurve(Curve=curve_8, Count=anchors_count_2, Kinks=False)  # -> simplify(Points), Tangents, Parameters

# ---- group: Creates the secList
construct_domain_2 = ConstructDomain(DomainStart=1, DomainEnd=min_value_2)
range_2 = Range(Domain=construct_domain_2, Steps=number_of_sections_defines_the_gradient_2)
reverse_list_2 = ReverseList(List=range_2)
cull_index_2 = CullIndex(List=reverse_list_2, Indices=0, Wrap=True)
merge_5 = Merge(Data1=range_2, Data2=cull_index_2)  # -> flatten(Result)
shift_list_4 = ShiftList(List=merge_5, Shift=shift_list_to_move_along_curve_2, Wrap=True)

# ----
c__gradientanchorselection_2 = CSharpScript(initPointsA=divide_curve_3.Points, initPointsB=divide_curve_4.Points, secList=shift_list_4)  # -> out, oSelectedIndicesA, oSelectedPointsA, oSelectedIndicesB, oSelectedPointsB; inputs initPointsA: list of Point3d, initPointsB: list of Point3d, secList: list of Double; same code as c__gradientanchorselection
final_seclist_2 = Panel(shift_list_4)

pt_3 = Point(c__gradientanchorselection_2.oSelectedPointsA)

pt_4 = Point(pt_3)

curve_closest_point_2 = CurveClosestPoint(Point=pt_4, Curve=extend_curve)  # -> Point, Parameter, Distance
line_2 = Line(StartPoint=pt_4, EndPoint=curve_closest_point_2.Point)
list_item_4 = ListItem(List=line_2, Index=0, Wrap=True)
extrude_along_2 = ExtrudeAlong(Base=curve_12, Curve=list_item_4)
deconstruct_plane_3 = DeconstructPlane(Plane=extrude_along_2)  # -> Origin, XAxis, YAxis, ZAxis
amplitude_3 = Amplitude(Vector=deconstruct_plane_3.YAxis, Amplitude=Slider(-1, range=-12..0))
construct_plane_3 = ConstructPlane(Origin=origin_pt, XAxis=deconstruct_plane_3.XAxis, YAxis=amplitude_3)

pln_5 = Plane(construct_plane_3)

lng_3 = ListLength(List=c__gradientanchorselection_2.oSelectedPointsA)
shift_3 = Slider(8, range=0..20)
c__x_approach_2 = CSharpScript(
    AnchorsCount=lng_3,
    Anchors_A=c__gradientanchorselection_2.oSelectedPointsA,
    Anchors_B=c__gradientanchorselection_2.oSelectedPointsB,
    shift=shift_3)  # -> out, finalList; inputs AnchorsCount: Int32, Anchors_A: list of Point3d, Anchors_B: list of Point3d, shift: Int32; same code as c__x_approach
polyline_4 = PolyLine(Vertices=c__x_approach_2.finalList, Closed=False)
sub_curve_2 = SubCurve(BaseCurve=reparameterize(polyline_4), Domain=Slider(1, range=0..1))

number_slider_2 = Slider(6, range=0..10)
panel_2 = Panel("""0
1
1
0""")
# +Weaving
shift_list_5 = ShiftList(List=c__gradientanchorselection_2.oSelectedPointsB, Shift=number_slider_2, Wrap=False)
shift_list_6 = ShiftList(List=c__gradientanchorselection_2.oSelectedPointsA, Shift=number_slider_2, Wrap=False)
weave_3 = Weave(Pattern=panel_2, Stream0=c__gradientanchorselection_2.oSelectedPointsA, Stream1=shift_list_5, NullGaps=False)
weave_4 = Weave(Pattern=panel_2, Stream0=shift_list_6, Stream1=c__gradientanchorselection_2.oSelectedPointsB, NullGaps=False)
polyline_5 = PolyLine(Vertices=weave_3, Closed=False)
polyline_6 = PolyLine(Vertices=weave_4, Closed=False)

curve_17 = Curve(polyline_4)
curve_18 = Curve([polyline_5, polyline_6])

shift_list_to_move_along_curve_3 = Slider(3, range=0..40)
number_of_sections_defines_the_gradient_3 = Slider(34, range=0..40)  # "Number of Sections (defines the gradient resolution)"
min_value_3 = Slider(0.4, range=0..1)
divide_curve_5 = DivideCurve(Curve=curve_9, Count=anchors_count_3, Kinks=False)  # -> simplify(Points), Tangents, Parameters
divide_curve_6 = DivideCurve(Curve=curve_10, Count=anchors_count_3, Kinks=False)  # -> simplify(Points), Tangents, Parameters

# ---- group: Creates the secList
construct_domain_3 = ConstructDomain(DomainStart=1, DomainEnd=min_value_3)
range_3 = Range(Domain=construct_domain_3, Steps=number_of_sections_defines_the_gradient_3)
reverse_list_3 = ReverseList(List=range_3)
cull_index_3 = CullIndex(List=reverse_list_3, Indices=0, Wrap=True)
merge_6 = Merge(Data1=range_3, Data2=cull_index_3)  # -> flatten(Result)
shift_list_7 = ShiftList(List=merge_6, Shift=shift_list_to_move_along_curve_3, Wrap=True)

# ----
c__gradientanchorselection_3 = CSharpScript(initPointsA=divide_curve_5.Points, initPointsB=divide_curve_6.Points, secList=shift_list_7)  # -> out, oSelectedIndicesA, oSelectedPointsA, oSelectedIndicesB, oSelectedPointsB; inputs initPointsA: list of Point3d, initPointsB: list of Point3d, secList: list of Double; same code as c__gradientanchorselection
final_seclist_3 = Panel(shift_list_7)

pt_5 = Point(c__gradientanchorselection_3.oSelectedPointsB)

pt_6 = Point(pt_5)

curve_closest_point_3 = CurveClosestPoint(Point=pt_6, Curve=extend_curve_3)  # -> Point, Parameter, Distance
line_3 = Line(StartPoint=pt_6, EndPoint=curve_closest_point_3.Point)
# Gradient
list_item_5 = ListItem(List=line_3, Index=0, Wrap=True)
extrude_along_3 = ExtrudeAlong(Base=curve_14, Curve=list_item_5)
deconstruct_plane_4 = DeconstructPlane(Plane=extrude_along_3)  # -> Origin, XAxis, YAxis, ZAxis
amplitude_4 = Amplitude(Vector=deconstruct_plane_4.YAxis, Amplitude=Slider(-1, range=-12..0))
construct_plane_4 = ConstructPlane(Origin=origin_pt_3, XAxis=deconstruct_plane_4.XAxis, YAxis=amplitude_4)

pln_6 = Plane(construct_plane_4)

lng_4 = ListLength(List=c__gradientanchorselection_3.oSelectedPointsA)
shift_4 = Slider(10, range=0..20)
# + X Approach
c__x_approach_3 = CSharpScript(
    AnchorsCount=lng_4,
    Anchors_A=c__gradientanchorselection_3.oSelectedPointsA,
    Anchors_B=c__gradientanchorselection_3.oSelectedPointsB,
    shift=shift_4)  # -> out, finalList; inputs AnchorsCount: Int32, Anchors_A: list of Point3d, Anchors_B: list of Point3d, shift: Int32; same code as c__x_approach
polyline_7 = PolyLine(Vertices=c__x_approach_3.finalList, Closed=False)
sub_curve_3 = SubCurve(BaseCurve=reparameterize(polyline_7), Domain=Slider(1, range=0..1))

number_slider_3 = Slider(6, range=0..10)
panel_3 = Panel("""0
1
1
0""")
# +Weaving
shift_list_8 = ShiftList(List=c__gradientanchorselection_3.oSelectedPointsB, Shift=number_slider_3, Wrap=False)
shift_list_9 = ShiftList(List=c__gradientanchorselection_3.oSelectedPointsA, Shift=number_slider_3, Wrap=False)
weave_5 = Weave(Pattern=panel_3, Stream0=c__gradientanchorselection_3.oSelectedPointsA, Stream1=shift_list_8, NullGaps=False)
weave_6 = Weave(Pattern=panel_3, Stream0=shift_list_9, Stream1=c__gradientanchorselection_3.oSelectedPointsB, NullGaps=False)
polyline_8 = PolyLine(Vertices=weave_5, Closed=False)
polyline_9 = PolyLine(Vertices=weave_6, Closed=False)

curve_19 = Curve(polyline_7)
curve_20 = Curve([polyline_8, polyline_9])

pt_7 = Point(Point(0, 0, 0))
len_2 = Length(Curve=curve_7)
pt_8 = ConstructPoint(XCoordinate=len_2, YCoordinate=0, ZCoordinate=0)
ln_3 = Line(StartPoint=pt_7, EndPoint=pt_8)

# ---- group: Input Curves
curve_21 = Curve(ln_3)
curve_22 = Curve(item_2)

# ----
divide_curve_7 = DivideCurve(Curve=curve_21, Count=anchors_count_2, Kinks=False)  # -> simplify(Points), Tangents, Parameters
divide_curve_8 = DivideCurve(Curve=curve_22, Count=anchors_count_2, Kinks=False)  # -> simplify(Points), Tangents, Parameters
c__gradientanchorselection_4 = CSharpScript(initPointsA=divide_curve_7.Points, initPointsB=divide_curve_8.Points, secList=shift_list_4)  # -> out, oSelectedIndicesA, oSelectedPointsA, oSelectedIndicesB, oSelectedPointsB; inputs initPointsA: list of Point3d, initPointsB: list of Point3d, secList: list of Double; same code as c__gradientanchorselection

# ---- group: division_points
pt_9 = Point(c__gradientanchorselection_4.oSelectedPointsA)

# ----
box1_depth = Slider(0.02, range=0..0.1)
box1_width = Slider(0.05, range=0..0.1)
box2_depth = Slider(0.02, range=0..0.1)
box2_width = Slider(0.03, range=0..0.1)
thickness = Slider(0.08, range=0..0.1)
division = Division(A=thickness, B=2)
division_2 = Division(A=box1_width, B=2)
division_3 = Division(A=box2_width, B=2)
addition = Addition(A=box1_depth, B=box2_depth)
dom = ConstructDomain(DomainStart=expr("-x", division_2), DomainEnd=division_2)
dom_2 = ConstructDomain(DomainStart=0, DomainEnd=expr("-X", box1_depth))
dom_3 = ConstructDomain(DomainStart=expr("-x", division_3), DomainEnd=division_3)
dom_4 = ConstructDomain(DomainStart=expr("-x", box1_depth), DomainEnd=expr("-X", addition))
item_4 = ListItem(List=pt_9, Index=0, Wrap=True)
yz = YZPlane(Origin=item_4)
division_4 = Division(A=division, B=2)
offset = OffsetCurve(Curve=curve_21, Distance=expr("-X", division), Corners=1)
rectangle = Rectangle(Plane=yz, XSize=dom_2, YSize=division_4, Radius=0)  # -> Rectangle, Length
offset_2 = OffsetCurve(Curve=curve_21, Distance=division, Corners=1)
rectangle_2 = Rectangle(Plane=pt_9, XSize=dom_3, YSize=dom_4, Radius=0)  # -> Rectangle, Length
rectangle_3 = Rectangle(Plane=pt_9, XSize=dom, YSize=dom_2, Radius=0)  # -> Rectangle, Length
Z_2 = UnitZ(Factor=division_4)
move_2 = Move(Geometry=rectangle.Rectangle, Motion=Z_2)  # -> Geometry, Transform
loft = Loft(
    Curves=[offset, offset_2],
    Options={Adjust=False, Closed=False, LoftEnds=0, LoftSimp=0, LoftType=0, Rebuild=10, Refit=0.01})
Z_3 = UnitZ(Factor=thickness)
boundary = BoundarySurfaces(Edges=[rectangle_3.Rectangle, rectangle_2.Rectangle])
Z_4 = UnitZ(Factor=division)
extr = Extrude(Base=flatten(boundary), Direction=Z_3)
extr_2 = Extrude(Base=loft, Direction=Z_3)
move_3 = Move(Geometry=extr, Motion=expr("-x", Z_4))  # -> Geometry, Transform
move_4 = Move(Geometry=extr_2, Motion=expr("-x", Z_4))  # -> Geometry, Transform

# ---- group: uniform_hook
extrcrv = ExtrudeAlong(Base=move_2.Geometry, Curve=offset)

# ---- group: cubic_bar
brep = Brep(move_4.Geometry)

# ---- group: finger_hooks
brep_2 = Brep(move_3.Geometry)

# ----
sdiff = SolidDifference(BrepsA=brep, BrepsB=brep_2)

lng_5 = ListLength(List=pt_9)
division_5 = Division(A=lng_5, B=2)
item_5 = ListItem(List=pt_9, Index=expr("x-1", division_5), Wrap=True)
item_6 = ListItem(List=pt_9, Index=expr("x-1", lng_5), Wrap=True)
item_7 = ListItem(List=pt_9, Index=0, Wrap=True)
item_8 = ListItem(List=pt_9, Index=expr("x-2", lng_5), Wrap=True)
item_9 = ListItem(List=pt_9, Index=1, Wrap=True)
item_10 = ListItem(List=pt_9, Index=division_5, Wrap=True)
ln_4 = Line(StartPoint=item_8, EndPoint=item_6)
ln_5 = Line(StartPoint=item_5, EndPoint=item_10)
ln_6 = Line(StartPoint=item_7, EndPoint=item_9)
num = Number(division_2)
ext = ExtendCurve(Curve=ln_4, Type=0, Start=num, End=num)
ext_2 = ExtendCurve(Curve=ln_5, Type=0, Start=num, End=num)
yz_2 = YZPlane(Origin=[item_8, item_5, item_7])
ext_3 = ExtendCurve(Curve=ln_6, Type=0, Start=num, End=num)
rectangle_4 = Rectangle(Plane=yz_2, XSize=dom_2, YSize=division_4, Radius=0)  # -> Rectangle, Length
move_5 = Move(Geometry=rectangle_4.Rectangle, Motion=expr("-2*x", Z_2))  # -> Geometry, Transform
item_11 = ListItem(List=move_5.Geometry, Index=0, Wrap=True)  # -> Item, Item1, Item2
srf = Surface(item_11.Item)
srf_2 = Surface(item_11.Item1)
srf_3 = Surface(item_11.Item2)
X = UnitX(Factor=num)

# ---- group: mid_hook
extrcrv_2 = ExtrudeAlong(Base=srf_2, Curve=ext_2)

# ---- group: far_end_hook
extrcrv_3 = ExtrudeAlong(Base=srf, Curve=ext)

# ---- group: start_end_hook
extrcrv_4 = ExtrudeAlong(Base=srf_3, Curve=ext_3)

# ----
move_6 = Move(Geometry=[extrcrv_3, extrcrv_2, extrcrv_4], Motion=expr("-x", X))  # -> Geometry, Transform

sdiff_2 = SolidDifference(BrepsA=sdiff, BrepsB=[move_6.Geometry, extrcrv])

brep_3 = Brep(sdiff_2)
orient = Orient(Geometry=brep_3, Source=construct_plane, Target=pln_5)  # -> Geometry, Transform
orient_2 = Orient(Geometry=brep_3, Source=construct_plane, Target=pln_6)  # -> Geometry, Transform
orient_3 = Orient(Geometry=brep_3, Source=construct_plane, Target=pln_4)  # -> Geometry, Transform
