# Grasshopper definition Custom CAM_3X_Surface Finishing.gh (Grasshopper 1.0.7)
# plug-ins: Sandbox

brep = Brep([<brep referenced from the Rhino model> x3])
X = UnitX(Factor=1)
Z = UnitZ(Factor=1)
pi = Pi(Factor=Slider(0.19, range=0..1))
vrot = Rotate(Vector=X, Axis=Z, Angle=pi)
contour = Contour(Shape=brep, Point=Point(0, 0, 0), Direction=vrot, Distance="10")
viewer = ParamViewer(contour)
dispatch = Dispatch(List=viewer, DispatchPattern=[True, False])  # -> ListA, ListB
branch = TreeBranch(Tree=contour, Path=dispatch.ListA, MaintainPaths=True)
branch_2 = TreeBranch(Tree=contour, Path=dispatch.ListB, MaintainPaths=True)
flip = FlipCurve(Curve=branch_2)  # -> Curve, Flag
rev = ReverseList(List=flip.Curve)
deviation_tolerance_mm = Panel("0.5")
merge = Merge(Data1=branch, Data2=rev)
topoly = CurveToPolyline(Curve=merge, ToleranceDistance=deviation_tolerance_mm, ToleranceAngle=0)  # -> Polyline, Segments

pt = Point(Point(-168.421613, -157.094091, 0))
xy = XYPlane(Origin=pt)
pi_2 = Pi(Factor=Slider(0, range=0..1))
deplane = DeconstructPlane(Plane=xy)  # -> Origin, XAxis, YAxis, ZAxis
rot3d = Rotate3D(Geometry=xy, Angle=pi_2, Center=deplane.Origin, Axis=deplane.YAxis)  # -> Geometry, Transform

tool_no = Panel("1")
spindle_speed_rpm = Panel("1000")
feed_mm_min = Panel("2000")
nc_settings = NCSettings(Tool=tool_no, Speed=spindle_speed_rpm, Feed=feed_mm_min)

tool_radius_mm = Panel("0")
clearance_plane_mm = Panel("100")
crv = Curve(topoly.Polyline)
pln = Plane(xy)
_3x_contour = _3XContour(Polyline=crv, ToolRadius=tool_radius_mm, SafetyOffset=clearance_plane_mm, Base=pln)  # -> Points, Vectors, Feed

eval = EvaluateLength(Curve=merge, Length=0.5, Normalized=True)  # -> Point, Tangent, Parameter
points = PointList(Points=flatten(eval.Point), Tags=True, Lines=True)
amp = Amplitude(Vector=eval.Tangent, Amplitude="50")
pt_2 = Point(_3x_contour.Points)
vec = Vector(_3x_contour.Vectors)
txt = Text(_3x_contour.Feed)
vdis = VectorDisplay(Anchor=eval.Point, Vector=amp)

nc = NCGeneration(Points=pt_2, Vectors=vec, Feed=txt, Settings=nc_settings)
panel = Panel(nc)

orient = Orient(Geometry=pt_2, Source=PlaneXY(0, 0, 0), Target=pln)  # -> Geometry, Transform
pline = PolyLine(Vertices=flatten(orient.Geometry), Closed=False)
preview = CustomPreview(Geometry=pline, Shader=ColourSwatch(SwatchColor=RGB(0, 255, 238)))
