# Grasshopper definition Custom CAM_5X_Drilling.gh (Grasshopper 1.0.7)
# plug-ins: Sandbox

brep = Brep([<brep referenced from the Rhino model> x3])
crv = Curve([<curve referenced from the Rhino model> x3])
area = Area(Geometry=brep)  # -> Area, Centroid
eval = Evaluate(F="Floor(x/y)", x=area.Area, y=Slider(603, range=0..1000))
popgeo = PopulateGeometry(Geometry=brep, Count=eval, Seed=1)
alongcrv = SortAlongCurve(Points=popgeo, Curve=graft(crv))  # -> Points, Indices
srf_cp = SurfaceClosestPoint(Point=alongcrv.Points, Surface=graft(brep))  # -> Point, UVPoint, Distance
evalsrf = EvaluateSurface(Surface=graft(brep), Point=srf_cp.UVPoint)  # -> Point, Normal, Frame
line = LineSDL(Start=evalsrf.Point, Direction=evalsrf.Normal, Length=1)

pt = Point(<point referenced from the Rhino model>)
xy = XYPlane(Origin=pt)
pi = Pi(Factor=Slider(0, range=0..1))
deplane = DeconstructPlane(Plane=xy)  # -> Origin, XAxis, YAxis, ZAxis
rot3d = Rotate3D(Geometry=xy, Angle=pi, Center=deplane.Origin, Axis=deplane.ZAxis)  # -> Geometry, Transform

clearance_plane_mm = Panel("100")
depth = Panel("-2")
pln = Plane(xy)
_5x_drilling = _5XDrilling(Lines=line, Depth=depth, ClearanceOffset=clearance_plane_mm, Base=pln)  # -> Points, Vectors, Feed

tool_no = Panel("1")
spindle_speed_rpm = Panel("1000")
feed_mm_min = Panel("2000")
nc_settings = NCSettings(Tool=tool_no, Speed=spindle_speed_rpm, Feed=feed_mm_min)

pt_2 = Point(_5x_drilling.Points)
vec = Vector(_5x_drilling.Vectors)
txt = Text(_5x_drilling.Feed)
orient = Orient(Geometry=pt_2, Source=PlaneXY(0, 0, 0), Target=pln)  # -> Geometry, Transform

nc = NCGeneration(Points=pt_2, Vectors=vec, Feed=txt, Settings=nc_settings)
panel = Panel(nc)

pshift = ShiftPaths(Data=orient.Geometry, Offset=-1)
pline = PolyLine(Vertices=pshift, Closed=False)
preview = CustomPreview(Geometry=pline, Shader=ColourSwatch(SwatchColor=RGB(0, 255, 238)))
