# Grasshopper definition Custom CAM_5X_Surface Finishing_Sim.gh (Grasshopper 1.0.7)
# plug-ins: Sandbox, VirtualRobot.Grasshopper

point = Point(<point referenced from the Rhino model>)

brep = Brep([<brep referenced from the Rhino model> x3])
unit_x = UnitX(Factor=1)
unit_z = UnitZ(Factor=1)
pi = Pi(Factor=Slider(0.22, range=0..1))
rotate = Rotate(Vector=unit_x, Axis=unit_z, Angle=pi)
contour = Contour(Shape=brep, Point=point, Direction=rotate, Distance="10")
param_viewer = ParamViewer(contour)
dispatch = Dispatch(List=param_viewer, DispatchPattern=[True, False])  # -> ListA, ListB
tree_branch = TreeBranch(Tree=contour, Path=dispatch.ListA, MaintainPaths=True)
tree_branch_2 = TreeBranch(Tree=contour, Path=dispatch.ListB, MaintainPaths=True)
flip_curve = FlipCurve(Curve=tree_branch_2)  # -> Curve, Flag
reverse_list = ReverseList(List=flip_curve.Curve)
merge = Merge(Data1=tree_branch, Data2=reverse_list)
deviation_tolerance_mm = Panel("0.2")
curve_to_polyline = CurveToPolyline(Curve=merge, ToleranceDistance=deviation_tolerance_mm, ToleranceAngle=0)  # -> Polyline, Segments
shift_paths = ShiftPaths(Data=curve_to_polyline.Polyline, Offset=-1)

evaluate_length = EvaluateLength(Curve=contour, Length=0.5, Normalized=True)  # -> Point, Tangent, Parameter
vector_display = VectorDisplay(Anchor=evaluate_length.Point, Vector=evaluate_length.Tangent)
point_2 = Point(Point(1170.398766, -505.1314022, 297.6415409))
xy_plane = XYPlane(Origin=point_2)

tool_no = Panel("1")
feed_mm_min = Panel("4000")
spindle_speed_rpm = Panel("10000")
nc_settings = NCSettings(Tool=tool_no, Speed=spindle_speed_rpm, Feed=feed_mm_min)

clearance_plane_mm = Panel("100")
surface = Surface(graft(brep))
curve = Curve(shift_paths)
plane = Plane(xy_plane)
_5x_srf_contour = _5XSurfaceContour(Polyline=curve, Surface=surface, ClearanceOffset=clearance_plane_mm, Base=plane)  # -> Points, Vectors, Feed

evaluate_length_2 = EvaluateLength(Curve=merge, Length=0.5, Normalized=True)  # -> Point, Tangent, Parameter
amplitude = Amplitude(Vector=evaluate_length_2.Tangent, Amplitude="50")
point_list = PointList(Points=flatten(evaluate_length_2.Point), Tags=True, Lines=True)
vector_display_2 = VectorDisplay(Anchor=evaluate_length_2.Point, Vector=amplitude)
point_3 = Point(_5x_srf_contour.Points)
vector = Vector(_5x_srf_contour.Vectors)
text = Text(_5x_srf_contour.Feed)
unit_x_2 = UnitX(Factor=1)
plane_normal = PlaneNormal(Origin=point_3, ZAxis=vector)
nc_generation = NCGeneration(Points=point_3, Vectors=vector, Feed=text, Settings=nc_settings)
align_plane = AlignPlane(Plane=plane_normal, Direction=unit_x_2)  # -> Plane, Angle
orient = Orient(Geometry=align_plane.Plane, Source=PlaneXY(0, 0, 0), Target=plane)  # -> Geometry, Transform
deconstruct_plane = DeconstructPlane(Plane=orient.Geometry)  # -> Origin, XAxis, YAxis, ZAxis
deconstruct = Deconstruct(Point=deconstruct_plane.Origin)  # -> XComponent, YComponent, ZComponent
bounds = Bounds(Numbers=flatten(deconstruct.YComponent))
panel = Panel(bounds)
remap_numbers = RemapNumbers(Value=deconstruct.YComponent, Source=bounds, Target="-60 to 60")  # -> Mapped, Clipped
number = Number(remap_numbers.Mapped)
rotate_plane = RotatePlane(Plane=orient.Geometry, Angle=degrees(remap_numbers.Mapped))
panel_2 = Panel(remap_numbers.Mapped)
deconstruct_plane_2 = DeconstructPlane(Plane=rotate_plane)  # -> Origin, XAxis, YAxis, ZAxis
polyline = PolyLine(Vertices=flatten(rotate_plane), Closed=False)

predefined_spindle_end_effector = PredefinedSpindleEndEffector()
predefined_kuka_kr_125_2 = PredefinedKUKAKR1252(RobRootFrame=PlaneXY(0, 0, 0), EndEffectorOptional=predefined_spindle_end_effector)
interpolate_frames = InterpolateFrames(Frames=flatten(rotate_plane), Length=Slider(0, range=0..1), Step="10", Reset=Toggle(True))  # -> Frame, Percent, CurrentIndex
robot_inverse_kinematics = RobotInverseKinematics(
    Robot=predefined_kuka_kr_125_2,
    TargetTCPFrame=interpolate_frames.Frame,
    AxisToggles=[False, False, False],
    useColorPreview=True)  # -> PoseGeometry, AxisValues, AxisFrames

custom_preview = CustomPreview(Geometry=polyline, Shader=ColourSwatch(SwatchColor=RGB(0, 255, 238)))
nc_generation_robomove = NCGenerationRobomove(Points=deconstruct_plane_2.Origin, Vectors=deconstruct_plane_2.ZAxis, Rotation=number, Feed=text, Settings=nc_settings)
panel_3 = Panel(nc_generation_robomove)
