# Grasshopper definition NC_to_Robomove.gh (Grasshopper 1.0.7)
# plug-ins: VirtualRobot.Grasshopper, Human, Sandbox, Bifocals

panel = Panel("C:\Users\Tobias Schwinn\Documents\Work\2_Teaching\3-Seminars\22-SS-CDDF\3-Lectures_and_handouts\W02-Robotic_fabrication\handout\NC_to_Robomove\madaRest.mpf")

# ----
# Work Table
Z = Panel("500")
Y = Panel("500")
X = Panel("1500")
A = Panel("0")
B = Panel("0")
C = Panel("0")
pt = ConstructPoint(XCoordinate=X, YCoordinate=Y, ZCoordinate=Z)
vec = VectorXYZ(XComponent=A, YComponent=B, ZComponent=C)  # -> Vector, Length
set_plane = SetPlane(xyz=pt, abc=vec.Vector)

file = ReadFile(File=panel, PerLineParse=True)
Z_2 = Panel("142.5")
Y_2 = Panel("71.40")
X_2 = Panel("50.97")
vb = VBScript(S=file)  # -> out, A, B, C, D; inputs S: list
# ---------- vb: VB usings ----------
Imports System.IO
Imports System.Linq
Imports System.Data
Imports System.Drawing
Imports System.Reflection
Imports System.Windows.Forms
Imports System.Xml
Imports System.Xml.Linq
Imports Microsoft.VisualBasic
Imports System.Runtime.InteropServices

Imports Rhino.DocObjects
Imports Rhino.Collections
Imports GH_IO
Imports GH_IO.Serialization
# ---------- vb: VB ----------
    Dim _out As New List(Of String)
    'Dim _frames As New DataTree(Of Plane)
    Dim _positions As New DataTree(Of Point3d)
    Dim _orientations As New DataTree(Of Vector3d)
    Dim _feeds As New DataTree(Of String)
    Dim _split() As String

    Dim _changed As Boolean = False
    Dim _next As Boolean = False
    'Dim _frm As Plane = New Plane(New Point3d(0, 0, 0), New Vector3d(0, 0, 1))
    Dim _pos As Point3d = New Point3d(0, 0, 0)
    Dim _ori As Vector3d = New Vector3d(0, 0, 0)
    Dim _index As Int32 = 0
    Dim _path As Gh_Path = New GH_Path(_index)
    Dim _rapid As Boolean = False

    For Each _satz As String In S

      _satz = _satz.Trim

      If Not (_satz.StartsWith(";") Or _satz = "") Then
        _split = Split(_satz, " ")

        If _next Then
          _path = New GH_Path(_index)
          _index += 1
          _next = False
        End If

        If _satz.Contains("G0") Then
          _rapid = True
          _next = True
        Else If _satz.Contains("G1") Then
          _rapid = False
        End If

        For Each _coor As String In _split
          If _coor.StartsWith("X") Then
            _pos.X = CDbl(_coor.TrimStart("X"))
            _changed = True
          ElseIf _coor.StartsWith("Y") Then
            _pos.Y = CDbl(_coor.TrimStart("Y"))
            _changed = True
          ElseIf _coor.StartsWith("Z") Then
            _pos.Z = CDbl(_coor.TrimStart("Z"))
            _changed = True
          ElseIf _coor.StartsWith("A") Then
            _ori.Z = CDbl(_coor.TrimStart("A"))
            _changed = True
          ElseIf _coor.StartsWith("B") Then
            _ori.Y = CDbl(_coor.TrimStart("B"))
            _changed = True
          ElseIf _coor.StartsWith("C") Then
            _ori.X = CDbl(_coor.TrimStart("C"))
            _changed = True
          End If
        Next

        If _changed Then
          '_frames.add(_frm, _path)
          _positions.add(_pos, _path)
          _orientations.add(_ori, _path)
          If _rapid Then
            _feeds.Add("G0", _path)
            '_rapid = False
          Else
            _feeds.Add("G1", _path)
          End If
          _changed = False
        End If

        'End If
        _out.add(_satz)
        '        Else If _satz.Contains("G1") Then
        '        _out.add(_satz)
      End If
    Next

    A = _out
    B = _positions
    C = _orientations
    D = _feeds
# ---------- end vb ----------
pt_2 = PointOriented(BasePlane=set_plane, UComponent=X_2, VComponent=Y_2, WComponent=Z_2)
set_plane_2 = SetPlane(xyz=vb.B, abc=vb.C)
X_3 = UnitX(Factor=1)
panel_2 = Panel(file)
pl_origin = PlaneOrigin(Base=set_plane, Origin=pt_2)
align = AlignPlane(Plane=set_plane_2, Direction=X_3)  # -> Plane, Angle

# ----
# Target frames
pln = Plane(align.Plane)
pln_2 = Plane(pl_origin)
orient = Orient(Geometry=pln, Source=PlaneXY(0, 0, 0), Target=pln_2)  # -> Geometry, Transform
pi = Pi(Factor=Slider(0.18, range=0..1))
swatch = ColourSwatch(SwatchColor=RGB(0, 255, 238))
pline = PolyLine(Vertices=flatten(orient.Geometry), Closed=False)
prot = RotatePlane(Plane=orient.Geometry, Angle=pi)
pln_3 = Plane(prot)
preview = CustomPreview(Geometry=pline, Shader=swatch)

previewlw = CustomPreviewLineweights(Geometry=pline, Shader=swatch, Absolute=False)
orient_2 = Orient(Geometry=pln_3, Source=pl_origin, Target=PlaneXY(0, 0, 0))  # -> Geometry, Transform

tool_no = Panel("1")
spindle_speed_rpm = Panel("12000")
feed_mm_min = Panel("2000")
nc_settings = NCSettings(Tool=tool_no, Speed=spindle_speed_rpm, Feed=feed_mm_min)

# ----
# Evaluate Target Frame List
pln_4 = Plane(flatten(pln_3))
E = Slider(0, range=0..1)
stepsize_mm = Slider(20, range=-10..20)
timer = Timer(Interval=50, TimerInterval=50, Target=iframe)  # disabled
iframe = InterpolateFrames(Frames=pln_4, Length=E, Step=stepsize_mm, Reset=Toggle(False))  # -> Frame, Percent, CurrentIndex
panel_3 = Panel(iframe.Percent)

xy = XYPlane(Origin=Point(0, 0, 0))
deplane = DeconstructPlane(Plane=orient_2.Geometry)  # -> Origin, XAxis, YAxis, ZAxis
X_4 = UnitX(Factor=1)
python = GhPythonScript(x=deplane.XAxis, y=X_4, iPl=xy)  # -> out, a; inputs x: Vector3d, y: Vector3d, iPl: Plane
# ---------- python: Python ----------
import Rhino.Geometry as rg
import math
angle = rg.Vector3d.VectorAngle(x, y, iPl)

if angle > math.pi:
    angle -= 2*math.pi

a = math.degrees(angle)
# ---------- end python ----------
python_2 = GhPythonScript(x=deplane.Origin)  # -> out, a; inputs x: list
# ---------- python_2: Python ----------
feeds = []

for i in range(0, len(x)):
    if i == 0:
        feeds.append("G0")
    else:
        feeds.append("G1")
        
a = feeds
# ---------- end python_2 ----------
panel_4 = Panel(python.a)
pt_3 = Point(deplane.Origin)
vec_2 = Vector(deplane.ZAxis)
num = Number(python.a)
txt = Text(python_2.a)
nc_r = NCGenerationRobomove(Points=pt_3, Vectors=vec_2, Rotation=num, Feed=txt, Settings=nc_settings)

nc = NCGeneration(Points=pt_3, Vectors=vec_2, Feed=txt, Settings=nc_settings)  # disabled
panel_5 = Panel(nc_r)

orient_3 = Orient(Geometry=pt_3, Source=PlaneXY(0, 0, 0), Target=pl_origin)  # -> Geometry, Transform
pline_2 = PolyLine(Vertices=flatten(orient_3.Geometry), Closed=False)
swatch_2 = ColourSwatch(SwatchColor=RGB(0, 255, 238))

# ----
# IK SIMULATION
ee = PredefinedSpindleEndEffector()
pln_5 = Plane(iframe.Frame)
kuka_kr_125_2 = PredefinedKUKAKR1252(RobRootFrame=PlaneXY(0, 0, 0), EndEffectorOptional=ee)
robot_ik = RobotInverseKinematics(Robot=kuka_kr_125_2, TargetTCPFrame=pln_5, AxisToggles=[False, False, False], useColorPreview=True)  # -> PoseGeometry, AxisValues, AxisFrames

preview_2 = CustomPreview(Geometry=pline_2, Shader=swatch_2)
previewlw_2 = CustomPreviewLineweights(Geometry=pline_2, Shader=swatch_2, Absolute=False)

# ==== cluster SetPlane: Contains a Grasshopper VB.Net component that converts location (XYZ) and orientation (ABC) values into frames
xyz = ClusterInput()
abc = ClusterInput()
set_plane = VBScript(XYZ=xyz, ABC=abc)  # -> out, Pl; inputs XYZ: Point3d, ABC: Vector3d
# ---------- set_plane: VB ----------
    Dim _f As Plane = Plane.WorldXY
    Dim _p As Point3d = XYZ
    Dim _v As Vector3d = ABC

    _f.Rotate(RhinoMath.ToRadians(_v.X), _f.ZAxis)
    _f.Rotate(RhinoMath.ToRadians(_v.Y), _f.YAxis)
    _f.Rotate(RhinoMath.ToRadians(_v.Z), _f.XAxis)

    _f.Origin = New Point3d(_p.X, _p.Y, _p.Z)

    Pl = _f
# ---------- end set_plane ----------
pl = ClusterOutput(set_plane.Pl)
