# Grasshopper definition Shingle_shell-CAM-2-Puzzle-3X_contour.gh (Grasshopper 1.0.7)
# plug-ins: Sandbox, Kangaroo Components, VirtualRobot.Grasshopper

# ---- group: Sheet-1
brep = Brep([<brep referenced from the Rhino model> x28])

# ---- group: Sheet-2
brep_2 = Brep([<brep referenced from the Rhino model> x35])

# ----
brep_3 = Brep([<brep referenced from the Rhino model> x2])

# ---- group: Sheet-3
brep_4 = Brep([<brep referenced from the Rhino model> x34])

# ---- group: Sheet-5
brep_5 = Brep([<brep referenced from the Rhino model> x13])

# ---- group: Sheet-4
brep_6 = Brep([<brep referenced from the Rhino model> x33])

# ----
# SELECT GEOMETRY TO WORK ON
brep_7 = Brep(brep)
debrep = DeconstructBrep(Brep=brep_7)  # -> Faces, Edges, Vertices
area = Area(Geometry=debrep.Faces)  # -> Area, Centroid
pdecon = Deconstruct(Point=area.Centroid)  # -> XComponent, YComponent, ZComponent
sort = SortList(Keys=pdecon.ZComponent, ValuesA=debrep.Faces)  # -> Keys, reverse(ValuesA)
item = ListItem(List=sort.ValuesA, Index=[0, 1], Wrap=True)
area_2 = Area(Geometry=item)  # -> Area, Centroid
sort_2 = SortList(Keys=area_2.Area, ValuesA=item)  # -> Keys, reverse(ValuesA)
item_2 = ListItem(List=sort_2.ValuesA, Index=0, Wrap=True)
explode = Explode(Curve=item_2, Recursive=True)  # -> Segments, Vertices
join = JoinCurves(Curves=explode.Segments, Preserve=False)
disc = Discontinuity(Curve=join, Level=1)  # -> Points, Parameters
shatter = Shatter(Curve=join, Parameters=disc.Parameters)
c_script = CSharpScript(C=shatter, tol="1")  # -> out, A; inputs C: Curve, tol: Double
# ---------- c_script: C# ----------
    bool result = true;
    //double tol = 0.1;

    if (C.IsLinear(tol)) {
      result = false;
    }

    A = result;
# ---------- end c_script ----------
cull = CullPattern(List=shatter, CullPattern=c_script.A)

panel = Panel("""11
22
26""")
Z = UnitZ(Factor=expr("-x", panel))
Z_2 = UnitZ(Factor=expr("-x", "11"))
pt = Point(Point(-366, -9961, 0))
xy = XYPlane(Origin=pt)
pt_2 = Point(Point(892.057, -1496.839, 113))
panel_2 = Panel(pt_2)
X = UnitX(Factor=1)
sframe = SetFrame(XYZLocation="{976.06,-1406.37,135.86}", ABCOrientation="0,0,0")
brep_8 = Brep(brep_7)
y_threshold = Slider(200, range=-1000..1000)

tool_no = Panel("1")
spindle_speed_rpm = Panel("12000")
feed_mm_min = Panel("4000")
nc_settings = NCSettings(Tool=tool_no, Speed=spindle_speed_rpm, Feed=feed_mm_min)

ee = PredefinedSpindleEndEffector()
kuka_kr_125_2 = PredefinedKUKAKR1252(RobRootFrame=PlaneXY(0, 0, 0), EndEffectorOptional=ee)

# ----
# GENERATE TOOLPATHS
deviation_tolerance_mm = Panel(".5")
topoly = CurveToPolyline(Curve=cull, ToleranceDistance=deviation_tolerance_mm, ToleranceAngle=0)  # -> Polyline, Segments
shatter_2 = Shatter(Curve=reparameterize(topoly.Polyline), Parameters=0.5)
offset = Offset(Curve=shatter_2, Distance="9", Plane=PlaneXY(0, 0, 0), Corners=4)  # -> simplify(Curve)
disc_2 = Discontinuity(Curve=offset, Level=1)  # -> simplify(Points), Parameters
pshift = ShiftPaths(Data=disc_2.Points, Offset=-1)
duppt = RemoveDuplicatePts(Points=pshift, Tolerance=0.01)
pline = PolyLine(Vertices=duppt, Closed=False)
flip = FlipCurve(Curve=pline)  # -> Curve, Flag
panel_3 = Panel("""11
22
26""")
filter = StreamFilter(Gate=Toggle(True), Stream0=pline, Stream1=flip.Curve)
Z_3 = UnitZ(Factor=expr("-x", panel_3))
ext = ExtendCurve(Curve=filter, Type=0, Start="9", End="9")
Z_4 = UnitZ(Factor=expr("-x", "26"))
disc_3 = Discontinuity(Curve=reparameterize(ext), Level=1)  # -> simplify(Points), Parameters
move = Move(Geometry=ext, Motion=Z_2)  # -> Geometry, Transform
disc_4 = Discontinuity(Curve=ext, Level=1)  # -> Points, Parameters
move_2 = Move(Geometry=disc_3.Points, Motion=Z_4)  # -> simplify(Geometry), Transform
pshift_2 = ShiftPaths(Data=disc_4.Points, Offset=-1)
rev = ReverseList(List=move_2.Geometry)
pdecon_2 = Deconstruct(Point=pshift_2)  # -> XComponent, YComponent, ZComponent
lng = ListLength(List=pshift_2)
range = Range(Domain="0 to -11", Steps=expr("x-1", lng))
pt_3 = ConstructPoint(XCoordinate=pdecon_2.XComponent, YCoordinate=pdecon_2.YComponent, ZCoordinate=range)  # -> simplify(Point)

disc_5 = Discontinuity(Curve=topoly.Polyline, Level=1)  # -> Points, Parameters
lng_2 = ListLength(List=disc_2.Points)
panel_4 = Panel(lng_2)
pdecon_3 = Deconstruct(Point=pshift_2)  # -> XComponent, YComponent, ZComponent
pdecon_4 = Deconstruct(Point=pshift_2)  # -> XComponent, YComponent, ZComponent
lng_3 = ListLength(List=pshift_2)
lng_4 = ListLength(List=pshift_2)
range_2 = Range(Domain="-22 to -26", Steps=expr("x-1", lng_3))
range_3 = Range(Domain="-11 to -22", Steps=expr("x-1", lng_4))
pt_4 = ConstructPoint(XCoordinate=pdecon_3.XComponent, YCoordinate=pdecon_3.YComponent, ZCoordinate=range_2)  # -> simplify(Point)
pt_5 = ConstructPoint(XCoordinate=pdecon_4.XComponent, YCoordinate=pdecon_4.YComponent, ZCoordinate=range_3)  # -> simplify(Point)
merge = Merge(Data1=pt_3, Data2=pt_5, Data3=pt_4, Data4=rev)
merge_2 = Merge(Data1=pt_3, Data2=pt_5, Data3=pt_4)
merge_3 = Merge(Data1=pt_3, Data2=pt_5)
pline_2 = PolyLine(Vertices=pt_3, Closed=False)
duppt_2 = RemoveDuplicatePts(Points=merge, Tolerance=0.01)  # -> simplify(UniquePoints)

merge_4 = Merge(Data1=pt_3, Data2=merge_3, Data3=merge_2, Data4=duppt_2)
pline_3 = PolyLine(Vertices=merge_4, Closed=False)

pline_4 = PolyLine(Vertices=merge_3, Closed=False)
pline_5 = PolyLine(Vertices=merge_2, Closed=False)
pline_6 = PolyLine(Vertices=duppt_2, Closed=False)

tool_radius_mm = Panel("0")
clearance_plane_mm = Panel("100")
pln = Plane(xy)
crv = Curve(pline_3)
_3x_contour = _3XContour(Polyline=crv, ToolRadius=tool_radius_mm, SafetyOffset=clearance_plane_mm, Base=pln)  # -> Points, Vectors, Feed

panel_5 = Panel(crv)
pl = PlaneNormal(Origin=_3x_contour.Points, ZAxis=_3x_contour.Vectors)
align = AlignPlane(Plane=pl, Direction=X)  # -> Plane, Angle
orient = Orient(Geometry=align.Plane, Source=PlaneXY(0, 0, 0), Target=sframe)  # -> Geometry, Transform
orient_2 = Orient(Geometry=_3x_contour.Points, Source=PlaneXY(0, 0, 0), Target=pln)  # -> Geometry, Transform
orient_3 = Orient(Geometry=brep_8, Source=pln, Target=sframe)  # -> Geometry, Transform
deplane = DeconstructPlane(Plane=orient.Geometry)  # -> Origin, XAxis, YAxis, ZAxis
pline_7 = PolyLine(Vertices=orient_2.Geometry, Closed=False)
avr = Average(Input=deplane.Origin)
preview = CustomPreview(Geometry=orient_3.Geometry, Shader=ColourSwatch(SwatchColor=RGBA(176, 176, 176, 148)))
preview_2 = CustomPreview(Geometry=pline_7, Shader=ColourSwatch(SwatchColor=RGB(0, 255, 238)))
pt_6 = Point(avr)
pdecon_5 = Deconstruct(Point=pt_6)  # -> XComponent, YComponent, ZComponent
larger = LargerThan(FirstNumber=pdecon_5.YComponent, SecondNumber=y_threshold)  # -> LargerThan, OrEqualTo
dispatch = Dispatch(List=avr, DispatchPattern=larger.LargerThan)  # -> ListA, ListB
lng_5 = ListLength(List=dispatch.ListB)
lng_6 = ListLength(List=dispatch.ListA)
bnd = Bounds(Numbers=flatten(pdecon_5.YComponent))
repeat = RepeatData(Data=Slider(90, range=-90..90), Length=lng_6)
repeat_2 = RepeatData(Data=Slider(-90, range=-90..90), Length=lng_5)
bnd_2 = Bounds(Numbers=flatten(pdecon_5.XComponent))
c_script_2 = CSharpScript(D=bnd)  # -> out, A
# ---------- c_script_2: C# ----------
    double t0 = D.T0;
    double t1 = D.T1;
    
    if (Math.Abs(t0) >= Math.Abs(t1)){
      Print("t0 larger or equal than t1");
      t1 = Math.Abs(t0);
    } else {
      Print("t1 larger than t0");
      t0 = Math.Abs(t1);
    }

    A = new Interval(t0, t1);
    //A = D.Mid;
# ---------- end c_script_2 ----------
merge_5 = Merge(Data1=repeat, Data2=repeat_2)  # -> simplify(Result)
remap = RemapNumbers(Value=pdecon_5.XComponent, Source=bnd_2, Target=Domain(1, 0))  # -> Mapped, Clipped
remap_2 = RemapNumbers(Value=pdecon_5.YComponent, Source=c_script_2.A, Target="-90 to 90")  # -> Mapped, Clipped
remap_3 = RemapNumbers(Value=pdecon_5.YComponent, Source=c_script_2.A, Target=Domain(0, 1))  # -> Mapped, Clipped
multiplication = Multiplication(A=remap_2.Mapped, B=remap_3.Mapped)
multiplication_2 = Multiplication(A=merge_5, B=remap.Mapped)
addition = Addition(A=multiplication_2, B=multiplication)
lng_7 = ListLength(List=orient.Geometry)
filter_2 = StreamFilter(Gate=Slider(2, range=0..2), Stream0=merge_5, Stream1=remap_2.Mapped, Stream2=addition)
dup = DuplicateData(Data=filter_2, Number=lng_7, Order=True)
rad = Radians(Degrees=dup)
txt = Text(_3x_contour.Feed)
num = Number(dup)
panel_6 = Panel(filter_2)
prot = RotatePlane(Plane=orient.Geometry, Angle=rad)
deplane_2 = DeconstructPlane(Plane=prot)  # -> Origin, XAxis, YAxis, ZAxis
pt_7 = Point(deplane_2.Origin)
vec = Vector(deplane_2.ZAxis)
nc_r = NCGenerationRobomove(Points=pt_7, Vectors=vec, Rotation=num, Feed=txt, Settings=nc_settings)

nc = NCGeneration(Points=pt_7, Vectors=vec, Feed=txt, Settings=nc_settings)
panel_7 = Panel(nc_r)

pline_8 = PolyLine(Vertices=flatten(prot), Closed=False)
preview_3 = CustomPreview(Geometry=pline_8, Shader=ColourSwatch(SwatchColor=RGB(0, 255, 238)))
iframe = InterpolateFrames(Frames=flatten(prot), Length=Slider(0.21, range=0..1), Step=10, Reset=Toggle(True))  # -> Frame, Percent, CurrentIndex
robot_ik = RobotInverseKinematics(Robot=kuka_kr_125_2, TargetTCPFrame=iframe.Frame, AxisToggles=[False, False, False], useColorPreview=True)  # -> PoseGeometry, AxisValues, AxisFrames
