# Grasshopper definition Shingle_shell-CAM-5-Cutout-5X_contours.gh (Grasshopper 1.0.7)
# plug-ins: Sandbox, VirtualRobot.Grasshopper

# ---- group: Sheet-2
crv = Curve([<curve referenced from the Rhino model> x70])

# ---- group: Sheet-1
crv_2 = Curve([<curve referenced from the Rhino model> x58])

# ---- group: Sheet-4
crv_3 = Curve([<curve referenced from the Rhino model> x66])

# ---- group: Sheet-5
crv_4 = Curve([<curve referenced from the Rhino model> x12])

# ---- group: Sheet-3
crv_5 = Curve([<curve referenced from the Rhino model> x68])

# ----
# SORT OUTLINES
crv_6 = Curve(crv_2)
disc = Discontinuity(Curve=crv_6, Level=1)  # -> Points, Parameters
avr = Average(Input=disc.Points)
pdecon = Deconstruct(Point=avr)  # -> XComponent, YComponent, ZComponent
sort = SortList(Keys=flatten(pdecon.YComponent), ValuesA=crv_6)  # -> Keys, ValuesA
partition = PartitionList(List=sort.ValuesA, Size=2)
disc_2 = Discontinuity(Curve=partition, Level=1)  # -> Points, Parameters
avr_2 = Average(Input=disc_2.Points)
pshift = ShiftPaths(Data=avr_2, Offset=-1)
pdecon_2 = Deconstruct(Point=pshift)  # -> XComponent, YComponent, ZComponent
sort_2 = SortList(Keys=pdecon_2.ZComponent, ValuesA=partition)  # -> Keys, reverse(ValuesA)
crv_7 = Curve(sort_2.ValuesA)

pt = Point(Point(892.057, -1496.839, 113))
panel = Panel(pt)
sframe = SetFrame(XYZLocation="{976.06,-1406.37,135.86}", ABCOrientation="0,0,0")
X = UnitX(Factor=1)
crv_8 = Curve(crv_6)

tool_no = Panel("1")
spindle_speed_rpm = Panel("12000")
feed_mm_min = Panel("4000")
nc_settings = NCSettings(Tool=tool_no, Speed=spindle_speed_rpm, Feed=feed_mm_min)

y_threshold = Slider(200, range=-1000..1000)
ee = PredefinedSpindleEndEffector()
kuka_kr_125_2 = PredefinedKUKAKR1252(RobRootFrame=PlaneXY(0, 0, 0), EndEffectorOptional=ee)

# ----
# GENERATE TOOL PATHS
crv_9 = Curve(crv_7)
flip = FlipCurve(Curve=crv_9)  # -> Curve, Flag
filter = StreamFilter(Gate=Toggle(True), Stream0=crv_9, Stream1=flip.Curve)
tool_radius_including_tolerance_mm = Panel("9.5")
panel_2 = Panel("""10
20
26""")
lng = ListLength(List=panel_2)

topoly = CurveToPolyline(Curve=filter, ToleranceDistance="0.5", ToleranceAngle=0)  # -> Polyline, Segments

item = ListItem(List=topoly.Polyline, Index=0, Wrap=True)  # -> Item, Item1
explode = Explode(Curve=item.Item, Recursive=True)  # -> Segments, Vertices
eval = EvaluateLength(Curve=graft(explode.Segments), Length=[0, 1], Normalized=True)  # -> Point, Tangent, Parameter
eval_2 = EvaluateLength(Curve=explode.Segments, Length=0.5, Normalized=True)  # -> Point, Tangent, Parameter
vdis = VectorDisplay(Anchor=eval_2.Point, Vector=eval_2.Tangent)
crv_cp = CurveClosestPoint(Point=eval_2.Point, Curve=item.Item1)  # -> Point, Parameter, Distance
vec2pt = Vector2Pt(PointA=eval_2.Point, PointB=crv_cp.Point, Unitize=False)  # -> Vector, Length
pl = ConstructPlane(Origin=eval_2.Point, XAxis=eval_2.Tangent, YAxis=vec2pt.Vector)  # -> graft(Plane)
deplane = DeconstructPlane(Plane=pl)  # -> Origin, XAxis, YAxis, ZAxis
pl_2 = ConstructPlane(Origin=deplane.Origin, XAxis=deplane.XAxis, YAxis=deplane.ZAxis)  # -> simplify(Plane)
pl_origin = PlaneOrigin(Base=pl_2, Origin=eval.Point)
pt_2 = PointOriented(BasePlane=pl_origin, UComponent=0, VComponent=tool_radius_including_tolerance_mm, WComponent=0)
item_2 = ListItem(List=pt_2, Index=0, Wrap=True)  # -> Item, Item1
deplane_2 = DeconstructPlane(Plane=simplify(pl_2))  # -> Origin, XAxis, YAxis, ZAxis
ln = Line(StartPoint=item_2.Item, EndPoint=item_2.Item1)  # -> simplify(Line)
rev = Reverse(Vector=deplane_2.ZAxis)
eval_3 = EvaluateLength(Curve=ln, Length=0.5, Normalized=True)  # -> Point, Tangent, Parameter
vdis_2 = VectorDisplay(Anchor=deplane_2.Origin, Vector=deplane_2.ZAxis)
amp = Amplitude(Vector=rev, Amplitude=panel_2)
pl_origin_2 = PlaneOrigin(Base=pl, Origin=eval_3.Point)  # -> simplify(Plane)
pshift_2 = ShiftPaths(Data=pl_origin_2, Offset=-1)
shift = ShiftList(List=pshift_2, Shift=-1, Wrap=True)
shift_2 = ShiftList(List=pshift_2, Shift=1, Wrap=True)
shift_3 = ShiftList(List=pshift_2, Shift=0, Wrap=True)
ppx = PlanePlane(PlaneA=shift, PlaneB=shift_3)  # -> graft(Line)
ppx_2 = PlanePlane(PlaneA=shift_3, PlaneB=shift_2)  # -> graft(Line)
llx = LineLine(Line1=ppx_2, Line2=ln)  # -> ParamA, ParamB, PointA, PointB
llx_2 = LineLine(Line1=ppx, Line2=ln)  # -> ParamA, ParamB, PointA, PointB
ln_2 = Line(StartPoint=llx_2.PointA, EndPoint=llx.PointA)
eval_4 = EvaluateLength(Curve=ln_2, Length=0.5, Normalized=True)  # -> Point, Tangent, Parameter
vdis_3 = VectorDisplay(Anchor=eval_4.Point, Vector=eval_4.Tangent)
dup = DuplicateData(Data=simplify(pl_2), Number=lng, Order=True)  # -> simplify(Data)
move = Move(Geometry=ln_2, Motion=amp)  # -> simplify(Geometry), Transform
path_mapper = PathMapper(dup, source="{A;B}(i)", target="{A;i}")
path_mapper_2 = PathMapper(move.Geometry, source="{A;B}(i)", target="{A;i}")
split = SplitTree(Data=path_mapper_2, Masks=flatten("{?;2}"))  # -> Positive, Negative
split_2 = SplitTree(Data=path_mapper, Masks=flatten("{?;2}"))  # -> Positive, Negative
flip_2 = FlipCurve(Curve=split.Positive)  # -> Curve, Flag
rev_2 = ReverseList(List=flip_2.Curve)
rev_3 = ReverseList(List=split_2.Positive)
merge = Merge(Data1=rev_2, Data2=split.Negative)
merge_2 = Merge(Data1=rev_3, Data2=split_2.Negative)
eval_5 = EvaluateLength(Curve=merge, Length=0.5, Normalized=True)  # -> Point, Tangent, Parameter
eval_6 = EvaluateLength(Curve=merge, Length=0.5, Normalized=True)  # -> Point, Tangent, Parameter
vdis_4 = VectorDisplay(Anchor=eval_5.Point, Vector=eval_5.Tangent)
pl_origin_3 = PlaneOrigin(Base=merge_2, Origin=eval_6.Point)
crv_10 = Curve(merge)
pln = Plane(pl_origin_3)

crv_11 = Curve(crv_10)

# ----
# GENERATE CAM DATA
pln_2 = Plane(pln)
pt_3 = Point(Point(-366, -9961, 0))
eval_7 = EvaluateLength(Curve=graft(crv_11), Length=[0, 1], Normalized=True)  # -> Point, Tangent, Parameter
xy = XYPlane(Origin=pt_3)
pl_origin_4 = PlaneOrigin(Base=graft(pln_2), Origin=eval_7.Point)
clearance_plane_mm = Panel("100")
orient = Orient(Geometry=pl_origin_4, Source=xy, Target=PlaneXY(0, 0, 0))  # -> Geometry, Transform
pt_4 = ConstructPoint(XCoordinate=0, YCoordinate=0, ZCoordinate=clearance_plane_mm)
pshift_3 = ShiftPaths(Data=orient.Geometry, Offset=-1)
xy_2 = XYPlane(Origin=pt_4)
item_3 = ListItem(List=pshift_3, Index=0, Wrap=True)  # -> Item1, Item
line = LineSDL(Start=item_3.Item1, Direction=item_3.Item1, Length=1000)
line_2 = LineSDL(Start=item_3.Item, Direction=item_3.Item, Length=1000)
plx = LinePlane(Line=line_2, Plane=xy_2)  # -> Point, ParamL, ParamP
plx_2 = LinePlane(Line=line, Plane=xy_2)  # -> Point, ParamL, ParamP
pl_origin_5 = PlaneOrigin(Base=item_3.Item1, Origin=plx_2.Point)
pl_origin_6 = PlaneOrigin(Base=item_3.Item, Origin=plx.Point)
ins = InsertItems(List=pshift_3, Item=pl_origin_5, Indices=-1, Wrap=True)
ins_2 = InsertItems(List=ins, Item=pl_origin_6, Indices=0, Wrap=True)
lng_2 = ListLength(List=ins)
dup_2 = DuplicateData(Data="G1", Number=lng_2, Order=True)
pln_3 = Plane(ins_2)
orient_2 = Orient(Geometry=pln_3, Source=PlaneXY(0, 0, 0), Target=xy)  # -> Geometry, Transform
ins_3 = InsertItems(List=dup_2, Item="G0", Indices=0, Wrap=True)
pline = PolyLine(Vertices=flatten(orient_2.Geometry), Closed=False)
txt = Text(ins_3)
preview = CustomPreview(Geometry=pline, Shader=ColourSwatch(SwatchColor=RGB(0, 255, 238)))

pln_4 = Plane(pln_3)
align = AlignPlane(Plane=pln_4, Direction=X)  # -> Plane, Angle
orient_3 = Orient(Geometry=crv_8, Source=xy, Target=sframe)  # -> Geometry, Transform
orient_4 = Orient(Geometry=align.Plane, Source=PlaneXY(0, 0, 0), Target=sframe)  # -> Geometry, Transform
deplane_3 = DeconstructPlane(Plane=orient_4.Geometry)  # -> Origin, XAxis, YAxis, ZAxis
avr_3 = Average(Input=deplane_3.Origin)
preview_2 = CustomPreview(Geometry=orient_3.Geometry, Shader=ColourSwatch(SwatchColor=RGBA(176, 176, 176, 148)))
pt_5 = Point(avr_3)
pdecon_3 = Deconstruct(Point=pt_5)  # -> XComponent, YComponent, ZComponent
larger = LargerThan(FirstNumber=pdecon_3.YComponent, SecondNumber=y_threshold)  # -> LargerThan, OrEqualTo
dispatch = Dispatch(List=avr_3, DispatchPattern=larger.LargerThan)  # -> ListA, ListB
lng_3 = ListLength(List=dispatch.ListB)
lng_4 = ListLength(List=dispatch.ListA)
bnd = Bounds(Numbers=flatten(pdecon_3.YComponent))
repeat = RepeatData(Data=Slider(90, range=-90..90), Length=lng_4)
repeat_2 = RepeatData(Data=Slider(-90, range=-90..90), Length=lng_3)
bnd_2 = Bounds(Numbers=flatten(pdecon_3.XComponent))
c_script = CSharpScript(D=bnd)  # -> out, A
# ---------- c_script: C# ----------
    double t0 = D.T0;
    double t1 = D.T1;
    
    if (Math.Abs(t0) >= Math.Abs(t1)){
      Print("t0 larger or equal than t1");
      t1 = Math.Abs(t0);
    } else {
      Print("t1 larger than t0");
      t0 = Math.Abs(t1);
    }

    A = new Interval(t0, t1);
    //A = D.Mid;
# ---------- end c_script ----------
merge_3 = Merge(Data1=repeat, Data2=repeat_2)  # -> simplify(Result)
remap = RemapNumbers(Value=pdecon_3.XComponent, Source=bnd_2, Target=Domain(1, 0))  # -> Mapped, Clipped
remap_2 = RemapNumbers(Value=pdecon_3.YComponent, Source=c_script.A, Target="-90 to 90")  # -> Mapped, Clipped
remap_3 = RemapNumbers(Value=pdecon_3.YComponent, Source=c_script.A, Target=Domain(0, 1))  # -> Mapped, Clipped
multiplication = Multiplication(A=remap_2.Mapped, B=remap_3.Mapped)
multiplication_2 = Multiplication(A=merge_3, B=remap.Mapped)
lng_5 = ListLength(List=orient_4.Geometry)
addition = Addition(A=multiplication_2, B=multiplication)
filter_2 = StreamFilter(Gate=Slider(0, range=0..2), Stream0=merge_3, Stream1=remap_2.Mapped, Stream2=addition)
dup_3 = DuplicateData(Data=filter_2, Number=lng_5, Order=True)
num = Number(dup_3)
rad = Radians(Degrees=dup_3)
prot = RotatePlane(Plane=orient_4.Geometry, Angle=rad)
null = NullItem(Item=prot)  # -> NullFlags, InvalidFlags, Description
pline_2 = PolyLine(Vertices=flatten(prot), Closed=False)
preview_3 = CustomPreview(Geometry=pline_2, Shader=ColourSwatch(SwatchColor=RGB(0, 255, 238)))
iframe = InterpolateFrames(Frames=flatten(prot), Length=Slider(0, range=0..1), Step=10, Reset=Toggle(True))  # -> Frame, Percent, CurrentIndex
robot_ik = RobotInverseKinematics(Robot=kuka_kr_125_2, TargetTCPFrame=iframe.Frame, AxisToggles=[False, False, False], useColorPreview=True)  # -> PoseGeometry, AxisValues, AxisFrames

deplane_4 = DeconstructPlane(Plane=prot)  # -> Origin, XAxis, YAxis, ZAxis
txt_2 = Text(txt)
nc = NCGeneration(Points=deplane_4.Origin, Vectors=deplane_4.ZAxis, Feed=txt_2, Settings=nc_settings)

nc_r = NCGenerationRobomove(Points=deplane_4.Origin, Vectors=deplane_4.ZAxis, Rotation=num, Feed=txt_2, Settings=nc_settings)

panel_3 = Panel(nc_r)
