# Grasshopper definition 3X_Contour_EXAX_Tool flexible.gh (Grasshopper 1.0.7)
# Copyright: University of Stuttgart, ICD
# plug-ins: Sandbox, VirtualRobot.Grasshopper

brep = Brep([<brep referenced from the Rhino model> x3])
debrep = DeconstructBrep(Brep=brep)  # -> Faces, Edges, Vertices
deviation_tolerance_mm = Panel("1.0")
join = JoinCurves(Curves=debrep.Edges, Preserve=False)
topoly = CurveToPolyline(Curve=join, ToleranceDistance=deviation_tolerance_mm, ToleranceAngle=0)  # -> Polyline, Segments

range = Range(Domain="0 to -21", Steps=3)
cull_i = CullIndex(List=range, Indices=0, Wrap=True)
Z = UnitZ(Factor=cull_i)
move = Move(Geometry=graft(topoly.Polyline), Motion=Z)  # -> Geometry, Transform
panel = Panel(move.Geometry)
pt = Point(Point(3982.14951, -1305.490001, 52))
pt_2 = Point(Point(3982.14951, 80.5099994, 52))
pt_3 = Point(Point(3173.14951, -1305.490001, 52))
pl_3pt = Plane3Pt(PointA=pt, PointB=pt_2, PointC=pt_3)
X = UnitX(Factor=1)

Z_2 = Panel("947.538")
X_2 = Panel("148.714")
Y = Panel("-2224.126")
B = Panel("-0.047")
C = Panel("0")
A = Panel("-88.786")
pt_4 = ConstructPoint(XCoordinate=X_2, YCoordinate=Y, ZCoordinate=Z_2)
vec = VectorXYZ(XComponent=A, YComponent=B, ZComponent=C)  # -> Vector, Length
sframe = SetFrame(XYZLocation=pt_4, ABCOrientation=vec.Vector)

Z_3 = Panel("70")
Y_2 = Panel("600")
X_3 = Panel("-400")
A_2 = Panel("-90")
B_2 = Panel("0")
C_2 = Panel("0")
pt_5 = ConstructPoint(XCoordinate=X_3, YCoordinate=Y_2, ZCoordinate=Z_3)
vec_2 = VectorXYZ(XComponent=A_2, YComponent=B_2, ZComponent=C_2)  # -> Vector, Length
sframe_2 = SetFrame(XYZLocation=pt_5, ABCOrientation=vec_2.Vector)

# ----
# Turntable Origin
pln = Plane(sframe)

orient = Orient(Geometry=sframe_2, Source=PlaneXY(0, 0, 0), Target=sframe)  # -> Geometry, Transform
feed_mm_min = Panel("3000")
eval = Evaluate(F="Round((x/1000)/60, 3)", x=feed_mm_min)
velocity_cp = Number(eval)

# ----
# KRL Settings
home_position = Panel("A1 0, A2 -120, A3 120, A4 0, A5 -20, A6 0, E1 0, E2 0, E3 0, E4 0, E5 0, E6 0")
velocity_cp_m_s = Slider(0.4, range=0..2)
velocity_ptp = Slider(10, range=0..100)
base = Slider(0, range=0..3)
tool = Slider(1, range=1..2)
vb = VBScript()  # -> out, A
# ---------- vb: VB ----------
    'Code written by Tobias Schwinn
    'Code copyrighted by ICD, University of Stuttgart
    'Code version Monday, 05 May 2014

    Dim _name As String = Rhino.RhinoDoc.ActiveDoc.Name
    Dim _split() As String = Split(_name, ".")
    A = _split(0)
# ---------- end vb ----------
job_name = Panel(vb.A)
krl_settings = KRLSettings(name=vb.A, home=home_position, velcp=velocity_cp, velptp=velocity_ptp, tool=tool, base=base, rpm="10000")

# ----
# CAM-TOOLING
tool_radius_mm = Panel("0")
clearance_plane_mm = Panel("50")
pln_2 = Plane(pl_3pt)
crv = Curve(move.Geometry)
_3x_contour = _3XContour(Polyline=crv, ToolRadius=tool_radius_mm, ClearanceOffset=clearance_plane_mm, Base=pln_2)  # -> Points, Vectors, Feed

pl = PlaneNormal(Origin=_3x_contour.Points, ZAxis=_3x_contour.Vectors)
align = AlignPlane(Plane=pl, Direction=X)  # -> Plane, Angle

orient_2 = Orient(Geometry=align.Plane, Source=PlaneXY(0, 0, 0), Target=pln_2)  # -> Geometry, Transform
pline = PolyLine(Vertices=orient_2.Geometry, Closed=False)
preview = CustomPreview(Geometry=pline, Shader=ColourSwatch(SwatchColor=RGB(0, 255, 238)))
pln_3 = Plane(align.Plane)

# ----
# Target frames
pln_4 = Plane(pln_3)
pln_5 = Plane(orient.Geometry)
orient_3 = Orient(Geometry=pln_4, Source=PlaneXY(0, 0, 0), Target=pln_5)  # -> Geometry, Transform
pline_2 = PolyLine(Vertices=flatten(orient_3.Geometry), Closed=False)
pln_6 = Plane(orient_3.Geometry)
preview_2 = CustomPreview(Geometry=pline_2, Shader=ColourSwatch(SwatchColor=RGB(0, 255, 238)))

# ----
# TOOL PRIORITY (FLEXIBLE ORIENTATION)
pln_7 = Plane(pln_6)
pln_8 = Plane(pln)
A_3 = Slider(90, range=-90..90)
lng = ListLength(List=pln_7)
vec2pt = Vector2Pt(PointA=pln_7, PointB=pln_8, Unitize=False)  # -> Vector, Length
e1_min = Slider(90, range=-180..180)
e1_max = Slider(180, range=-180..180)
range_2 = Range(Domain=Domain(0, 1), Steps=expr("x-1", lng))
devec = DeconstructVector(Vector=vec2pt.Vector)  # -> XComponent, YComponent, ZComponent
vec_3 = VectorXYZ(XComponent=devec.XComponent, YComponent=devec.YComponent, ZComponent=0)  # -> Vector, Length
rad = Radians(Degrees=A_3)
rad_2 = Radians(Degrees=e1_max)
rad_3 = Radians(Degrees=e1_min)
graph = GraphMapper(range_2, x0=0, x1=1, y0=0, y1=1, container_name="Sine", Equation_px=[0, 0.5], Equation_py=[0, 1])
dom = ConstructDomain(DomainStart=rad_3, DomainEnd=rad_2)
vrot = Rotate(Vector=vec_3.Vector, Axis=pln_8, Angle=rad)
remap = RemapNumbers(Value=graph, Source=Domain(0, 1), Target=dom)  # -> Mapped, Clipped
align_2 = AlignPlane(Plane=pln_7, Direction=vrot)  # -> Plane, Angle
pln_9 = Plane(pln_8)
pln_10 = Plane(align_2.Plane)
num = Number(remap.Mapped)
pcomp = PlaneComponents(Plane=pln_10)  # -> Origin, XAxis, YAxis, ZAxis
prot = RotatePlane(Plane=pln_9, Angle=num)
deplane = DeconstructPlane(Plane=prot)  # -> Origin, XAxis, YAxis, ZAxis
plcoord = PlaneCoordinates(Point=pcomp.Origin, System=pln_9)  # -> XCoordinate, YCoordinate, ZCoordinate
vec_4 = VectorXYZ(XComponent=plcoord.XCoordinate, YComponent=plcoord.YCoordinate, ZComponent=0)  # -> Vector, Length
amp = Amplitude(Vector=deplane.YAxis, Amplitude=250)
vb_2 = VBScript(V=vec_4.Vector, P=pln_9, R=prot)  # -> out, S; inputs V: list of Vector3d, P: Plane, R: list of Plane
# ---------- vb_2: VB ----------
    ' Step 1: get refAngle
    Dim _refAngle As Double = Vector3d.VectorAngle(V.Item(0), R.item(0).YAxis, P)
    _refAngle = _refAngle

    Dim _refAngles As New List(Of Double)
    If V.count = R.Count Then
      For i As int32 = 0 To V.count - 2
        _refAngles.add(Vector3d.VectorAngle(R.Item(i).YAxis, R.item(i + 1).YAxis, P))
      Next
    Else If R.count = 1 Then
      For i As int32 = 0 To V.count - 2
        _refAngles.add(0)
      Next
    Else
      Throw New Exception("Something is wrong with the number of reference planes!")
    End If

    ' Step 2:
    Dim _angles As New List(Of Double)
    Dim _angle As Double = 0
    For i As int32 = 0 To v.count - 2
      _angle = Vector3d.VectorAngle(V.Item(i + 1), V.Item(i), P)
      _angles.add(minPI(_angle))
    Next

    Dim _sum As New List(Of Double)
    Dim _total As Double = minPI(_refAngle)
    _sum.add(_total)
    For i As int32 = 0 To _angles.count - 1
      _total += _angles.item(i) + minPI(_refAngles.item(i))
      _sum.add(_total)
    Next

    S = _sum
# ---------- vb_2: VB additional code ----------
  Private Function minPI(ByVal val As Double) As Double
    If val > Math.PI Then
      val = val - 2 * Math.PI
    End If
    Return  val
  End Function
# ---------- end vb_2 ----------
vdis = VectorDisplay(Anchor=deplane.Origin, Vector=amp)
num_2 = Number(vb_2.S)
orient_4 = Orient(Geometry=pln_10, Source=pln_9, Target=PlaneXY(0, 0, 0))  # -> Geometry, Transform
rotate = Rotate(Geometry=pln_10, Angle=num_2, Plane=pln_9)  # -> Geometry, Transform
deg = Degrees(Radians=num_2)
pln_11 = Plane(rotate.Geometry)
num_3 = Number(deg)
pln_12 = Plane(orient_4.Geometry)

pln_13 = Plane(pln_11)
num_4 = Number(num_3)
pln_14 = Plane(pln_12)

# ----
# Evaluate Target Frame List
num_5 = Number(flatten(num_4))
pln_15 = Plane(flatten(pln_13))
E = Slider(0.267, range=0..1)
stepsize_mm = Slider(10, range=-10..20)
timer = Timer(TimerInterval=50, Target=vb_3)  # disabled
vb_3 = VBScript(N=pln_15, E1=num_5, E=E, S=stepsize_mm, T=Toggle(True))  # -> out, A, B, C; inputs N: list of Plane, E1: list
# ---------- vb_3: VB ----------
    'Code written by Tobias Schwinn
    'Code copyrighted by ICD, University of Stuttgart
    'Code version Monday, 05 May 2014

    Static _inc As Double = Nothing
    Static _len As Double = Double.NaN
    Static _poly As Polyline = Nothing
    Dim _pt As Point3d = Point3d.Unset
    Dim _plane As Plane = Plane.Unset
    Dim _ex As Double = Double.NaN

    If T Then

      _inc = E
      _len = 0
      _poly = New Polyline()
      _plane = N.item(0)
      _ex = RhinoMath.ToRadians(E1.item(0))

      ' Step 1: get the length of the tool path
      For Each _pl As Plane In N
        _poly.Add(_pl.Origin)
      Next
      _len = _poly.Length

    Else

      _inc += S / _len
      If _inc > 1 Then
        _inc = 1
      Else If _inc < 0 Then
        _inc = 0
      End If

    End If

    ' Step 2: interpolate the plane based on where along the path we are
    Dim _crv As Curve = _poly.ToNurbsCurve
    _pt = _crv.PointAtNormalizedLength(_inc)
    Dim _param As Double = _poly.ClosestParameter(_pt)
    Dim _index As Int32 = Math.Floor(_param)
    Dim _line As Line = _poly.SegmentAt(_index)
    Dim _t As Double = _line.ClosestParameter(_pt)
    Dim _P0 As Plane = N.item(_index)
    Dim _EX0 As Double = E1.item(_index)
    Dim _P1 As Plane
    Dim _EX1 As Double
    If _index = _poly.SegmentCount Then
      _P1 = N.item(_index)
      _EX1 = E1.item(_index)
    Else
      _P1 = N.item(_index + 1)
      _EX1 = E1.item(_index + 1)
    End If

    Dim _origin As Point3d = _P0.Origin + _t * (_P1.Origin - _P0.Origin)
    Dim _xDir As Vector3d = _P0.XAxis + _t * (_P1.XAxis - _P0.XAxis)
    Dim _yDir As Vector3d = _P0.YAxis + _t * (_P1.YAxis - _P0.YAxis)
    _plane = New plane(_origin, _xDir, _yDir)
    _ex = _EX0 + _t * (_EX1 - _EX0)

    A = _plane
    B = Math.Round(_inc * 100, 3)
    C = RhinoMath.ToRadians(_ex)
# ---------- end vb_3 ----------
panel_2 = Panel(vb_3.B)

# ----
# KRL-Code generation
pln_16 = Plane(pln_14)
num_6 = Number(num_4)
data = Data(krl_settings)
krl_exax = VBScript(P=pln_16, E1=num_6, S=data)  # -> out, A, B; inputs P: tree of Plane, E1: tree
# ---------- krl_exax: VB usings ----------
Imports System.IO
Imports System.Linq
Imports System.Data
Imports System.Drawing
Imports System.Reflection
Imports System.Windows.Forms
Imports System.Xml
Imports System.Xml.Linq
Imports Microsoft.VisualBasic
Imports System.Runtime.InteropServices

Imports Rhino.DocObjects
Imports Rhino.Collections
Imports GH_IO
Imports GH_IO.Serialization
# ---------- krl_exax: VB ----------
    'Code written by Tobias Schwinn
    'Code copyrighted by ICD, University of Stuttgart
    'Code version Monday, 12 May 2014

    ' Step 0: generate point-vector (XYZ-ABC) pair from planes
    Dim _xyz As DataTree(Of Point3d) = getXYZ(P)
    Dim _abc As DataTree(Of Vector3d) = getABC(P)

    ' Step 1: create a new KRL code object
    Dim _krl As KRLCode = New KRLCode(S)

    ' Step 2: generate the header
    Call _krl.Header()

    ' Step 3: generate the declaration
    Call _krl.Decl()

    ' Step 4: initialization section
    Call _krl.Init()

    ' Step 5: main program
    Call _krl.Main(_xyz, _abc, E1)

    ' Step 6: generate the footer
    Call _krl.Footer()

    A = _krl.Code
# ---------- krl_exax: VB additional code ----------
  Private Function getXYZ(ByVal P As DataTree(Of Plane)) As DataTree(Of Point3d)

    Dim _pts As New DataTree(Of Point3d)

    For Each _path As Gh_Path In P.Paths
      Dim _branch As list(Of Plane) = P.Branch(_path)
      For Each _pl As Plane In _branch
        _pts.Add(_pl.Origin, _path)
      Next
    Next

    Return _pts

  End Function

  Private Function getABC(ByVal P As DataTree(Of Plane)) As DataTree(Of Vector3d)

    Dim _vts As New Datatree(Of Vector3d)
    Dim _s As Plane = Plane.Unset

    For Each _path As Gh_Path In P.Paths

      Dim _branch As list(Of Plane) = P.Branch(_path)

      For Each _t As Plane In _branch
        _s = Plane.WorldXY
        _s.Origin = _t.Origin
        Dim _abc As New Vector3d()

        ' Rotation around z-Axis
        Dim _a As Double = Vector3d.VectorAngle(_s.XAxis, _t.XAxis, _s)
        If _a > Math.PI Then
          _a = _a - 2 * Math.PI
        End If
        _s.Rotate(_a, _s.ZAxis)
        _abc.X = Rhinomath.ToDegrees(_a)

        ' Rotation around y-Axis
        Dim _refY As Plane = New Plane(_s.Origin, _s.XAxis, -_s.ZAxis)
        Dim _b As Double = Vector3d.VectorAngle(_s.XAxis, _t.XAxis, _refY)
        If _b > Math.PI Then
          _b = _b - 2 * Math.PI
        End If
        _s.Rotate(_b, _s.YAxis)
        _abc.Y = Rhinomath.ToDegrees(_b)

        ' Rotation around x-Axis
        Dim _refZ As Plane = New Plane(_s.Origin, _s.YAxis, _s.ZAxis)
        Dim _c As Double = Vector3d.VectorAngle(_s.YAxis, _t.YAxis, _refZ)
        If _c > Math.PI Then
          _c = _c - 2 * Math.PI
        End If
        _s.Rotate(_c, _s.YAxis)
        _abc.Z = Rhinomath.ToDegrees(_c)

        _vts.Add(_abc, _path)

      Next
    Next

    Return _vts

  End Function

  Private Class KRLCode

    Private _code As List(Of String)
    Private _r As Int32 = 3

    Private _name As String
    Private _home As String
    Private _velcp As String
    Private _velptp As String
    Private _tool As String
    Private _base As String

    Public Sub New(ByVal S As Object)
      _code = New List(Of String)
      _name = S.Name
      _home = S.Home
      _velcp = S.VelCP
      _velptp = S.VelPTP
      _tool = S.Tool
      _base = S.Base
    End Sub

    Public Sub Header()
      _code.Add("&ACCESS RVP")
      _code.Add("&REL 1")
      _code.Add("&PARAM TEMPLATE = C:\KRC\Roboter\Template\vorgabe")
      _code.Add("&PARAM EDITMASK = *")
      _code.Add("DEF " & _name & "()")
    End Sub

    Public Sub Decl()
      _code.Add(vbcrlf & ";------- Declaration section -------")
      _code.Add("DECL E6AXIS HOME")
    End Sub

    Public Sub Init()
      _code.Add(vbcrlf & ";------- Initialization ---------")
      _code.Add("BAS (#INITMOV,0)")
      _code.Add("BAS (#VEL_CP, " & _velcp & ")  ;Continous Path velocity (m/s)")
      _code.Add("BAS (#VEL_PTP, " & _velptp & ")  ;Point-to-point movement velocity (m/s^2)")
      '_code.Add("$ACC_EXTAX[1] = 10 ;Accelleration external axis (Percent)")
      '_code.Add("$APO.CVEL = 100    ;approximation velocity criterion (%)")
      '_code.Add("$BASE = BASE_DATA[" & _base & "]   ;setting of the base coordinate system")
      '_code.Add("$ACT_BASE = " & _base)
      _code.Add("$BASE = EK(MACHINE_DEF[2].ROOT,MACHINE_DEF[2].MECH_TYPE,BASE_CORR:BASE_DATA[17]:M_BASE_CORR)")
      'GSatz.Add("$ACT_EX_AX = 1")
      _code.Add(String.Format("BAS (#TOOL, {0})   ;setting of the tool coordinate system", _tool))
      '_code.Add("$ACT_TOOL = " & _tool)
      _code.Add("HOME = {" & _home & "}")
    End Sub

    Public Sub Main(ByVal P As DataTree(Of Point3d), ByVal V As DataTree(Of Vector3d), ByVal E1 As DataTree(Of Double))

      Dim _pt As Point3d
      Dim _abc As Vector3d
      Dim _x1 As Double = 0
      Dim G As String

      For i As int32 = 0 To P.BranchCount - 1

        Dim _pts As List(Of Point3d) = P.Branch(i)
        Dim _vts As List(Of Vector3d) = V.Branch(i)
        Dim _x1s As List(Of Double) = E1.Branch(i)

        _code.Add(vbcrlf & ";----------- Main section ----------")
        _code.Add("PTP HOME")

        For j As int32 = 0 To _pts.Count - 1

          _pt = _pts.item(j)
          _abc = _vts.item(j)
          _x1 = _x1s.item(j)

          '############ Mit Externer Achse ############
          G = "{E6POS: X " & CStr(Math.Round(_pt.X, _r)) & ", Y " & CStr(Math.Round(_pt.Y, _r)) & ", Z " & CStr(Math.Round(_pt.Z, _r)) _
            & ", A " & CStr(Math.Round(_abc.X, _r)) & ", B " & CStr(Math.Round(_abc.Y, _r)) & ", C " & CStr(Math.Round(_abc.Z, _r)) _
            & ", E1 " & CStr(Math.Round(_x1, _r) & ", E2 0.0, E3 0.0, E4 0.0, E5 0.0, E6 0.0}")

          '############ Ohne Externe Achse ############
          'G = "X " & CStr(Math.Round(_pt.X, _r)) & ", Y " & CStr(Math.Round(_pt.Y, _r)) & ", Z " & CStr(Math.Round(_pt.Z, _r)) _
          ' & ", A " & CStr(Math.Round(_abc.X, _r)) & ", B " & CStr(Math.Round(_abc.Y, _r)) & ", C " & CStr(Math.Round(_abc.Z, _r))

          If j = 0 Then
            _code.add("PTP " & G)
          Else
            _code.add("LIN " & G & " C_VEL")
          End If

        Next

      Next

    End Sub

    Public Sub Footer()
      _code.Add("PTP HOME")
      _code.Add("END")
    End Sub

    '##### PROPERTIES #####

    Public ReadOnly Property Code As List(Of String)
      Get
        Return _code
      End Get
    End Property


  End Class
# ---------- end krl_exax ----------
status = Panel(krl_exax.out)
krl_code = Panel(krl_exax.A)

# ----
# EXAX SIMULATION
panel_3 = Panel("-400 to 400")
pln_17 = Plane(pln_6)
pln_18 = Plane(pln)
box = DomainBox(Base=pln_18, X=panel_3, Y="-600 to 600", Z="0 to 50")
pline_3 = PolyLine(Vertices=flatten(pln_17), Closed=False)
mbox = MeshBox(Base=box, XCount=10, YCount=10, ZCount=10)
rotate_2 = Rotate(Geometry=mbox, Angle=vb_3.C, Plane=pln_18)  # -> Geometry, Transform
rotate_3 = Rotate(Geometry=pline_3, Angle=vb_3.C, Plane=pln_18)  # -> Geometry, Transform
preview_3 = CustomPreview(Geometry=rotate_2.Geometry, Shader=ColourSwatch(SwatchColor=RGB(178, 178, 178)))

# ----
# IK SIMULATION
ee = PredefinedSpindleEndEffector()
pln_19 = Plane(vb_3.A)
kuka_kr_125_2 = PredefinedKUKAKR1252(RobRootFrame=PlaneXY(0, 0, 0), EndEffectorOptional=ee)
robot_ik = RobotInverseKinematics(Robot=kuka_kr_125_2, TargetTCPFrame=pln_19, AxisToggles=[False, False, False], useColorPreview=True)  # -> PoseGeometry, AxisValues, AxisFrames

preview_4 = CustomPreview(Geometry=rotate_3.Geometry, Material=ColourSwatch(SwatchColor=RGB(0, 255, 238)))

# ==== cluster KRLSettings: Contains a Grasshopper components that allows the definition of KRL settings
name = ClusterInput()
home = ClusterInput()
velcp = ClusterInput()
velptp = ClusterInput()
tool = ClusterInput()
base = ClusterInput()
rpm = ClusterInput()
vb = VBScript(Name=name, Home=home, VelCP=velcp, VelPTP=velptp, Tool=tool, Base=base, RPM=rpm)  # -> out, A
# ---------- vb: VB ----------
    'Code written by Tobias Schwinn
    'Code copyrighted by ICD, University of Stuttgart
    'Code version Monday, 05 May 2014

    Dim _settings As RobotSettings = New RobotSettings()

    _settings.Name = Name
    _settings.Home = Home
    _settings.VelCP = VelCP
    _settings.VelPTP = VelPTP
    _settings.Tool = Tool
    _settings.Base = Base
    _settings.RPM = RPM

    A = _settings
# ---------- vb: VB additional code ----------
  Private Class RobotSettings

    Private _name As String
    Private _home As String
    Private _velcp As String
    Private _velptp As String
    Private _tool As String
    Private _base As String
    Private _rpm As Int32

    Public Sub New()

    End Sub

    '##### PROPERTIES #####

    Public Property Name As String
      Get
        Return _name
      End Get
      Set (ByVal value As String)
        _name = value
      End Set
    End Property

    Public Property Home As String
      Get
        Return _home
      End Get
      Set (ByVal value As String)
        _home = value
      End Set
    End Property

    Public Property VelCP As Double
      Get
        Return _velcp
      End Get
      Set (ByVal value As Double)
        _velcp = value
      End Set
    End Property

    Public Property VelPTP As Double
      Get
        Return _velptp
      End Get
      Set (ByVal value As Double)
        _velptp = value
      End Set
    End Property

    Public Property Tool As Int32
      Get
        Return _tool
      End Get
      Set (ByVal value As Int32)
        _tool = value
      End Set
    End Property

    Public  Property Base As Int32
      Get
        Return _base
      End Get
      Set (ByVal value As Int32)
        _base = value
      End Set
    End Property
    
    Public Property RPM As Int32
      Get
        Return _rpm
      End Get
      Set (ByVal value As Int32)
        _rpm = value
      End Set
    End Property

    '    oList.Add("$ACC_EXTAX[1] = 50" & " ;Accelleration external axis (Percent)")
    '    oList.Add("$ACT_TOOL = " & Tool)
    '    oList.Add("$ACT_BASE = " & Base)

  End Class
# ---------- end vb ----------
A = ClusterOutput(vb.A)
