# Grasshopper definition CDDF_Winding_Setup_Wangen.gh (Grasshopper 1.0.7)
# plug-ins: Virtual Robot

# ---- group: Polylines following winding order
_1_upper_corner_right = Curve(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)
_2_diagonal_1 = Curve(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)
_3_lower_corner_left = Curve(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)
_4_upper_corner_left = Curve(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)
_5_diagonal_2 = Curve(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)
_6_lower_corner_right = Curve(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)

# ---- group: Anchors
lower_points = Point([Point(7060.69419, -9602.190009, 424.7181637), Point(6993.716546, -9602.117322, 404.371424), Point(6926.738901, -9602.044635, 384.0246843), Point(6859.761256, -9601.971948, 363.6779446), Point(6792.783611, -9601.899262, 343.3312049), Point(6725.805967, -9601.826575, 322.9844652), Point(6658.828322, -9601.753888, 302.6377255), Point(6591.850677, -9601.681201, 282.2909857), Point(6524.873032, -9601.608514, 261.944246), Point(6457.895387, -9601.535827, 241.5975063), Point(6390.917743, -9601.46314, 221.2507666), Point(6323.940098, -9601.390453, 200.9040269), Point(6256.962453, -9601.317766, 180.5572872), Point(6189.984808, -9601.245079, 160.2105475), Point(6123.007164, -9601.172392, 139.8638078)])
right_points = Point([Point(7162.48236, -9533.651006, 438.5541374), Point(7162.48236, -9464.800845, 425.9186587), Point(7162.48236, -9395.950684, 413.28318), Point(7162.48236, -9327.100523, 400.6477013), Point(7162.48236, -9258.250362, 388.0122226), Point(7162.48236, -9189.400201, 375.3767438)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])
upper_points = Point([Point(6116.217327, -7657.121896, 424.7181637), Point(6183.195011, -7657.121896, 404.371424), Point(6250.172695, -7657.121896, 384.0246843), Point(6317.150379, -7657.121896, 363.6779446), Point(6384.128064, -7657.121896, 343.3312049), Point(6451.105748, -7657.121896, 322.9844652), Point(6518.083432, -7657.121896, 302.6377255), Point(6585.061116, -7657.121896, 282.2909857), Point(6652.038801, -7657.121896, 261.944246), Point(6719.016485, -7657.121896, 241.5975063), Point(6785.994169, -7657.121896, 221.2507666), Point(6852.971853, -7657.121896, 200.9040269), Point(6919.949537, -7657.121896, 180.5572872), Point(6986.927222, -7657.121896, 160.2105475), Point(7053.904906, -7657.121896, 139.8638078)])
left_points = Point([Point(6014.48236, -7724.761746, 438.7101415), Point(6014.48236, -7793.611907, 426.0746628), Point(6014.48236, -7862.462068, 413.4391841), Point(6014.48236, -7931.312229, 400.8037054), Point(6014.48236, -8000.16239, 388.1682267), Point(6014.48236, -8069.012551, 375.5327479)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])

# ----
entwine = Entwine(Branch00=lower_points, Branch01=upper_points, Branch02=left_points, Branch03=right_points, FlattenInputs=True)
c_getsyntaxlist = CSharpScript(anchorPts=simplify(entwine), syntax=_1_upper_corner_right)  # -> out, syntaxList; inputs anchorPts: tree of Point3d, syntax: Polyline
# ---------- c_getsyntaxlist: C# ----------
    //assign unique ID to each anchor point
    anchors = new List<Anchor>();

    for(int i = 0; i < anchorPts.BranchCount; i++)
    {
      for(int j = 0; j < anchorPts.Branch(i).Count; j++)
      {
        Anchor anchor = new Anchor();
        anchor.Position = anchorPts.Branch(i)[j];
        anchor.ID = j + Number2Alphabet(i, true);

        anchors.Add(anchor);
      }
    }

    // check whether polyline pts are identical with the anchors, if so output anchor ID in list
    List<string> syntaxAnchorIDs = GetAnchorIDs(syntax);

    syntaxList = syntaxAnchorIDs;
# ---------- c_getsyntaxlist: C# additional code ----------
  List<Anchor> anchors = new List<Anchor>();

  public class Anchor
  {
    public Point3d Position;
    public string ID;
  }

  public List<string> GetAnchorIDs(Polyline syntax)
  {
    List<string> syntaxAnchorIDs = new List<string>();

    for(int i = 0; i < syntax.Count; i++)
    {
      for (int j = 0; j < anchors.Count; j++)
      {
        if (anchors[j].Position == syntax[i])
        {
          syntaxAnchorIDs.Add(anchors[j].ID);
        }
      }
    }

    return syntaxAnchorIDs;
  }

  public static string Number2Alphabet(int number, bool isCaps)
  {
    Char c = (Char) ((isCaps ? 65 : 97) + number);

    return c.ToString();
  }
# ---------- end c_getsyntaxlist ----------

travel_offset = Slider(120, range=-50..200)
hooking_radius = Slider(30, range=0..100)
xy = XYPlane(Origin=Point(0, 0, 0))

panel = Panel(c_getsyntaxlist.syntaxList)

# ----
# PATH PLANNING
c_travel = CSharpScript(anchorPts=simplify(entwine), syntax=c_getsyntaxlist.syntaxList, travelOffset=travel_offset, orientation=xy)  # -> out, travelPlns, syntaxPts, anchorPlns; inputs anchorPts: tree of Point3d, syntax: list of String, travelOffset: Double, orientation: Plane
# ---------- c_travel: C# usings ----------
using System.Linq;
# ---------- c_travel: C# ----------
    // create Planes & Polyline
    List<Point3d> polyPoints = new List<Point3d>();
    List<Plane> anchorPlanes = new List<Plane>();

    for (int i = 0; i < syntax.Count - 1; i++)
    {
      // get both endpoints of segment
      string segStart = syntax[i];
      string segEnd = syntax[i + 1];

      //split string & cast to number
      var digitsStart = segStart.Where(c => Char.IsDigit(c));
      var digitsEnd = segEnd.Where(c => Char.IsDigit(c));

      // Execute the second query
      string digitStart = "";
      foreach (char c in digitsStart)
        digitStart += c;
      int indStart = int.Parse(digitStart);

      string digitEnd = "";
      foreach (char c in digitsEnd)
        digitEnd += c;
      int indEnd = int.Parse(digitEnd);

      //get points
      Point3d startPl = new Point3d();
      Point3d endPl = new Point3d();

      for(int j = 0; j < anchorPts.BranchCount; j++)
      {
        if(segStart.Contains(Number2Alphabet(j, true)))
        {
          startPl = anchorPts.Branch(j)[indStart];
        }
        if(segEnd.Contains(Number2Alphabet(j, true)))
        {
          endPl = anchorPts.Branch(j)[indEnd];
        }
      }

      polyPoints.Add(startPl);
      if (i == syntax.Count - 2)
        polyPoints.Add(endPl);
    }

    Surface s = null;

    if(anchorPts.BranchCount == 2)
    {
      // create expected surface
      List<Curve> edgeCurves = new List<Curve>();


      Curve a = Curve.CreateInterpolatedCurve(anchorPts.Branch(0), 3);
      edgeCurves.Add(a);
      Curve b = Curve.CreateInterpolatedCurve(anchorPts.Branch(1), 3);
      edgeCurves.Add(b);

      Brep brep = Brep.CreateFromLoft(edgeCurves, Point3d.Unset, Point3d.Unset, LoftType.Tight, false)[0];
      s = brep.Faces[0];
    }

    DataTree<Plane> windingPlanes = new DataTree<Plane>();


    for (int i = 0; i < syntax.Count - 1; i++)
    {
      Vector3d vec = polyPoints[i] - polyPoints[i + 1];
      LineCurve ln = new LineCurve(polyPoints[i], polyPoints[i + 1]);

      if(anchorPts.BranchCount == 2)
      {
        double u;
        double v;
        double u1;
        double v1;

        s.ClosestPoint(polyPoints[i], out u, out v);
        s.ClosestPoint(polyPoints[i + 1], out u1, out v1);
        Plane anchorPln = new Plane(polyPoints[i], s.NormalAt(u, v));

        anchorPlanes.Add(anchorPln);

        double[] crvParams = ln.DivideByCount(4, false);
        windingPlanes.Add(new Plane(ln.PointAt(crvParams[0]) + s.NormalAt(u, v) * -travelOffset, Plane.WorldXY.ZAxis, Vector3d.CrossProduct(Plane.WorldXY.ZAxis, s.NormalAt(u, v))), new GH_Path(i));
        windingPlanes.Add(new Plane(ln.PointAt(crvParams[2]) + s.NormalAt(u1, v1) * -travelOffset, Plane.WorldXY.ZAxis, Vector3d.CrossProduct(Plane.WorldXY.ZAxis, s.NormalAt(u1, v1))), new GH_Path(i));
      }
      else
      {
        Plane anchorPln = new Plane(polyPoints[i], Plane.WorldXY.ZAxis);

        anchorPlanes.Add(anchorPln);

        double[] crvParams = ln.DivideByCount(4, false);
        windingPlanes.Add(new Plane(ln.PointAt(crvParams[0]) + new Vector3d(0.0, 0.0, travelOffset), orientation.Normal), new GH_Path(i));
        windingPlanes.Add(new Plane(ln.PointAt(crvParams[2]) + new Vector3d(0.0, 0.0, travelOffset), orientation.Normal), new GH_Path(i));
      }
    }

    if(anchorPts.BranchCount == 2)
    {
      double u2;
      double v2;
      s.ClosestPoint(polyPoints[syntax.Count - 1], out u2, out v2);

      anchorPlanes.Add(new Plane(polyPoints[syntax.Count - 1], s.NormalAt(u2, v2)));
    }
    else
    {
      anchorPlanes.Add(new Plane(polyPoints[syntax.Count - 1], Plane.WorldXY.ZAxis));
    }

    //outputs
    travelPlns = windingPlanes;
    syntaxPts = polyPoints;
    anchorPlns = anchorPlanes;
# ---------- c_travel: C# additional code ----------
  public static string Number2Alphabet(int number, bool isCaps)
  {
    Char c = (Char) ((isCaps ? 65 : 97) + number);

    return c.ToString();
  }
# ---------- end c_travel ----------
lng = ListLength(List=c_getsyntaxlist.syntaxList)
panel_2 = Panel("X")
dup = DuplicateData(Data="U", Number=lng, Order=True)
c_hooking = CSharpScript(
    syntaxPts=c_travel.syntaxPts,
    hookingTypes=dup,
    anchorPlns=c_travel.anchorPlns,
    hookingRadius=hooking_radius,
    travelPlns=c_travel.travelPlns)  # -> out, hookingPlns; inputs syntaxPts: list of Point3d, hookingTypes: list of String, anchorPlns: list of Plane, hookingRadius: Double, travelPlns: tree of Plane
# ---------- c_hooking: C# ----------
    DataTree<Plane> hookingPlanes = new DataTree<Plane>();

    Print(hookingTypes.Count.ToString());

    for (int i = 0; i < syntaxPts.Count; i++)
    {
      hookingPlanes.AddRange(HookingMotion(syntaxPts[i], hookingTypes[i], anchorPlns[i], travelPlns, hookingRadius, i), new GH_Path(i));
    }

    hookingPlns = hookingPlanes;
# ---------- c_hooking: C# additional code ----------
  public List<Plane> HookingMotion(Point3d origin, string hookingType, Plane anchorPln, DataTree<Plane> travelSegments, double hookingRadius, int id)
  {
    List<Plane> hookingPlanes = new List<Plane>();

    Point3d startPt = Point3d.Unset;
    Point3d endPt = Point3d.Unset;
    Point3d startPtremapped;

    Plane xy = anchorPln;
    Vector3d start = new Vector3d();
    Vector3d end = new Vector3d();
    double angle = 0;;

    if (id == 0)
    {
      endPt = travelSegments.Branch(id)[0].Origin;
      end = xy.Origin - endPt;
      start = new Vector3d(end);
      start.Reverse();
      angle = 2 * Math.PI;
    }

    else if (id > travelSegments.BranchCount - 1)
    {
      startPt = travelSegments.Branch(id - 1)[1].Origin;
      start = xy.Origin - startPt;
      end = new Vector3d(start);
      end.Reverse();
      angle = 2 * Math.PI;
    }

    if (id > 0 && id < travelSegments.BranchCount) {

      startPt = travelSegments.Branch(id - 1)[1].Origin;
      endPt = travelSegments.Branch(id)[0].Origin;

      start = xy.Origin - startPt;
      end = xy.Origin - endPt;
      angle = 2 * Math.PI - Vector3d.VectorAngle(start, end);
    }

    double _s;
    double _t;
    xy.ClosestParameter(startPt, out _s, out _t);
    startPtremapped = xy.PointAt(_s, _t);
    Vector3d xDir = startPtremapped - origin;
    //Vector3d zDir = centerProjected - origin;
    //Vector3d zDir = Plane.WorldXY.ZAxis;
    Vector3d zDir = anchorPln.Normal;
    Vector3d yDir = Vector3d.CrossProduct(xDir, zDir);

    xy = new Plane(origin, xDir, yDir);

    //map endpoint - check y value, needs to be negative
    double sEnd;
    double tEnd;
    xy.ClosestParameter(endPt, out sEnd, out tEnd);

    if (tEnd > 0)
    {
      yDir = -1 * Vector3d.CrossProduct(xDir, zDir);
      xy = new Plane(origin, xDir, yDir);
    }

    int steps = 4;

    double increment = angle / steps;

    for (int i = 0; i < steps; i++)
    {
      // need to set correct starting point! rotate plane!

      double t = increment * i;

      double a = Math.Cos(t) * (hookingRadius);
      double b = Math.Sin(t) * (hookingRadius);

      Point3d pt = new Point3d(a * xy.XAxis + b * xy.YAxis) + origin;

      Point3d centerPj = new Point3d(Plane.WorldXY.Origin.X, Plane.WorldXY.Origin.Y, pt.Z);

      // fix hardcoded vector
      Vector3d x = new Vector3d(0, -1, 0);
      Vector3d z = anchorPln.Normal;
      Vector3d offsetVec = new Vector3d(z);
      offsetVec.Unitize();
      offsetVec *= hookingRadius;
      Vector3d y = Vector3d.CrossProduct(x, z);

      Plane hookingPln = Plane.Unset;
      
      /*if(i == 1 || i == 2)
      {
        hookingPln = new Plane(pt, x, y);
      }
      else
      {
        hookingPln = new Plane(pt + z * 15 , x, y);
      }*/
      
      if(id == 0 && i == 0)
      {
        Plane approachPln = new Plane(pt + z * 120, x, y);
        approachPln.Flip();
        hookingPlanes.Add(approachPln);
      }

      hookingPln = new Plane(pt, x, y);
      hookingPln.Flip();

      hookingPlanes.Add(hookingPln);

      if(id == travelSegments.BranchCount && i == steps - 1)
      {
        Plane approachPln = new Plane(pt + z * 120, x, y);
        approachPln.Flip();
        hookingPlanes.Add(approachPln);
      }
    }

    if(hookingType == "X") hookingPlanes.Reverse();

    return hookingPlanes;
  }
# ---------- end c_hooking ----------
panel_3 = Panel("{1,2,5,6...}")
split = SplitTree(Data=c_hooking.hookingPlns, Masks=flatten("{0,2,...}"))  # -> Positive, Negative
prot = RotatePlane(Plane=c_travel.travelPlns, Angle=degrees(Slider(60, range=-91..180)))
prot_2 = RotatePlane(Plane=split.Positive, Angle=degrees(Slider(-90, range=-90..180)))
prot_3 = RotatePlane(Plane=split.Negative, Angle=degrees(Slider(-130, range=-180..180)))
merge = Merge(Data1=prot_2, Data2=prot_3)
c_fiber_path = CSharpScript(travelPlns=prot, hookingPlns=merge)  # -> out, windingPlns, pathCurve; inputs travelPlns: tree of Plane, hookingPlns: tree of Plane
# ---------- c_fiber_path: C# ----------
    List<Plane> plns = new List<Plane>();

    for (int i = 0; i <= travelPlns.BranchCount; i++)
    {
      if(i < travelPlns.BranchCount)
      {
        plns.AddRange(hookingPlns.Branch(i));
        if(travelPlns.Branch(i)[0].Origin.DistanceTo(travelPlns.Branch(i)[1].Origin) > 150)
        {
          plns.AddRange(travelPlns.Branch(i));
        }
      }
      else if(i == travelPlns.BranchCount)
      {
        plns.AddRange(hookingPlns.Branch(i));
      }
    }

    // construct polyline
    List<Point3d> polyPoints = new List<Point3d>();

    foreach (Plane p in plns)
    {
      polyPoints.Add(p.Origin);
    }

    Polyline pl = new Polyline(polyPoints);

    windingPlns = plns;
    pathCurve = pl;
# ---------- end c_fiber_path ----------

panel_4 = Panel("""-90, -130
180, -80""")
xy_2 = XYPlane(Origin=Point(0, 0, 0))
test_tool = TESTTOOL()  # -> pl_2, G

# ----
# END EFFECTOR
pt = Point(Point(-15487.94509, -3949.973942, -2.96))
pt_2 = Point(Point(-15110.80273, -3940.73584, 739.5223999))
tool_abc = Panel("0,-90,0")
vec2pt = Vector2Pt(PointA=pt, PointB=pt_2, Unitize=False)  # -> Vector, Length
sframe = SetFrame(XYZLocation=vec2pt.Vector, ABCOrientation=tool_abc)
tool_xyz = Panel(vec2pt.Vector)
tcp = PlaneOrigin(Base=sframe, Origin=pt_2)
flange = XYPlane(Origin=pt)
mesh = Mesh(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)
coord_display = CoordinateFrameDisplay(
    CoordinateFrame=tcp,
    ArrowLengths=[120, 120, 120],
    ArrowWidths=[1, 1, 1],
    ArrowColors=[RGB(139, 0, 0), RGB(0, 100, 0), RGB(0, 0, 139)])
end_effector = DefineEndEffector(Geometry=mesh, TCPFrame=tcp, MountingFrame=flange)
ee = PredefinedFibrePlacementEndEffector()
pflip = FlipPlane(Plane=test_tool.pl_2, ReverseX=False, ReverseY=False, SwapAxes=True)

sframe_2 = SetFrame(XYZLocation=tool_xyz, ABCOrientation=tool_abc)

# ---- group: Robot KR210
pt_3 = Point(Point(4944.930434, -8564.921451, 627.04))
xy_3 = XYPlane(Origin=pt_3)

# ----
prot_4 = RotatePlane(Plane=xy_3, Angle=degrees(Slider(90, range=0..180)))
xy_4 = XYPlane(Origin=Point(0, 0, 0))

# ---- group: KRL Generation
write_file = Button()
panel_5 = Panel("C:\Users\Fabian\Desktop\KRL\")

# Enter the part (module) name. This will also be the name of the files. The name must be unique on the KUKA drive and not start with a number. Max. 21 characters allowed.
# KRL GENERATION
velocity_cp_m_s = Slider(0.4, range=0..2)
panel_6 = Panel("""90
-90
60
0
45
0""")
velocity_ptp = Slider(20, range=0..100)
c_script = CSharpScript(
    WindingPlanes=c_fiber_path.windingPlns,
    Name="TestWindingCorner",
    Home=panel_6,
    Vel_CP=velocity_cp_m_s,
    Vel_PTP=velocity_ptp,
    iBase=xy_4,
    Tool=sframe_2,
    robRoot=xy_4,
    Folder=panel_5,
    Write=write_file)  # -> KRL; inputs WindingPlanes: list of Plane, Name: String, Home: list of Double, E1: list of Double, E2: list of Double, Vel_CP: Double, Vel_PTP: Double, iBase: Plane, Tool: Plane, robRoot: Plane, Folder: String, Write: Boolean
# ---------- c_script: C# ----------
    List<string> krlCode = new List<string>();

    krlCode.Add("DEF " + Name + "()");

    krlCode.Add(";------- Declaration section -------");
    krlCode.Add(";FOLD DECL");
    krlCode.Add("DECL E6AXIS HOME");
    krlCode.Add(";ENDFOLD");
    krlCode.Add(";------- Initialization ---------");
    krlCode.Add("BAS (#INITMOV,0)");
    krlCode.Add("BAS(#VEL_PTP, " + Vel_PTP + ")");
    krlCode.Add("$VEL.CP = " + Vel_CP);

    if(iBase == Plane.WorldXY)
    {
      krlCode.Add("$BASE = $NULLFRAME");
    }
    else
    {
      double[] baseXYZABC = ComputeXYZABCFromFrame(iBase, robRoot, 3);

      krlCode.Add("$BASE = {POS: X " + baseXYZABC[0] + ", Y " + baseXYZABC[1] + ", Z " + baseXYZABC[2] +
        ", A " + baseXYZABC[3] + ", B " + baseXYZABC[4] + ", C " + baseXYZABC[5] + "}   ;setting of the base coordinate system");
    }

    double[] toolXYZABC = ComputeXYZABCFromFrame(Tool, robRoot, 3);
    krlCode.Add("$TOOL = {POS: X " + toolXYZABC[0] + ", Y " + toolXYZABC[1] + ", Z " + toolXYZABC[2] +
      ", A " + toolXYZABC[3] + ", B " + toolXYZABC[4] + ", C " + toolXYZABC[5] + "}");

    krlCode.Add("HOME = {A1 " + Home[0] + ",A2 " + Home[1] + ",A3 " + Home[2] + ",A4 " + Home[3] + ",A5 " + Home[4] + ",A6 " + Home[5] + ",E1 0, E2 0, E3 0, E4 0, E5 0, E6 0}");

    krlCode.Add(";----------- Main section ----------");
    krlCode.Add("PTP HOME");

    if(E1.Count == 0)
    {
      for(int i = 0; i < WindingPlanes.Count; i++)
      {
        E1.Add(0);
      }
    }

    if(E2.Count == 0)
    {
      for(int i = 0; i < WindingPlanes.Count; i++)
      {
        E2.Add(0);
      }
    }

    for(int i = 0; i < WindingPlanes.Count; i++)
    {
      Plane wp = WindingPlanes[i];
      double[] XYZABC = ComputeXYZABCFromFrame(WindingPlanes[i], robRoot, 3);

      string motion = "LIN {E6POS: X " + XYZABC[0] + ", Y " + XYZABC[1] + ", Z " + XYZABC[2] + ", A " + XYZABC[3] + ", B " + XYZABC[4] + ", C " + XYZABC[5] + ", E1 " + Math.Round(E1[i], 3) + ", E2 " + Math.Round(E2[i], 3) + ", E3 0.0, E4 0.0, E5 0.0, E6 0.0}" + " C_VEL";

      krlCode.Add(motion);
    }

    krlCode.Add("END");

    if(Write)
    {
      System.IO.Directory.CreateDirectory(Folder);
      string pathString = System.IO.Path.Combine(Folder, Name);

      System.IO.File.WriteAllText(pathString + ".src", String.Join("\n", krlCode));
    }

    KRL = krlCode;
# ---------- c_script: C# additional code ----------
  public static double[] ComputeXYZABCFromFrame(Plane frame, Plane referenceFrame, int roundingDigitCount)
  {
    const double toDegree = 180.0 / Math.PI;
    Transform temp = Transform.PlaneToPlane(referenceFrame, frame);

    double c = toDegree * Math.Atan2(temp.M21, temp.M22);
    double b = toDegree * -Math.Atan2(temp.M20, Math.Sqrt(Math.Pow(temp.M21, 2) + Math.Pow(temp.M22, 2)));
    double a = toDegree * Math.Atan2(temp.M10, temp.M00);

    return new[] {
        Math.Round(frame.Origin.X, roundingDigitCount),
        Math.Round(frame.Origin.Y, roundingDigitCount),
        Math.Round(frame.Origin.Z, roundingDigitCount),
        Math.Round(a, roundingDigitCount),
        Math.Round(b, roundingDigitCount),
        Math.Round(c, roundingDigitCount)
        };
  }
# ---------- end c_script ----------

# ----
panel_7 = Panel(c_script)

# ---- group: End-Effector 210
pt_4 = Point(<point referenced from the Rhino model>)
xy_5 = XYPlane(Origin=pt_4)
pt_5 = Point(<point referenced from the Rhino model>)
deplane = DeconstructPlane(Plane=xy_5)  # -> Origin, XAxis, YAxis, ZAxis
xy_6 = XYPlane(Origin=pt_5)
mesh_2 = Mesh(<mesh referenced from the Rhino model>)
data = Data(mesh_2)

# ----
neg = Negative(Value=deplane.YAxis)

# ---- group: End-Effector 210 (continued)
rot3d = Rotate3D(Geometry=xy_5, Angle=degrees(Slider(120, range=0..180)), Center=xy_5, Axis=neg)  # -> Geometry, Transform

end_effector_2 = DefineEndEffector(Geometry=data, TCPFrame=rot3d.Geometry, MountingFrame=xy_6)

# ---- group: Robot KR210 / HOME POSITION
kuka_kr_210 = PredefinedKUKAKR210Robot(RobRootFrame=prot_4, EndEffectorOptional=end_effector_2, variant="R3100")
home_position = Panel("""90
-90
60
0
45
0""")
robot_fk = RobotForwardKinematics(Robot=kuka_kr_210, AxisValues=home_position, useColorPreview=True)  # -> PoseGeometry, TCPFrame

# ----
# ROBOT SIMULATION
robot_path = Slider(0.721, range=0..0.999)
kuka_kr_125_2 = PredefinedKUKAKR1252(RobRootFrame=PlaneXY(0, 0, 0), EndEffectorOptional=end_effector)
interpolate_frames = InterpolateFrames(Frames=c_fiber_path.windingPlns, Length=robot_path, Step="20", Reset=Toggle(True))  # -> Frame, Percent, CurrentIndex
robot_ik = RobotInverseKinematics(Robot=kuka_kr_210, TargetTCPFrame=interpolate_frames.Frame, AxisToggles=[False, False, False], useColorPreview=True)  # -> PoseGeometry, AxisValues

# ==== cluster TESTTOOL
number_slider = Slider(94.9, range=0..100)
orientation_marker = Mesh(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)

# ---- group: EFFECTOR GEOMETRY
mesh = Mesh(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)

# ----
xy = XYPlane(Origin=Point(0, 0, 0))
mjoin = MeshJoin(Meshes=[mesh, orientation_marker])
Z = UnitZ(Factor=number_slider)
move = Move(Geometry=mjoin, Motion=Z)  # -> Geometry, Transform
rad = Radians(Degrees=Slider(90, range=0..100))
scale_nu = ScaleNU(Geometry=mjoin, Plane=xy, ScaleX=Slider(1.001, range=0..10), ScaleY=1, ScaleZ=Slider(1.183, range=0..10))  # -> Geometry, Transform
Z_2 = UnitZ(Factor=1)

# ---- group: Initial TCP
panel = Panel("429.095")

# ----
addition = Addition(A=panel, B=number_slider)

# ---- group: Initial TCP (continued)
pt = ConstructPoint(XCoordinate="-256.637", YCoordinate="7.902", ZCoordinate=addition)

# ----
vec2pt = Vector2Pt(PointA=xy, PointB=pt, Unitize=False)  # -> Vector, Length
devec = DeconstructVector(Vector=vec2pt.Vector)  # -> XComponent, YComponent, ZComponent
vec = VectorXYZ(XComponent=devec.XComponent, YComponent=devec.YComponent, ZComponent=0)  # -> Vector, Length
vdis = VectorDisplay(Anchor=xy, Vector=vec.Vector)

# ---- group: target TCP
panel_2 = Panel("411.575")

# ----
addition_2 = Addition(A=panel_2, B=number_slider)

# ---- group: target TCP (continued)
pt_2 = ConstructPoint(XCoordinate="241.802", YCoordinate="-21.579", ZCoordinate=addition_2)

# ----
vec2pt_2 = Vector2Pt(PointA=xy, PointB=pt_2, Unitize=False)  # -> Vector, Length
devec_2 = DeconstructVector(Vector=vec2pt_2.Vector)  # -> XComponent, YComponent, ZComponent
vec_2 = VectorXYZ(XComponent=devec_2.XComponent, YComponent=devec_2.YComponent, ZComponent=0)  # -> Vector, Length
angle = Angle(VectorA=vec.Vector, VectorB=vec_2.Vector)  # -> Angle, Reflex
rotate = Rotate(Geometry=vec_2.Vector, Angle=rad, Plane=xy)  # -> Geometry, Transform
rotate_2 = Rotate(Geometry=scale_nu.Geometry, Angle=angle.Angle, Plane=xy)  # -> Geometry, Transform
pl = ConstructPlane(Origin=pt_2, XAxis=rotate.Geometry, YAxis=Z_2)
gframe = GetFrame(Frame=pl)  # -> XYZLocation, ABCOrientation; disabled
pl_2 = ClusterOutput(pl)
G = ClusterOutput(rotate_2.Geometry)

# ---- group: VALUES TO BE INPUT A;B;C
panel_3 = Panel(gframe.ABCOrientation)

# ---- group: VALUES TO BE INPUT X;Y;Z
panel_4 = Panel(gframe.XYZLocation)

# ---- group: X
vdis_2 = VectorDisplay(Anchor=pt_2, Vector=rotate.Geometry)

# ---- group: Z
vdis_3 = VectorDisplay(Anchor=pt_2, Vector=vec_2.Vector)

# ---- group: Y
vdis_4 = VectorDisplay(Anchor=pt_2, Vector=Z_2)
