# Grasshopper definition miling_final.gh (Grasshopper 1.0.7)
# plug-ins: Kangaroo Components, Kangaroo2 Components, Sandbox, VirtualRobot.Grasshopper

# ---- group: kangaroo
# Kangaroo
number_slider = Slider(600, range=0..600)
polygon = Polygon(Plane=PlaneXY(0, 0, 0), Radius=number_slider, Segments=Slider(3, range=0..10), FilletRadius=0)  # -> Polygon, Length
Z = UnitZ(Factor=Slider(660, range=0..1000))
move = Move(Geometry=polygon.Polygon, Motion=Z)  # -> Geometry, Transform
cp = ControlPoints(Curve=polygon.Polygon)  # -> Points, Weights, Knots
cp_2 = ControlPoints(Curve=move.Geometry)  # -> Points, Weights, Knots
duppt = RemoveDuplicatePts(Points=cp_2.Points, Tolerance=0.01)
duppt_2 = RemoveDuplicatePts(Points=cp.Points, Tolerance=0.01)
shift = ShiftList(List=duppt, Shift=1, Wrap=True)
explode = Explode(Curve=move.Geometry, Recursive=True)  # -> Segments, Vertices
explode_2 = Explode(Curve=polygon.Polygon, Recursive=True)  # -> Segments, Vertices
ln = Line(StartPoint=duppt_2, EndPoint=duppt)
ln_2 = Line(StartPoint=duppt_2, EndPoint=shift)
merge = Merge(Data1=ln, Data2=explode_2.Segments, Data3=explode.Segments)  # -> flatten(Result)
merge_2 = Merge(Data1=flatten(polygon.Polygon), Data2=flatten(move.Geometry), Data3=flatten(ln), Data4=flatten(ln_2))
len = Length(Curve=merge)
multiplication = Multiplication(A=len, B=Slider(0.582, range=0..1))
length_line = LengthLine(Line=merge, Length=multiplication, Strength=10)
length_line_2 = LengthLine(Line=ln_2, Length=ln_2, Strength=Slider(1000, range=0..1000))
show = Show(G=merge_2)
merge_3 = Merge(Data1=flatten(show), Data2=flatten(length_line_2), Data3=flatten(length_line))
solver = Solver(
    GoalObjects=merge_3,
    Reset=Button(),
    Restart=False,
    Parallel=True,
    Threshold=1e-15,
    Tolerance=0.01,
    AddCurrent=False,
    On=Toggle(True))  # -> V, O
lng = ListLength(List=merge_2)  # -> expr("x-1", Length)
subset = SubList(List=solver.O, Domain=lng, Wrap=True)  # -> List, Index
split = SplitList(List=subset.List, Index=Slider(5, range=0..10))  # -> ListA, ListB
pipe = Pipe(Curve=split.ListB, Radius=Slider(0.046, range=0..1), Caps=0)
preview = CustomPreview(Geometry=pipe, Shader=ColourSwatch(SwatchColor=RGB(255, 56, 56)))
preview_2 = CustomPreview(Geometry=split.ListA, Shader=ColourSwatch(SwatchColor=RGB(0, 0, 0)))

# ---- group: Parameters
anchors_count = Slider(30, range=0..1000)

# ---- group: Bar_lines
item = ListItem(List=split.ListB, Index=0, Wrap=True)
item_2 = ListItem(List=split.ListB, Index=1, Wrap=True)
item_3 = ListItem(List=split.ListB, Index=2, Wrap=True)

# ---- group: Input Curves
# Gradient
curve = Curve(item)
# - Defines a gradient for the selection of
# anchors from an initial list.
# - Min % value defines how sparse the
# center is.
# - Number of sections defines in how many
#  percentage groups are you spliting your
# gradient.
# - The shift moves the gradient along the
# curve.
curve_2 = Curve(item_2)

curve_3 = Curve(item)
curve_4 = Curve(item_3)

curve_5 = Curve(item_2)
curve_6 = Curve(item_3)

# ----
list_item = ListItem(List=split.ListA, Index=0, Wrap=True)  # -> Item, Item1, Item2, Item3, Item4
curve_7 = Curve(list_item.Item2)
curve_8 = Curve(list_item.Item3)
curve_9 = Curve(list_item.Item4)
# Get planes for orientation
curve_10 = Curve(list_item.Item)
explode_3 = Explode(Curve=curve_10, Recursive=True)  # -> Segments, Vertices
end_points = EndPoints(Curve=curve_7)  # -> Start, End
end_points_2 = EndPoints(Curve=curve_8)  # -> Start, End
end_points_3 = EndPoints(Curve=curve_9)  # -> Start, End
list_item_2 = ListItem(List=explode_3.Vertices, Index=0, Wrap=True)  # -> Item, Item1, Item2
point = Point(list_item_2.Item1)
point_2 = Point(list_item_2.Item2)
point_3 = Point(list_item_2.Item)

plane_3pt = Plane3Pt(PointA=end_points.Start, PointB=end_points.End, PointC=point)

plane_3pt_2 = Plane3Pt(PointA=end_points_3.Start, PointB=end_points_3.End, PointC=point_3)

plane_3pt_3 = Plane3Pt(PointA=end_points_2.Start, PointB=end_points_2.End, PointC=point_2)

# ----
# place bars
xy_plane = XYPlane(Origin=Point(0, 0, 0))
deconstruct_plane = DeconstructPlane(Plane=xy_plane)  # -> Origin, XAxis, YAxis, ZAxis
amplitude = Amplitude(Vector=deconstruct_plane.YAxis, Amplitude=Slider(-1, range=-12..0))
construct_plane = ConstructPlane(Origin=Point(0, 0, 0), XAxis=amplitude, YAxis=deconstruct_plane.XAxis)

brep = Brep(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)
number_slider_2 = Slider(100, range=0..100)
Z_2 = UnitZ(Factor=number_slider_2)
Y = UnitY(Factor=number_slider_2)
Z_3 = UnitZ(Factor=Slider(-170, range=-200..0))

tool_no = Panel("1")
spindle_speed_rpm = Panel("12000")
feed_mm_min = Panel("4000")
nc_settings = NCSettings(Tool=tool_no, Speed=spindle_speed_rpm, Feed=feed_mm_min)

tool_no_2 = Panel("1")
spindle_speed_rpm_2 = Panel("12000")
feed_mm_min_2 = Panel("4000")
nc_settings_2 = NCSettings(Tool=tool_no_2, Speed=spindle_speed_rpm_2, Feed=feed_mm_min_2)

shift_list_to_move_along_curve = Slider(3, range=0..40)
min_value = Slider(0.4, range=0..1)
number_of_sections_defines_the_gradient = Slider(34, range=0..40)  # "Number of Sections (defines the gradient resolution)"
divide_curve = DivideCurve(Curve=curve, Count=anchors_count, Kinks=False)  # -> simplify(Points), Tangents, Parameters
divide_curve_2 = DivideCurve(Curve=curve_2, Count=anchors_count, Kinks=False)  # -> simplify(Points), Tangents, Parameters

# ---- group: Creates the secList
construct_domain = ConstructDomain(DomainStart=1, DomainEnd=min_value)
range = Range(Domain=construct_domain, Steps=number_of_sections_defines_the_gradient)
reverse_list = ReverseList(List=range)
cull_index = CullIndex(List=reverse_list, Indices=0, Wrap=True)
merge_4 = Merge(Data1=range, Data2=cull_index)  # -> flatten(Result)
shift_list = ShiftList(List=merge_4, Shift=shift_list_to_move_along_curve, Wrap=True)

# ----
divide_curve_3 = DivideCurve(Curve=curve_3, Count=anchors_count, Kinks=False)  # -> simplify(Points), Tangents, Parameters
divide_curve_4 = DivideCurve(Curve=curve_4, Count=anchors_count, Kinks=False)  # -> simplify(Points), Tangents, Parameters
c__gradientanchorselection = CSharpScript(initPointsA=divide_curve_3.Points, initPointsB=divide_curve_4.Points, secList=shift_list)  # -> out, oSelectedIndicesA, oSelectedPointsA, oSelectedIndicesB, oSelectedPointsB; inputs initPointsA: list of Point3d, initPointsB: list of Point3d, secList: list of Double
# ---------- c__gradientanchorselection: C# usings ----------
using System.IO;
using System.Text.RegularExpressions;
using System.Linq;
# ---------- c__gradientanchorselection: C# ----------
    //___________ This script selects two lists of points based on a gradient list defined by the user_________
    //___________ re_duque_11/04/22___________________________________________________________________________


    double numPoints = initPointsA.Count(); //total number of points in initPoints
    double numSection = secList.Count(); // total number of sections (gradient resolution)
    List<int> SelectedPointsIndicesA = new List<int>();
    List<Point3d> SelectedPointsA = new List<Point3d>();
    List<int> SelectedPointsIndicesB = new List<int>();
    List<Point3d> SelectedPointsB = new List<Point3d>();
    int i = 0;

    Print("numSection=" + numSection.ToString());

    while (i < numPoints) // go through the list until reaches its end without defining the step size
    {

      Print("i=" + i.ToString());

      // add the i to the list
      SelectedPointsA.Add(initPointsA[i]); //adds current Point in A
      SelectedPointsIndicesA.Add(i); // adds current index in A
      SelectedPointsB.Add(initPointsB[i]); //adds current Point in B
      SelectedPointsIndicesB.Add(i); // adds current index in B

      // which section are we in? Remap the indexes to their respective sections
      int mySection = (int) Math.Floor(i / numPoints * numSection); // i/numPoints gives the relative position of the index in the list. (Math.Floor rounds down the number)

      Print("mySection=" + mySection.ToString());

      //what is the section density? calculate the skip factor: Density/1
      int skip = (int) Math.Round(1 / secList[mySection]); // secList[mySection] gives the skip value based on the list you defined with the densitity ratios

      // gets i value

      i = i + skip;


    }


    oSelectedPointsA = SelectedPointsA;
    oSelectedIndicesA = SelectedPointsIndicesA;

    oSelectedPointsB = SelectedPointsB;
    oSelectedIndicesB = SelectedPointsIndicesB;
# ---------- end c__gradientanchorselection ----------

divide_curve_5 = DivideCurve(Curve=curve_5, Count=anchors_count, Kinks=False)  # -> simplify(Points), Tangents, Parameters
divide_curve_6 = DivideCurve(Curve=curve_6, Count=anchors_count, Kinks=False)  # -> simplify(Points), Tangents, Parameters
c__gradientanchorselection_2 = CSharpScript(initPointsA=divide_curve_5.Points, initPointsB=divide_curve_6.Points, secList=shift_list)  # -> out, oSelectedIndicesA, oSelectedPointsA, oSelectedIndicesB, oSelectedPointsB; inputs initPointsA: list of Point3d, initPointsB: list of Point3d, secList: list of Double; same code as c__gradientanchorselection

c__gradientanchorselection_3 = CSharpScript(initPointsA=divide_curve.Points, initPointsB=divide_curve_2.Points, secList=shift_list)  # -> out, oSelectedIndicesA, oSelectedPointsA, oSelectedIndicesB, oSelectedPointsB; inputs initPointsA: list of Point3d, initPointsB: list of Point3d, secList: list of Double; same code as c__gradientanchorselection

pt = Point(c__gradientanchorselection_3.oSelectedPointsA)
crv = Curve(item)

pt_2 = Point(c__gradientanchorselection.oSelectedPointsB)
crv_2 = Curve(item_3)

pt_3 = Point(c__gradientanchorselection_2.oSelectedPointsA)
curve_11 = Curve(item_2)

pln = Plane(plane_3pt)
pt_4 = Point(pt)
curve_12 = Curve(crv)

pln_2 = Plane(plane_3pt_3)
curve_13 = Curve(curve_11)
pt_5 = Point(pt_3)

pln_3 = Plane(plane_3pt_2)
curve_14 = Curve(crv_2)
pt_6 = Point(pt_2)

len_2 = Length(Curve=curve)
# generate bar shape
pt_7 = Point(Point(0, 0, 0))
pt_8 = ConstructPoint(XCoordinate=len_2, YCoordinate=0, ZCoordinate=0)
ln_3 = Line(StartPoint=pt_7, EndPoint=pt_8)

# ---- group: Input Curves
curve_15 = Curve(ln_3)
curve_16 = Curve(item_2)

# ----
divide_curve_7 = DivideCurve(Curve=curve_15, Count=anchors_count, Kinks=False)  # -> simplify(Points), Tangents, Parameters
divide_curve_8 = DivideCurve(Curve=curve_16, Count=anchors_count, Kinks=False)  # -> simplify(Points), Tangents, Parameters
c__gradientanchorselection_4 = CSharpScript(initPointsA=divide_curve_7.Points, initPointsB=divide_curve_8.Points, secList=shift_list)  # -> out, oSelectedIndicesA, oSelectedPointsA, oSelectedIndicesB, oSelectedPointsB; inputs initPointsA: list of Point3d, initPointsB: list of Point3d, secList: list of Double; same code as c__gradientanchorselection

# ---- group: division_points
pt_9 = Point(c__gradientanchorselection_4.oSelectedPointsA)

# ----
origin_pt = Point(point_3)

plane_normal = PlaneNormal(Origin=pln, ZAxis=Vector(0, 0, 1))
offset_curve = OffsetCurve(Curve=curve_12, Distance=1, Plane=plane_normal, Corners=1)
extend_curve = ExtendCurve(Curve=offset_curve, Type=0, Start=expr("0.5*X", 1), End=expr("0.5*X", 1))
curve_closest_point = CurveClosestPoint(Point=pt_4, Curve=extend_curve)  # -> Point, Parameter, Distance
line = Line(StartPoint=pt_4, EndPoint=curve_closest_point.Point)
list_item_3 = ListItem(List=line, Index=0, Wrap=True)
extrude_along = ExtrudeAlong(Base=curve_12, Curve=list_item_3)
deconstruct_plane_2 = DeconstructPlane(Plane=extrude_along)  # -> Origin, XAxis, YAxis, ZAxis
amplitude_2 = Amplitude(Vector=deconstruct_plane_2.YAxis, Amplitude=Slider(-1, range=-12..0))
construct_plane_2 = ConstructPlane(Origin=origin_pt, XAxis=deconstruct_plane_2.XAxis, YAxis=amplitude_2)

pln_4 = Plane(construct_plane_2)

origin_pt_2 = Point(point)

plane_normal_2 = PlaneNormal(Origin=pln_2, ZAxis=Vector(0, 0, 1))
offset_curve_2 = OffsetCurve(Curve=curve_13, Distance=1, Plane=plane_normal_2, Corners=1)
extend_curve_2 = ExtendCurve(Curve=offset_curve_2, Type=0, Start=expr("0.5*X", 1), End=expr("0.5*X", 1))
curve_closest_point_2 = CurveClosestPoint(Point=pt_5, Curve=extend_curve_2)  # -> Point, Parameter, Distance
line_2 = Line(StartPoint=pt_5, EndPoint=curve_closest_point_2.Point)
list_item_4 = ListItem(List=line_2, Index=0, Wrap=True)
extrude_along_2 = ExtrudeAlong(Base=curve_13, Curve=list_item_4)
deconstruct_plane_3 = DeconstructPlane(Plane=extrude_along_2)  # -> Origin, XAxis, YAxis, ZAxis
amplitude_3 = Amplitude(Vector=deconstruct_plane_3.XAxis, Amplitude=Slider(-1, range=-12..0))
construct_plane_3 = ConstructPlane(Origin=origin_pt_2, XAxis=amplitude_3, YAxis=deconstruct_plane_3.YAxis)

pln_5 = Plane(construct_plane_3)

origin_pt_3 = Point(point_2)

plane_normal_3 = PlaneNormal(Origin=pln_3, ZAxis=Vector(0, 0, 1))
offset_curve_3 = OffsetCurve(Curve=curve_14, Distance=1, Plane=plane_normal_3, Corners=1)
extend_curve_3 = ExtendCurve(Curve=offset_curve_3, Type=0, Start=expr("0.5*X", 1), End=expr("0.5*X", 1))
curve_closest_point_3 = CurveClosestPoint(Point=pt_6, Curve=extend_curve_3)  # -> Point, Parameter, Distance
line_3 = Line(StartPoint=pt_6, EndPoint=curve_closest_point_3.Point)
list_item_5 = ListItem(List=line_3, Index=0, Wrap=True)
extrude_along_3 = ExtrudeAlong(Base=curve_14, Curve=list_item_5)
deconstruct_plane_4 = DeconstructPlane(Plane=extrude_along_3)  # -> Origin, XAxis, YAxis, ZAxis
amplitude_4 = Amplitude(Vector=deconstruct_plane_4.YAxis, Amplitude=Slider(-1, range=-12..0))
construct_plane_4 = ConstructPlane(Origin=origin_pt_3, XAxis=deconstruct_plane_4.XAxis, YAxis=amplitude_4)

pln_6 = Plane(construct_plane_4)

thickness = Slider(55, range=0..100)
box2_width = Slider(16, range=0..20)
box1_width = Slider(26, range=0..30)
division = Division(A=thickness, B=2)
division_2 = Division(A=box1_width, B=2)
division_3 = Division(A=box2_width, B=2)
dom = ConstructDomain(DomainStart=expr("-x", division_2), DomainEnd=division_2)
dom_2 = ConstructDomain(DomainStart=expr("-x", division_3), DomainEnd=division_3)
division_4 = Division(A=division, B=2)
item_4 = ListItem(List=pt_9, Index=0, Wrap=True)
yz = YZPlane(Origin=item_4)
offset = OffsetCurve(Curve=curve_15, Distance=expr("-X", division), Corners=1)
offset_2 = OffsetCurve(Curve=curve_15, Distance=division, Corners=1)
Z_4 = UnitZ(Factor=division_4)
loft = Loft(
    Curves=[offset, offset_2],
    Options={Adjust=False, Closed=False, LoftEnds=0, LoftSimp=0, LoftType=0, Rebuild=10, Refit=0.01})
Z_5 = UnitZ(Factor=thickness)
Z_6 = UnitZ(Factor=division)
extr = Extrude(Base=loft, Direction=Z_5)
move_2 = Move(Geometry=extr, Motion=expr("-x", Z_6))  # -> Geometry, Transform

division_5 = Division(A=thickness, B=4)

# ---- group: cubic_bar
brep_2 = Brep(move_2.Geometry)

# ----
lng_2 = ListLength(List=pt_9)
division_6 = Division(A=lng_2, B=2)
item_5 = ListItem(List=pt_9, Index=expr("x-1", division_6), Wrap=True)
item_6 = ListItem(List=pt_9, Index=expr("x-1", lng_2), Wrap=True)
item_7 = ListItem(List=pt_9, Index=0, Wrap=True)
item_8 = ListItem(List=pt_9, Index=expr("x-2", lng_2), Wrap=True)
item_9 = ListItem(List=pt_9, Index=1, Wrap=True)
item_10 = ListItem(List=pt_9, Index=division_6, Wrap=True)
ln_4 = Line(StartPoint=item_8, EndPoint=item_6)
ln_5 = Line(StartPoint=item_5, EndPoint=item_10)
ln_6 = Line(StartPoint=item_7, EndPoint=item_9)
num = Number(division_2)
ext = ExtendCurve(Curve=ln_4, Type=0, Start=num, End=num)
ext_2 = ExtendCurve(Curve=ln_5, Type=0, Start=num, End=num)
yz_2 = YZPlane(Origin=[item_8, item_5, item_7])
ext_3 = ExtendCurve(Curve=ln_6, Type=0, Start=num, End=num)
X = UnitX(Factor=num)

addition = Addition(A=division_5, B=division_5)
dom_3 = ConstructDomain(DomainStart=0, DomainEnd=expr("-X", division_5))
dom_4 = ConstructDomain(DomainStart=expr("-x", division_5), DomainEnd=expr("-X", addition))
rectangle = Rectangle(Plane=yz, XSize=dom_3, YSize=division_4, Radius=0)  # -> Rectangle, Length
rectangle_2 = Rectangle(Plane=pt_9, XSize=dom_2, YSize=dom_4, Radius=0)  # -> Rectangle, Length
rectangle_3 = Rectangle(Plane=pt_9, XSize=dom, YSize=dom_3, Radius=0)  # -> Rectangle, Length
move_3 = Move(Geometry=rectangle.Rectangle, Motion=Z_4)  # -> Geometry, Transform
boundary = BoundarySurfaces(Edges=[rectangle_3.Rectangle, rectangle_2.Rectangle])
extr_2 = Extrude(Base=flatten(boundary), Direction=Z_5)
move_4 = Move(Geometry=extr_2, Motion=expr("-x", Z_6))  # -> Geometry, Transform

# ---- group: uniform_hook
extrcrv = ExtrudeAlong(Base=move_3.Geometry, Curve=offset)

# ---- group: finger_hooks
brep_3 = Brep(move_4.Geometry)

# ----
sdiff = SolidDifference(BrepsA=brep_2, BrepsB=brep_3)

rectangle_4 = Rectangle(Plane=yz_2, XSize=dom_3, YSize=division_4, Radius=0)  # -> Rectangle, Length
move_5 = Move(Geometry=rectangle_4.Rectangle, Motion=expr("-2*x", Z_4))  # -> Geometry, Transform
item_11 = ListItem(List=move_5.Geometry, Index=0, Wrap=True)  # -> Item, Item1, Item2
srf = Surface(item_11.Item)
srf_2 = Surface(item_11.Item1)
srf_3 = Surface(item_11.Item2)

# ---- group: mid_hook
extrcrv_2 = ExtrudeAlong(Base=srf_2, Curve=ext_2)

# ---- group: far_end_hook
extrcrv_3 = ExtrudeAlong(Base=srf, Curve=ext)

# ---- group: start_end_hook
extrcrv_4 = ExtrudeAlong(Base=srf_3, Curve=ext_3)

# ----
move_6 = Move(Geometry=[extrcrv_3, extrcrv_2, extrcrv_4], Motion=expr("-x", X))  # -> Geometry, Transform

# ----
# bar_prototype
sdiff_2 = SolidDifference(BrepsA=sdiff, BrepsB=[move_6.Geometry, extrcrv])

brep_4 = Brep(sdiff_2)
orient = Orient(Geometry=brep_4, Source=construct_plane, Target=pln_4)  # -> Geometry, Transform
orient_2 = Orient(Geometry=brep_4, Source=construct_plane, Target=pln_6)  # -> Geometry, Transform
orient_3 = Orient(Geometry=brep_4, Source=construct_plane, Target=pln_5)  # -> Geometry, Transform

brep_5 = Brep(sdiff_2)

# ----
# path1
volume = Volume(Geometry=brep)  # -> Volume, Centroid
pl = ConstructPlane(Origin=volume.Centroid, XAxis=Vector(1, 0, 0), YAxis=Vector(0, 1, 0))
pdecon = Deconstruct(Point=volume.Centroid)  # -> XComponent, YComponent, ZComponent
sec = BrepPlane(Brep=brep, Plane=pl)  # -> Curves, Points
explode_4 = Explode(Curve=sec.Curves, Recursive=True)  # -> Segments, Vertices
panel = Panel("""181
182
183""")
cull_i = CullIndex(List=explode_4.Segments, Indices=panel, Wrap=True)
join = JoinCurves(Curves=cull_i, Preserve=False)
Z_7 = UnitZ(Factor=thickness)
# milling path
offset_3 = OffsetCurve(Curve=join, Distance=Slider(-6, range=-10..10), Plane=pl, Corners=1)
panel_2 = Panel("""true
false""")
panel_3 = Panel("""0
1
2""")

# ----
# path3
debrep = DeconstructBrep(Brep=brep)  # -> Faces, Edges, Vertices
area = Area(Geometry=debrep.Faces)  # -> Area, Centroid
sort = SortList(Keys=area.Area, ValuesA=debrep.Faces)  # -> Keys, ValuesA
item_12 = ListItem(List=reverse(sort.ValuesA), Index=Slider(1, range=0..10), Wrap=True)
panel_4 = Panel("""3
167
41
44
166
165
82""")
debrep_2 = DeconstructBrep(Brep=item_12)  # -> Faces, Edges, Vertices
item_13 = ListItem(List=debrep_2.Vertices, Index=0, Wrap=True)
item_14 = ListItem(List=debrep_2.Edges, Index=panel_4, Wrap=True)
pdecon_2 = Deconstruct(Point=item_13)  # -> XComponent, YComponent, ZComponent
join_2 = JoinCurves(Curves=item_14, Preserve=False)
end = EndPoints(Curve=join_2)  # -> Start, End
X_2 = UnitX(Factor="-6")
X_3 = UnitX(Factor="6")
move_7 = Move(Geometry=end.Start, Motion=X_2)  # -> Geometry, Transform
move_8 = Move(Geometry=end.End, Motion=X_3)  # -> Geometry, Transform
ln_7 = Line(StartPoint=move_8.Geometry, EndPoint=move_7.Geometry)
Y_2 = UnitY(Factor="-6")
move_9 = Move(Geometry=ln_7, Motion=Y_2)  # -> Geometry, Transform

subtraction = Subtraction(A=pdecon_2.ZComponent, B=pdecon.ZComponent)
Z_8 = UnitZ(Factor=subtraction)
move_10 = Move(Geometry=offset_3, Motion=Z_8)  # -> Geometry, Transform
extr_3 = Extrude(Base=move_10.Geometry, Direction=Z_7)
contour = Contour(Shape=extr_3, Point=item_13, Direction=Vector(0, 0, 1), Distance=Slider(8, range=0..20))  # -> flatten(Contours)
end_2 = EndPoints(Curve=reverse(contour))  # -> Start, End
shift_2 = ShiftList(List=end_2.Start, Shift=1, Wrap=False)
dispatch = Dispatch(List=end_2.End, DispatchPattern=panel_2)  # -> ListA, ListB
dispatch_2 = Dispatch(List=shift_2, DispatchPattern=panel_2)  # -> ListA, ListB
cull_i_2 = CullIndex(List=dispatch.ListA, Indices=-1, Wrap=True)
ln_8 = Line(StartPoint=dispatch_2.ListA, EndPoint=dispatch_2.ListB)
ln_9 = Line(StartPoint=cull_i_2, EndPoint=dispatch.ListB)
weave = Weave(Pattern=panel_3, Stream0=reverse(contour), Stream1=ln_9, Stream2=ln_8, NullGaps=False)
join_3 = JoinCurves(Curves=weave, Preserve=False)

# ----
# path2
item_15 = ListItem(List=reverse(end_2.Start), Index=0, Wrap=True)
item_16 = ListItem(List=reverse(end_2.End), Index=0, Wrap=True)
division_7 = Division(A=thickness, B=4)
ln_10 = Line(StartPoint=item_15, EndPoint=item_16)
multiplication_2 = Multiplication(A=division_7, B=3)
Z_9 = UnitZ(Factor=multiplication_2)
move_11 = Move(Geometry=ln_10, Motion=Z_9)  # -> Geometry, Transform

Z_10 = UnitZ(Factor=division_7)
move_12 = Move(Geometry=move_9.Geometry, Motion=Z_10)  # -> Geometry, Transform

crv_3 = Curve(move_11.Geometry)
crv_4 = Curve(join_3)
crv_5 = Curve(move_12.Geometry)
end_3 = EndPoints(Curve=crv_4)  # -> Start, End
end_4 = EndPoints(Curve=crv_3)  # -> Start, End
ln_11 = Line(StartPoint=end_4.End, EndPoint=end_4.Start)
ln_12 = Line(StartPoint=end_3.End, EndPoint=end_4.End)
move_13 = Move(Geometry=end_4.Start, Motion=Z_2)  # -> Geometry, Transform
move_14 = Move(Geometry=move_13.Geometry, Motion=Y)  # -> Geometry, Transform
ln_13 = Line(StartPoint=end_4.Start, EndPoint=move_13.Geometry)
ln_14 = Line(StartPoint=move_13.Geometry, EndPoint=move_14.Geometry)
merge_5 = Merge(Data1=crv_4, Data2=ln_12, Data3=ln_11, Data4=ln_13, Data5=ln_14)  # -> flatten(Result)
join_4 = JoinCurves(Curves=merge_5, Preserve=False)

# ---- group: Orient path to fabrication area and including start and end of robot path
pln_7 = Plane(pl)
crv_6 = Curve(join_4)
clearance_plane_mm = Panel("100")
tool_radius_mm = Panel("0")
_3x_contour = _3XContour(Polyline=crv_6, ToolRadius=tool_radius_mm, SafetyOffset=clearance_plane_mm, Base=pln_7)  # -> Points, Vectors, Feed

# ---- group: Set Orientation Milling Planes
# milling tool:
# D=12mm
pt_10 = Point(Point(892.057, -1496.839, 113))
panel_5 = Panel(pt_10)
X_4 = UnitX(Factor=1)
pl_2 = PlaneNormal(Origin=_3x_contour.Points, ZAxis=_3x_contour.Vectors)
align = AlignPlane(Plane=pl_2, Direction=X_4)  # -> Plane, Angle
sframe = SetFrame(XYZLocation="{-200,-1806.37,135.86}", ABCOrientation="0,0,0")
orient_4 = Orient(Geometry=align.Plane, Source=PlaneXY(0, 0, 0), Target=sframe)  # -> Geometry, Transform
deplane = DeconstructPlane(Plane=orient_4.Geometry)  # -> Origin, XAxis, YAxis, ZAxis
avr = Average(Input=deplane.Origin)
pt_11 = Point(avr)
y_threshold = Slider(200, range=-1000..1000)
pdecon_3 = Deconstruct(Point=pt_11)  # -> XComponent, YComponent, ZComponent
larger = LargerThan(FirstNumber=pdecon_3.YComponent, SecondNumber=y_threshold)  # -> LargerThan, OrEqualTo
dispatch_3 = Dispatch(List=avr, DispatchPattern=larger.LargerThan)  # -> ListA, ListB
# G-Code Generation
number_slider_3 = Slider(90, range=-90..90)
lng_3 = ListLength(List=dispatch_3.ListB)
lng_4 = ListLength(List=dispatch_3.ListA)
bnd = Bounds(Numbers=flatten(pdecon_3.YComponent))
repeat = RepeatData(Data=number_slider_3, Length=lng_4)
repeat_2 = RepeatData(Data=Slider(-90, range=-90..90), Length=lng_3)
bnd_2 = Bounds(Numbers=flatten(pdecon_3.XComponent))
c_script = CSharpScript(D=bnd)  # -> out, A
# ---------- c_script: C# ----------
    double t0 = D.T0;
    double t1 = D.T1;
    
    if (Math.Abs(t0) >= Math.Abs(t1)){
      Print("t0 larger or equal than t1");
      t1 = Math.Abs(t0);
    } else {
      Print("t1 larger than t0");
      t0 = Math.Abs(t1);
    }

    A = new Interval(t0, t1);
    //A = D.Mid;
# ---------- end c_script ----------
merge_6 = Merge(Data1=repeat, Data2=repeat_2)  # -> simplify(Result)
remap = RemapNumbers(Value=pdecon_3.XComponent, Source=bnd_2, Target=Domain(1, 0))  # -> Mapped, Clipped
remap_2 = RemapNumbers(Value=pdecon_3.YComponent, Source=c_script.A, Target="-90 to 90")  # -> Mapped, Clipped
remap_3 = RemapNumbers(Value=pdecon_3.YComponent, Source=c_script.A, Target=Domain(0, 1))  # -> Mapped, Clipped
multiplication_3 = Multiplication(A=remap_2.Mapped, B=remap_3.Mapped)
multiplication_4 = Multiplication(A=merge_6, B=remap.Mapped)
addition_2 = Addition(A=multiplication_4, B=multiplication_3)
lng_5 = ListLength(List=orient_4.Geometry)
filter = StreamFilter(Gate=Slider(2, range=0..2), Stream0=merge_6, Stream1=remap_2.Mapped, Stream2=addition_2)
dup = DuplicateData(Data=filter, Number=lng_5, Order=True)
rad = Radians(Degrees=dup)
Z_11 = UnitZ(Factor=Slider(1000, range=-1000..1000))
prot = RotatePlane(Plane=orient_4.Geometry, Angle=rad)
panel_6 = Panel(filter)
move_15 = Move(Geometry=prot, Motion=Z_11)  # -> Geometry, Transform
pline = PolyLine(Vertices=flatten(move_15.Geometry), Closed=False)
preview_3 = CustomPreview(Geometry=pline, Shader=ColourSwatch(SwatchColor=RGB(0, 255, 238)))

# ---- group: Orient path to fabrication area and including start and end of robot path
deplane_2 = DeconstructPlane(Plane=pl)  # -> Origin, XAxis, YAxis, ZAxis
multiplication_5 = Multiplication(A=deplane_2.ZAxis, B=-1)
brep_6 = Brep(brep)
pln_8 = Plane(pl)
pl_3 = PlaneNormal(Origin=deplane_2.Origin, ZAxis=multiplication_5)
crv_7 = Curve(move_12.Geometry)
clearance_plane_mm_2 = Panel("100")
tool_radius_mm_2 = Panel("0")
_3x_contour_2 = _3XContour(Polyline=crv_7, ToolRadius=tool_radius_mm_2, SafetyOffset=clearance_plane_mm_2, Base=pln_8)  # -> Points, Vectors, Feed
orient_5 = Orient(Geometry=crv_7, Source=pln_8, Target=sframe)  # -> Geometry, Transform
orient_6 = Orient(Geometry=brep_6, Source=pln_8, Target=sframe)  # -> Geometry, Transform
move_16 = Move(Geometry=orient_5.Geometry, Motion=Z_11)  # -> Geometry, Transform
move_17 = Move(Geometry=orient_6.Geometry, Motion=Z_11)  # -> Geometry, Transform
crv_8 = Curve(move_16.Geometry)
preview_4 = CustomPreview(Geometry=move_17.Geometry, Shader=ColourSwatch(SwatchColor=RGBA(237, 237, 237, 179)))

brep_7 = Brep(brep)
orient_7 = Orient(Geometry=crv_6, Source=pln_7, Target=sframe)  # -> Geometry, Transform
orient_8 = Orient(Geometry=brep_7, Source=pln_7, Target=sframe)  # -> Geometry, Transform
move_18 = Move(Geometry=orient_7.Geometry, Motion=Z_11)  # -> Geometry, Transform
move_19 = Move(Geometry=orient_8.Geometry, Motion=Z_11)  # -> Geometry, Transform
crv_9 = Curve(move_18.Geometry)
preview_5 = CustomPreview(Geometry=move_19.Geometry, Shader=ColourSwatch(SwatchColor=RGBA(237, 237, 237, 179)))

# ----
item_17 = ListItem(List=_3x_contour_2.Points, Index=Slider(0, range=0..4), Wrap=True)  # -> Item, Item1, Item2, Item3
move_20 = Move(Geometry=item_17.Item, Motion=Z_3)  # -> Geometry, Transform
move_21 = Move(Geometry=item_17.Item3, Motion=Z_3)  # -> Geometry, Transform
merge_7 = Merge(Data1=move_20.Geometry, Data2=item_17.Item1, Data3=item_17.Item2, Data4=move_21.Geometry)

# ---- group: Set Orientation Milling Planes
# milling tool:
# D=12mm
pt_12 = Point(Point(892.057, -1496.839, 113))
multiplication_6 = Multiplication(A=_3x_contour_2.Vectors, B=-1)
panel_7 = Panel(pt_12)
pl_4 = PlaneNormal(Origin=merge_7, ZAxis=multiplication_6)
X_5 = UnitX(Factor=-1)
align_2 = AlignPlane(Plane=pl_4, Direction=X_5)  # -> Plane, Angle
sframe_2 = SetFrame(XYZLocation="{-200,-1806.37,135.86}", ABCOrientation="0,0,0")
orient_9 = Orient(Geometry=align_2.Plane, Source=PlaneXY(0, 0, 0), Target=sframe_2)  # -> Geometry, Transform
deplane_3 = DeconstructPlane(Plane=orient_9.Geometry)  # -> Origin, XAxis, YAxis, ZAxis
avr_2 = Average(Input=deplane_3.Origin)
pt_13 = Point(avr_2)
y_threshold_2 = Slider(200, range=-1000..1000)
pdecon_4 = Deconstruct(Point=pt_13)  # -> XComponent, YComponent, ZComponent
larger_2 = LargerThan(FirstNumber=pdecon_4.YComponent, SecondNumber=y_threshold_2)  # -> LargerThan, OrEqualTo
dispatch_4 = Dispatch(List=avr_2, DispatchPattern=larger_2.LargerThan)  # -> ListA, ListB
lng_6 = ListLength(List=dispatch_4.ListB)
lng_7 = ListLength(List=dispatch_4.ListA)
bnd_3 = Bounds(Numbers=flatten(pdecon_4.YComponent))
repeat_3 = RepeatData(Data=Slider(90, range=-90..90), Length=lng_7)
repeat_4 = RepeatData(Data=Slider(-90, range=-90..90), Length=lng_6)
bnd_4 = Bounds(Numbers=flatten(pdecon_4.XComponent))
c_script_2 = CSharpScript(D=bnd_3)  # -> out, A; same code as c_script
merge_8 = Merge(Data1=repeat_3, Data2=repeat_4)  # -> simplify(Result)
remap_4 = RemapNumbers(Value=pdecon_4.XComponent, Source=bnd_4, Target=Domain(1, 0))  # -> Mapped, Clipped
remap_5 = RemapNumbers(Value=pdecon_4.YComponent, Source=c_script_2.A, Target="-90 to 90")  # -> Mapped, Clipped
remap_6 = RemapNumbers(Value=pdecon_4.YComponent, Source=c_script_2.A, Target=Domain(0, 1))  # -> Mapped, Clipped
multiplication_7 = Multiplication(A=remap_5.Mapped, B=remap_6.Mapped)
multiplication_8 = Multiplication(A=merge_8, B=remap_4.Mapped)
addition_3 = Addition(A=multiplication_8, B=multiplication_7)
lng_8 = ListLength(List=orient_9.Geometry)
filter_2 = StreamFilter(Gate=Slider(2, range=0..2), Stream0=merge_8, Stream1=remap_5.Mapped, Stream2=addition_3)
dup_2 = DuplicateData(Data=filter_2, Number=lng_8, Order=True)
rad_2 = Radians(Degrees=dup_2)
prot_2 = RotatePlane(Plane=orient_9.Geometry, Angle=rad_2)
Z_12 = UnitZ(Factor=Slider(1000, range=-1000..1000))
panel_8 = Panel(filter_2)
move_22 = Move(Geometry=prot_2, Motion=Z_12)  # -> Geometry, Transform
pline_2 = PolyLine(Vertices=flatten(move_22.Geometry), Closed=False)
preview_6 = CustomPreview(Geometry=pline_2, Shader=ColourSwatch(SwatchColor=RGB(0, 255, 238)))

# ----
deplane_4 = DeconstructPlane(Plane=move_15.Geometry)  # -> Origin, XAxis, YAxis, ZAxis
num_2 = Number(dup)
pt_14 = Point(deplane_4.Origin)
vec = Vector(deplane_4.ZAxis)
txt = Text(_3x_contour.Feed)

# ---- group: Robot Simulatiopn
ee = PredefinedSpindleEndEffector()
kuka_kr_125_2 = PredefinedKUKAKR1252(RobRootFrame=PlaneXY(0, 0, 0), EndEffectorOptional=ee)
iframe = InterpolateFrames(Frames=flatten(move_22.Geometry), Length=Slider(0.283, range=0..1), Step=10, Reset=Toggle(True))  # -> Frame, Percent, CurrentIndex
robot_ik = RobotInverseKinematics(Robot=kuka_kr_125_2, TargetTCPFrame=iframe.Frame, AxisToggles=[False, False, False], useColorPreview=True)  # -> PoseGeometry, AxisValues, AxisFrames

# ----
deplane_5 = DeconstructPlane(Plane=move_22.Geometry)  # -> Origin, XAxis, YAxis, ZAxis

# ---- group: Robot Simulatiopn
ee_2 = PredefinedSpindleEndEffector()
kuka_kr_125_2_2 = PredefinedKUKAKR1252(RobRootFrame=PlaneXY(0, 0, 0), EndEffectorOptional=ee_2)
iframe_2 = InterpolateFrames(Frames=flatten(move_15.Geometry), Length=Slider(0, range=0..1), Step=10, Reset=Toggle(True))  # -> Frame, Percent, CurrentIndex
robot_ik_2 = RobotInverseKinematics(Robot=kuka_kr_125_2_2, TargetTCPFrame=iframe_2.Frame, AxisToggles=[False, False, False], useColorPreview=True)  # -> PoseGeometry, AxisValues, AxisFrames

# ----
nc_r = NCGenerationRobomove(Points=pt_14, Vectors=vec, Rotation=num_2, Feed=txt, Settings=nc_settings)

# ---- group: G-CODE
nc = NCGeneration(Points=pt_14, Vectors=vec, Feed=txt, Settings=nc_settings)
panel_9 = Panel(nc_r)

# ----
num_3 = Number(dup_2)
pt_15 = Point(deplane_5.Origin)
vec_2 = Vector(deplane_5.ZAxis)
txt_2 = Text(_3x_contour_2.Feed)
nc_r_2 = NCGenerationRobomove(Points=pt_15, Vectors=vec_2, Rotation=num_3, Feed=txt_2, Settings=nc_settings_2)

# ---- group: G-CODE
nc_2 = NCGeneration(Points=pt_15, Vectors=vec_2, Feed=txt_2, Settings=nc_settings_2)
panel_10 = Panel(nc_r_2)
