# Grasshopper definition Custom CAM_3X_Contour.gh (Grasshopper 1.0.7)
# plug-ins: Sandbox

brep = Brep([<brep referenced from the Rhino model> x3])
debrep = DeconstructBrep(Brep=brep)  # -> Faces, Edges, Vertices
deviation_tolerance_mm = Panel("0.2")
join = JoinCurves(Curves=debrep.Edges, Preserve=False)
topoly = CurveToPolyline(Curve=join, ToleranceDistance=deviation_tolerance_mm, ToleranceAngle=0)  # -> Polyline, Segments

pt = Point(Point(-168.421613, -157.094091, 0))
xy = XYPlane(Origin=pt)
pi = Pi(Factor=Slider(0, range=0..1))
deplane = DeconstructPlane(Plane=xy)  # -> Origin, XAxis, YAxis, ZAxis
rot3d = Rotate3D(Geometry=xy, Angle=pi, Center=deplane.Origin, Axis=deplane.YAxis)  # -> Geometry, Transform

tool_no = Panel("1")
spindle_speed_rpm = Panel("10000")
feed_mm_min = Panel("4000")
nc_settings = NCSettings(Tool=tool_no, Speed=spindle_speed_rpm, Feed=feed_mm_min)

tool_radius_mm = Panel("8")
clearance_plane_mm = Panel("100")
crv = Curve(topoly.Polyline)
pln = Plane(xy)
_3x_contour = _3XContour(Polyline=crv, ToolRadius=tool_radius_mm, SafetyOffset=clearance_plane_mm, Base=pln)  # -> Points, Vectors, Feed

panel = Panel(crv)
pt_2 = Point(_3x_contour.Points)
vec = Vector(_3x_contour.Vectors)
txt = Text(_3x_contour.Feed)

nc = NCGeneration(Points=pt_2, Vectors=vec, Feed=txt, Settings=nc_settings)
panel_2 = Panel(nc)

orient = Orient(Geometry=pt_2, Source=PlaneXY(0, 0, 0), Target=pln)  # -> Geometry, Transform
pline = PolyLine(Vertices=orient.Geometry, Closed=False)
preview = CustomPreview(Geometry=pline, Shader=ColourSwatch(SwatchColor=RGB(0, 255, 238)))
