# Grasshopper definition Custom CAM_3X_Drilling.gh (Grasshopper 1.0.7)
# plug-ins: Sandbox

crv = Curve(graft([<curve referenced from the Rhino model> x3]))
brep = Brep([<brep referenced from the Rhino model> x3])
area = Area(Geometry=brep)  # -> Area, Centroid
eval = Evaluate(F="Floor(x/y)", x=area.Area, y=Slider(603, range=0..1000))
popgeo = PopulateGeometry(Geometry=brep, Count=eval, Seed=1)
alongcrv = SortAlongCurve(Points=popgeo, Curve=crv)  # -> Points, Indices

pt = Point(Point(-168.421613, -157.094091, 0))
xy = XYPlane(Origin=pt)
pi = Pi(Factor=Slider(0, range=0..1))
deplane = DeconstructPlane(Plane=xy)  # -> Origin, XAxis, YAxis, ZAxis
rot3d = Rotate3D(Geometry=xy, Angle=pi, Center=deplane.Origin, Axis=deplane.YAxis)  # -> Geometry, Transform

depth = Panel("-2")
clearance_plane = Panel("100")
pln = Plane(xy)
_3x_drilling = _3XDrilling(Points=alongcrv.Points, Depth=depth, SafetyOffset=clearance_plane, Base=pln)  # -> Points, Vectors, Feed

tool_no = Panel("1")
spindle_speed_rpm = Panel("1000")
feed_mm_min = Panel("2000")
nc_settings = NCSettings(Tool=tool_no, Speed=spindle_speed_rpm, Feed=feed_mm_min)

pt_2 = Point(_3x_drilling.Points)
vec = Vector(_3x_drilling.Vectors)
txt = Text(_3x_drilling.Feed)
orient = Orient(Geometry=pt_2, Source=PlaneXY(0, 0, 0), Target=pln)  # -> Geometry, Transform

nc = NCGeneration(Points=pt_2, Vectors=vec, Feed=txt, Settings=nc_settings)
panel = Panel(nc)

pshift = ShiftPaths(Data=orient.Geometry, Offset=-1)
pline = PolyLine(Vertices=pshift, Closed=False)
preview = CustomPreview(Geometry=pline, Shader=ColourSwatch(SwatchColor=RGB(0, 255, 238)))
