# Grasshopper definition Dovetail_Join_Fabrication_Handout.gh (Grasshopper 1.0.7)
# plug-ins: Pufferfish, Sandbox, VirtualRobot.Grasshopper

offset = Slider(46, range=0..1000)
tool_diameter = Slider(20, range=0..100)
amount = Slider(16, range=0..100)
corner_smooth = Slider(24, range=0..100)
depth = Slider(25, range=0..100)

# ---- group: Region Plate
pt = Point(Point(-366, -9961, 0))
xy = XYPlane(Origin=pt)
panel = Panel("475")
rectangle = Rectangle(Plane=xy, XSize=panel, YSize="200", Radius=0)  # -> Rectangle, Length

# ----
z_depth = Slider(21, range=0..50)
division = Division(A=z_depth, B=2)

tool_no = Panel("1")
spindle_speed_rpm = Panel("12000")
feed_mm_min = Panel("4000")
nc_settings = NCSettings(Tool=tool_no, Speed=spindle_speed_rpm, Feed=feed_mm_min)

# ---- group: Dovetail Joint
explode = Explode(Curve=rectangle.Rectangle, Recursive=True)  # -> Segments, Vertices
neg = Negative(Value=offset)
item = ListItem(List=explode.Segments, Index="2", Wrap=True)
Y = UnitY(Factor=neg)
move = Move(Geometry=item, Motion=Y)  # -> Geometry, Transform
X = UnitX(Factor=panel)
divide = DivideCurve(Curve=move.Geometry, Count=amount, Kinks=False)  # -> Points, Tangents, Parameters
neg_2 = Negative(Value=X)
move_2 = Move(Geometry=divide.Points, Motion=neg_2)  # -> Geometry, Transform
# 3D Geometry Generation
move_3 = Move(Geometry=divide.Points, Motion=X)  # -> Geometry, Transform
merge = Merge(Data1=move_3.Geometry, Data2=divide.Points, Data3=move_2.Geometry)
cullpt = CullDuplicates(Points=merge, Tolerance=0.1, CullMode=3)  # -> Points, Indices, Valence
dispatch = Dispatch(List=cullpt.Points, DispatchPattern=[True, False])  # -> ListA, ListB
Y_2 = UnitY(Factor=depth)
neg_3 = Negative(Value=Y_2)
move_4 = Move(Geometry=dispatch.ListA, Motion=Y_2)  # -> Geometry, Transform
move_5 = Move(Geometry=dispatch.ListB, Motion=neg_3)  # -> Geometry, Transform

# ---- group: Dovetail Joint / Generate DoveTail
X_2 = UnitX(Factor=corner_smooth)
neg_4 = Negative(Value=X_2)
move_6 = Move(Geometry=move_4.Geometry, Motion=X_2)  # -> Geometry, Transform
move_7 = Move(Geometry=move_4.Geometry, Motion=neg_4)  # -> Geometry, Transform
move_8 = Move(Geometry=move_5.Geometry, Motion=X_2)  # -> Geometry, Transform
move_9 = Move(Geometry=move_5.Geometry, Motion=neg_4)  # -> Geometry, Transform
panel_2 = Panel("""0
1
2
3""")
weave = Weave(
    Pattern=panel_2,
    Stream0=move_6.Geometry,
    Stream1=move_7.Geometry,
    Stream2=move_8.Geometry,
    Stream3=move_9.Geometry,
    NullGaps=False)
nurbs = NurbsCurve(Vertices=weave, Degree=Slider(2, range=0..10), Periodic=False)  # -> Curve, Length, Domain

# ---- group: Dovetail Joint (continued)
ccx = CurveCurve(CurveA=nurbs.Curve, CurveB=rectangle.Rectangle)  # -> Points, ParamsA, ParamsB
shatter = Shatter(Curve=nurbs.Curve, Parameters=ccx.ParamsA)
shatter_2 = Shatter(Curve=rectangle.Rectangle, Parameters=ccx.ParamsB)
item_2 = ListItem(List=shatter, Index="1", Wrap=True)
item_3 = ListItem(List=shatter_2, Index=0, Wrap=True)  # -> Item, Item1
crv = Curve(item_2)
join = JoinCurves(Curves=flatten([item_3.Item1, crv]), Preserve=False)
join_2 = JoinCurves(Curves=flatten([item_3.Item, crv]), Preserve=False)

# ----
dovetail_crv = Curve(crv)
plate_area = Curve(join)
lap_area = Curve(join_2)

# ---- group: Lap Area
division_2 = Division(A=tool_diameter, B=2)
subtraction = Subtraction(A=division_2, B="0.5")
subtraction_2 = Subtraction(A=offset, B=depth)
item_4 = ListItem(List=explode.Segments, Index="2", Wrap=True)
division_3 = Division(A=subtraction_2, B=subtraction)
int = Integer(division_3)
# Generate Milling Path
series = Series(Start=0, Step=subtraction, Count=int)
Y_3 = UnitY(Factor=series)
neg_5 = Negative(Value=Y_3)
move_10 = Move(Geometry=item_4, Motion=neg_5)  # -> Geometry, Transform
panel_3 = Panel("30")
ext = ExtendCurve(Curve=move_10.Geometry, Type=0, Start=panel_3, End=panel_3)
dispatch_2 = Dispatch(List=ext, DispatchPattern=[True, False])  # -> ListA, ListB
flip = FlipCurve(Curve=dispatch_2.ListB)  # -> Curve, Flag
weave_2 = Weave(Pattern=[0, 1], Stream0=dispatch_2.ListA, Stream1=flip.Curve, NullGaps=False)
end = EndPoints(Curve=weave_2)  # -> Start, End
weave_3 = Weave(Pattern=[0, 1], Stream0=end.Start, Stream1=end.End, NullGaps=False)
pline = PolyLine(Vertices=weave_3, Closed=False)
Z = UnitZ(Factor=division)
move_11 = Move(Geometry=pline, Motion=Z)  # -> Geometry, Transform

# ---- group: Contour Cut
Y_4 = UnitY(Factor=subtraction)
move_12 = Move(Geometry=item_4, Motion=Y_4)  # -> Geometry, Transform
ext_2 = ExtendCurve(Curve=move_12.Geometry, Type=0, Start=panel_3, End=panel_3)
Z_2 = UnitZ(Factor=division)
flip_2 = FlipCurve(Curve=ext_2)  # -> Curve, Flag
Z_3 = UnitZ(Factor="-1")
move_13 = Move(Geometry=ext_2, Motion=Z_2)  # -> Geometry, Transform
move_14 = Move(Geometry=flip_2.Curve, Motion=Z_3)  # -> Geometry, Transform
end_2 = EndPoints(Curve=move_13.Geometry)  # -> Start, End
end_3 = EndPoints(Curve=move_14.Geometry)  # -> Start, End
ln = Line(StartPoint=end_2.End, EndPoint=end_3.Start)
merge_2 = Merge(Data1=move_13.Geometry, Data2=ln, Data3=move_14.Geometry)  # -> flatten(Result)
join_3 = JoinCurves(Curves=merge_2, Preserve=False)

# ---- group: Mill Path Dovetail
Z_4 = UnitZ(Factor=division)
move_15 = Move(Geometry=dovetail_crv, Motion=Z_4)  # -> Geometry, Transform
ext_3 = ExtendCurve(Curve=move_15.Geometry, Type=0, Start="50", End="50")
offcrv = OffsetCurve(Curve=ext_3, Plane=PlaneXY(0, 0, 0), Distance=subtraction, BothSides=0, Kinks=0, CapType=0)
number_slider = Slider(0.1, range=0..0.1)
topoly = CurveToPolyline(Curve=offcrv, ToleranceDistance=number_slider, ToleranceAngle=number_slider)  # -> Polyline, Segments

# ---- group: BUTTJOINT
curve = Curve(topoly.Polyline)

# ---- group: LAP AREA TOP
curve_2 = Curve(move_11.Geometry)

# ---- group: FRONT CUT
curve_3 = Curve(join_3)

# ---- group: Orient path to fabrication area and including start and end of robot path
list = ValueList({"Dovetail": 0, "Contour": 1, "Lap Area": 2}, selected="Dovetail")
pt_2 = Point(Point(-366, -9961, 0))
filter = StreamFilter(Gate=list, Stream0=curve, Stream1=curve_3, Stream2=curve_2)
xy_2 = XYPlane(Origin=pt_2)
brep = Brep(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)

tool_radius_mm = Panel("0")
clearance_plane_mm = Panel("100")
crv_2 = Curve(filter)
pln = Plane(xy)
_3x_contour = _3XContour(Polyline=crv_2, ToolRadius=tool_radius_mm, SafetyOffset=clearance_plane_mm, Base=pln)  # -> Points, Vectors, Feed

# ---- group: Set Orientation Milling Planes
pt_3 = Point(Point(892.057, -1496.839, 113))
panel_4 = Panel(pt_3)
pl = PlaneNormal(Origin=_3x_contour.Points, ZAxis=_3x_contour.Vectors)
X_3 = UnitX(Factor=1)
sframe = SetFrame(XYZLocation="{976.06,-1406.37,135.86}", ABCOrientation="0,0,0")
align = AlignPlane(Plane=pl, Direction=X_3)  # -> Plane, Angle
orient = Orient(Geometry=align.Plane, Source=PlaneXY(0, 0, 0), Target=sframe)  # -> Geometry, Transform
deplane = DeconstructPlane(Plane=orient.Geometry)  # -> Origin, XAxis, YAxis, ZAxis
avr = Average(Input=deplane.Origin)
pt_4 = Point(avr)
y_threshold = Slider(200, range=-1000..1000)
pdecon = Deconstruct(Point=pt_4)  # -> XComponent, YComponent, ZComponent
larger = LargerThan(FirstNumber=pdecon.YComponent, SecondNumber=y_threshold)  # -> LargerThan, OrEqualTo
dispatch_3 = Dispatch(List=avr, DispatchPattern=larger.LargerThan)  # -> ListA, ListB
# G-Code Generation
number_slider_2 = Slider(90, range=-90..90)
lng = ListLength(List=dispatch_3.ListB)
lng_2 = ListLength(List=dispatch_3.ListA)
bnd = Bounds(Numbers=flatten(pdecon.YComponent))
repeat = RepeatData(Data=number_slider_2, Length=lng_2)
repeat_2 = RepeatData(Data=Slider(-90, range=-90..90), Length=lng)
bnd_2 = Bounds(Numbers=flatten(pdecon.XComponent))
c_script = CSharpScript(D=bnd)  # -> out, A
# ---------- c_script: C# ----------
    double t0 = D.T0;
    double t1 = D.T1;
    
    if (Math.Abs(t0) >= Math.Abs(t1)){
      Print("t0 larger or equal than t1");
      t1 = Math.Abs(t0);
    } else {
      Print("t1 larger than t0");
      t0 = Math.Abs(t1);
    }

    A = new Interval(t0, t1);
    //A = D.Mid;
# ---------- end c_script ----------
merge_3 = Merge(Data1=repeat, Data2=repeat_2)  # -> simplify(Result)
remap = RemapNumbers(Value=pdecon.XComponent, Source=bnd_2, Target=Domain(1, 0))  # -> Mapped, Clipped
remap_2 = RemapNumbers(Value=pdecon.YComponent, Source=c_script.A, Target="-90 to 90")  # -> Mapped, Clipped
remap_3 = RemapNumbers(Value=pdecon.YComponent, Source=c_script.A, Target=Domain(0, 1))  # -> Mapped, Clipped
multiplication = Multiplication(A=remap_2.Mapped, B=remap_3.Mapped)
multiplication_2 = Multiplication(A=merge_3, B=remap.Mapped)
addition = Addition(A=multiplication_2, B=multiplication)
lng_3 = ListLength(List=orient.Geometry)
filter_2 = StreamFilter(Gate=Slider(2, range=0..2), Stream0=merge_3, Stream1=remap_2.Mapped, Stream2=addition)
dup = DuplicateData(Data=filter_2, Number=lng_3, Order=True)
rad = Radians(Degrees=dup)
panel_5 = Panel(filter_2)
prot = RotatePlane(Plane=orient.Geometry, Angle=rad)
pline_2 = PolyLine(Vertices=flatten(prot), Closed=False)
preview = CustomPreview(Geometry=pline_2, Shader=ColourSwatch(SwatchColor=RGB(0, 255, 238)))

# ---- group: Orient path to fabrication area and including start and end of robot path (continued)
orient_2 = Orient(Geometry=crv_2, Source=pln, Target=sframe)  # -> Geometry, Transform
orient_3 = Orient(Geometry=brep, Source=pln, Target=sframe)  # -> Geometry, Transform
crv_3 = Curve(orient_2.Geometry)
preview_2 = CustomPreview(Geometry=orient_3.Geometry, Shader=ColourSwatch(SwatchColor=RGBA(237, 237, 237, 179)))

# ----
deplane_2 = DeconstructPlane(Plane=prot)  # -> Origin, XAxis, YAxis, ZAxis
pt_5 = Point(deplane_2.Origin)
num = Number(dup)
vec = Vector(deplane_2.ZAxis)
txt = Text(_3x_contour.Feed)
nc_r = NCGenerationRobomove(Points=pt_5, Vectors=vec, Rotation=num, Feed=txt, Settings=nc_settings)

# ---- group: G-CODE
nc = NCGeneration(Points=pt_5, Vectors=vec, Feed=txt, Settings=nc_settings)
panel_6 = Panel(nc_r)

# ---- group: Robot Simulatiopn
ee = PredefinedSpindleEndEffector()
kuka_kr_125_2 = PredefinedKUKAKR1252(RobRootFrame=PlaneXY(0, 0, 0), EndEffectorOptional=ee)
iframe = InterpolateFrames(Frames=flatten(prot), Length=Slider(0.476, range=0..1), Step=10, Reset=Toggle(True))  # -> Frame, Percent, CurrentIndex
robot_ik = RobotInverseKinematics(Robot=kuka_kr_125_2, TargetTCPFrame=iframe.Frame, AxisToggles=[False, False, False], useColorPreview=True)  # -> PoseGeometry, AxisValues, AxisFrames
