# Grasshopper definition Shingle_shell-CAM-1-Marking-3X_drilling.gh (Grasshopper 1.0.7)
# plug-ins: Sandbox, VirtualRobot.Grasshopper

# ---- group: Sheet-1
brep = Brep([<brep referenced from the Rhino model> x28])

# ---- group: Sheet-2
brep_2 = Brep([<brep referenced from the Rhino model> x35])

# ---- group: Sheet-3
brep_3 = Brep([<brep referenced from the Rhino model> x34])

# ---- group: Sheet-4
brep_4 = Brep([<brep referenced from the Rhino model> x33])

# ---- group: Sheet-5
brep_5 = Brep([<brep referenced from the Rhino model> x13])

# ----
path_mapper = PathMapper(source="{A}", target="{1;A}")
pt = Point(Point(-366, -9961, 0))
xy = XYPlane(Origin=pt)
pt_2 = Point(Point(892.057, -1496.839, 113))
panel = Panel(pt_2)
sframe = SetFrame(XYZLocation="{976.06,-1406.37,135.86}", ABCOrientation="0,0,0")
y_threshold = Slider(200, range=-1000..1000)

tool_no = Panel("1")
spindle_speed_rpm = Panel("12000")
feed_mm_min = Panel("4000")
nc_settings = NCSettings(Tool=tool_no, Speed=spindle_speed_rpm, Feed=feed_mm_min)

ee = PredefinedSpindleEndEffector()
kuka_kr_125_2 = PredefinedKUKAKR1252(RobRootFrame=PlaneXY(0, 0, 0), EndEffectorOptional=ee)

# ----
# GENERATE TOOLPATH
brep_6 = Brep(brep)
debrep = DeconstructBrep(Brep=brep_6)  # -> Faces, Edges, Vertices
area = Area(Geometry=debrep.Faces)  # -> Area, Centroid

pdecon = Deconstruct(Point=area.Centroid)  # -> XComponent, YComponent, ZComponent
brep_7 = Brep(brep_6)

sort = SortList(Keys=pdecon.ZComponent, ValuesA=debrep.Faces)  # -> Keys, reverse(ValuesA)
item = ListItem(List=sort.ValuesA, Index=[0, 1], Wrap=True)

area_2 = Area(Geometry=item)  # -> Area, Centroid

sort_2 = SortList(Keys=area_2.Area, ValuesA=area_2.Centroid)  # -> Keys, reverse(ValuesA)

item_2 = ListItem(List=sort_2.ValuesA, Index=0, Wrap=True)

pt_3 = Point(simplify(item_2))

points = PointList(Points=flatten(item_2), Size=50)
circle = CircleCNR(Center=pt_3, Normal=Vector(0, 0, 1), Radius="10")
path_mapper_2 = PathMapper(pt_3, source="{A}", target="{0;A}")
merge = Merge(Data1=path_mapper_2, Data2=path_mapper)

depth = Panel("-2")
clearance_plane = Panel("100")
pln = Plane(xy)
pt_4 = Point(merge)
_3x_drilling = _3XDrilling(Points=pt_4, Depth=depth, SafetyOffset=clearance_plane, Base=pln)  # -> Points, Vectors, Feed

orient = Orient(Geometry=_3x_drilling.Points, Source=PlaneXY(0, 0, 0), Target=pln)  # -> Geometry, Transform
pshift = ShiftPaths(Data=orient.Geometry, Offset=-1)
pl = PlaneNormal(Origin=_3x_drilling.Points, ZAxis=_3x_drilling.Vectors)
pline = PolyLine(Vertices=pshift, Closed=False)
preview = CustomPreview(Geometry=pline, Shader=ColourSwatch(SwatchColor=RGB(0, 255, 238)))
orient_2 = Orient(Geometry=pl, Source=PlaneXY(0, 0, 0), Target=sframe)  # -> Geometry, Transform
orient_3 = Orient(Geometry=brep_7, Source=pln, Target=sframe)  # -> Geometry, Transform
deplane = DeconstructPlane(Plane=orient_2.Geometry)  # -> Origin, XAxis, YAxis, ZAxis
preview_2 = CustomPreview(Geometry=orient_3.Geometry, Shader=ColourSwatch(SwatchColor=RGBA(176, 176, 176, 148)))
avr = Average(Input=deplane.Origin)
pt_5 = Point(avr)
pdecon_2 = Deconstruct(Point=pt_5)  # -> XComponent, YComponent, ZComponent
larger = LargerThan(FirstNumber=pdecon_2.YComponent, SecondNumber=y_threshold)  # -> LargerThan, OrEqualTo
dispatch = Dispatch(List=avr, DispatchPattern=larger.LargerThan)  # -> ListA, ListB
lng = ListLength(List=dispatch.ListB)
lng_2 = ListLength(List=dispatch.ListA)
bnd = Bounds(Numbers=flatten(pdecon_2.YComponent))
repeat = RepeatData(Data=Slider(90, range=-90..90), Length=lng_2)
repeat_2 = RepeatData(Data=Slider(-90, range=-90..90), Length=lng)
bnd_2 = Bounds(Numbers=flatten(pdecon_2.XComponent))
c_script = CSharpScript(D=bnd)  # -> out, A
# ---------- c_script: C# ----------
    double t0 = D.T0;
    double t1 = D.T1;
    
    if (Math.Abs(t0) >= Math.Abs(t1)){
      Print("t0 larger or equal than t1");
      t1 = Math.Abs(t0);
    } else {
      Print("t1 larger than t0");
      t0 = Math.Abs(t1);
    }

    A = new Interval(t0, t1);
    //A = D.Mid;
# ---------- end c_script ----------
merge_2 = Merge(Data1=repeat, Data2=repeat_2)  # -> simplify(Result)
remap = RemapNumbers(Value=pdecon_2.XComponent, Source=bnd_2, Target=Domain(1, 0))  # -> Mapped, Clipped
remap_2 = RemapNumbers(Value=pdecon_2.YComponent, Source=c_script.A, Target="-90 to 90")  # -> Mapped, Clipped
remap_3 = RemapNumbers(Value=pdecon_2.YComponent, Source=c_script.A, Target=Domain(0, 1))  # -> Mapped, Clipped
multiplication = Multiplication(A=merge_2, B=remap.Mapped)
multiplication_2 = Multiplication(A=remap_2.Mapped, B=remap_3.Mapped)
addition = Addition(A=multiplication, B=multiplication_2)
lng_3 = ListLength(List=orient_2.Geometry)
dup = DuplicateData(Data=addition, Number=lng_3, Order=True)
panel_2 = Panel(addition)
rad = Radians(Degrees=dup)
prot = RotatePlane(Plane=orient_2.Geometry, Angle=rad)
deplane_2 = DeconstructPlane(Plane=prot)  # -> Origin, XAxis, YAxis, ZAxis
pt_6 = Point(deplane_2.Origin)
vec = Vector(deplane_2.ZAxis)
txt = Text(_3x_drilling.Feed)
num = Number(dup)
pline_2 = PolyLine(Vertices=flatten(prot), Closed=False)
nc_r = NCGenerationRobomove(Points=pt_6, Vectors=vec, Rotation=num, Feed=txt, Settings=nc_settings)

nc = NCGeneration(Points=pt_6, Vectors=vec, Feed=txt, Settings=nc_settings)
panel_3 = Panel(nc_r)

preview_3 = CustomPreview(Geometry=pline_2, Material=ColourSwatch(SwatchColor=RGB(0, 255, 238)))
iframe = InterpolateFrames(Frames=flatten(prot), Length=Slider(1, range=0..1), Step=10, Reset=Toggle(True))  # -> Frame, Percent, CurrentIndex
robot_ik = RobotInverseKinematics(Robot=kuka_kr_125_2, TargetTCPFrame=iframe.Frame, AxisToggles=[False, False, False], useColorPreview=True)  # -> PoseGeometry, AxisValues, AxisFrames
