# Grasshopper definition Shingle_shell-CAM-3-Pockets-5X_surface.gh (Grasshopper 1.0.7)
# plug-ins: Sandbox, VirtualRobot.Grasshopper

toggle = BooleanToggle(False)
brep = Brep([<brep referenced from the Rhino model> x16])
brep_2 = Brep(<brep referenced from the Rhino model>)
brep_3 = Brep([<brep referenced from the Rhino model> x31])
brep_4 = Brep([<brep referenced from the Rhino model> x4])
brep_5 = Brep([<brep referenced from the Rhino model> x32])
brep_6 = Brep([<brep referenced from the Rhino model> x2])
brep_7 = Brep([<brep referenced from the Rhino model> x30])
brep_8 = Brep([<brep referenced from the Rhino model> x3])
brep_9 = Brep([<brep referenced from the Rhino model> x11])
brep_10 = Brep([<brep referenced from the Rhino model> x2])
filter = StreamFilter(Gate=toggle, Stream0=brep_7, Stream1=brep_8)
filter_2 = StreamFilter(Gate=toggle, Stream0=brep_9, Stream1=brep_10)
filter_3 = StreamFilter(Gate=toggle, Stream0=brep_3, Stream1=brep_4)
filter_4 = StreamFilter(Gate=toggle, Stream0=brep_5, Stream1=brep_6)
filter_5 = StreamFilter(Gate=toggle, Stream0=brep, Stream1=brep_2)

# ---- group: Sheet-4
brep_11 = Brep(filter)

# ---- group: Sheet-5
brep_12 = Brep(filter_2)

# ---- group: Sheet-3
brep_13 = Brep(filter_4)

# ---- group: Sheet-2
brep_14 = Brep(filter_3)

# ---- group: Sheet-1
brep_15 = Brep(filter_5)

# ----
# SELECT SURFACES TO WORK ON
brep_16 = Brep(brep_15)
debrep = DeconstructBrep(Brep=brep_16)  # -> Faces, Edges, Vertices
evalsrf = EvaluateSurface(Surface=reparameterize(debrep.Faces), Point=Point(0.5, 0.5, 0))  # -> Point, Normal, Frame
Z = UnitZ(Factor=1)
angle = Angle(VectorA=evalsrf.Normal, VectorB=Z)  # -> Angle, Reflex
smaller = SmallerThan(FirstNumber=angle.Angle, SecondNumber=Slider(0.25, range=0..1))  # -> SmallerThan, OrEqualTo
cull = CullPattern(List=debrep.Faces, CullPattern=smaller.SmallerThan)
area = Area(Geometry=cull)  # -> Area, Centroid
sort = SortList(Keys=area.Area, ValuesA=cull)  # -> Keys, ValuesA
panel = Panel("""1
2""")
item = ListItem(List=sort.ValuesA, Index=panel, Wrap=True)
item_2 = ListItem(List=sort.ValuesA, Index=0, Wrap=True)

item_3 = ListItem(List=sort.ValuesA, Index=0, Wrap=True)
filter_6 = StreamFilter(Gate=toggle, Stream0=item, Stream1=item_3)

srf = Surface(item_2)
explode = Explode(Curve=srf, Recursive=True)  # -> Segments, Vertices
join = JoinCurves(Curves=explode.Segments, Preserve=False)
offset = Offset(Curve=join, Distance="12", Plane=PlaneXY(0, 0, 0), Corners=1)
rad = Radians(Degrees=10)
topoly = CurveToPolyline(Curve=offset, ToleranceDistance=0, ToleranceAngle=rad)  # -> Polyline, Segments
disc = Discontinuity(Curve=topoly.Polyline, Level=1)  # -> Points, Parameters
hull = ConvexHull(Points=disc.Points, Plane=PlaneXY(0, 0, 0))  # -> Hull, HullZ, Indices
dup = DuplicateData(Data=hull.Hull, Number=2, Order=True)  # -> simplify(Data)
crv = Curve(simplify(graft(dup)))

# ----
# REBUILD SURFACES
srf_2 = Surface(filter_6)
c_script = CSharpScript(S=srf_2)  # -> out, A; inputs S: Brep
# ---------- c_script: C# ----------
    if (S.Faces.ShrinkFaces()){
      Print("Shrink, shrank, shrunk");
    }else{
      Print("Doo");
    }
    S.Faces.Flip(true);

    A = S;
# ---------- end c_script ----------
evalsrf_2 = EvaluateSurface(Surface=reparameterize(c_script.A), Point=Point(0.5, 0.5, 0))  # -> Point, Normal, Frame
area_2 = Area(Geometry=c_script.A)  # -> Area, Centroid
srf_3 = Surface(simplify(graft(c_script.A)))
vdis = VectorDisplay(Anchor=area_2.Centroid, Vector=evalsrf_2.Normal)
pl_origin = PlaneOrigin(Base=evalsrf_2.Frame, Origin=area_2.Centroid)

# ----
# SELECT DATUM LINES
srf_4 = Surface(srf_3)
evalsrf_3 = EvaluateSurface(Surface=reparameterize(srf_4), Point=Point(0.5, 0.5, 0))  # -> Point, Normal, Frame
explode_2 = Explode(Curve=srf_4, Recursive=True)  # -> Segments, Vertices
eval = EvaluateLength(Curve=explode_2.Segments, Length=0.5, Normalized=True)  # -> simplify(Point), Tangent, Parameter
vdis_2 = VectorDisplay(Anchor=evalsrf_3.Point, Vector=evalsrf_3.Normal)
plcoord = PlaneCoordinates(Point=eval.Point, System=evalsrf_3.Frame)  # -> XCoordinate, YCoordinate, ZCoordinate
sort_2 = SortList(Keys=plcoord.YCoordinate, ValuesA=explode_2.Segments)  # -> Keys, ValuesA
item_4 = ListItem(List=sort_2.ValuesA, Index=0, Wrap=True)

crv_2 = Curve(simplify(graft(crv)))
xy = XYPlane(Origin=Point(0, 0, 0))
pln = Plane(pl_origin)
deplane = DeconstructPlane(Plane=pln)  # -> Origin, XAxis, YAxis, ZAxis
amp = Amplitude(Vector=deplane.ZAxis, Amplitude="2")  # -> graft(Vector)
pt = Point(Point(-366, -9961, 0))
xy_2 = XYPlane(Origin=pt)
pt_2 = Point(Point(892.057, -1496.839, 113))
panel_2 = Panel(pt_2)
X = UnitX(Factor=1)
sframe = SetFrame(XYZLocation="{976.06,-1406.37,135.86}", ABCOrientation="0,0,0")
brep_17 = Brep(brep_16)
y_threshold = Slider(200, range=-1000..1000)

tool_no = Panel("1")
spindle_speed_rpm = Panel("12000")
feed_mm_min = Panel("4000")
nc_settings = NCSettings(Tool=tool_no, Speed=spindle_speed_rpm, Feed=feed_mm_min)

# ----
# GENERATE TOOL PATHS
srf_5 = Surface(simplify(srf_3))
crv_3 = Curve(simplify(item_4))
eval_2 = EvaluateLength(Curve=crv_3, Length=0.5, Normalized=True)  # -> Point, Tangent, Parameter
pl = PlaneNormal(Origin=eval_2.Point, ZAxis=eval_2.Tangent)
sec = BrepPlane(Brep=srf_5, Plane=pl)  # -> simplify(Curves), Points
crv_4 = Curve(crv_2)
xy_3 = XYPlane(Origin=Point(0, 0, 0))
offset_2 = Offset(Curve=crv_4, Distance=-1.5, Plane=PlaneXY(0, 0, 0), Corners=1)

eval_3 = EvaluateLength(Curve=sec.Curves, Length=0.5, Normalized=True)  # -> Point, Tangent, Parameter

vec2pt = Vector2Pt(PointA=eval_2.Point, PointB=eval_3.Point, Unitize=False)  # -> simplify(Vector), Length
contour = Contour(Shape=srf_5, Point=eval_2.Point, Direction=vec2pt.Vector, Distance="9.5")
vdis_3 = VectorDisplay(Anchor=graft(eval_2.Point), Vector=vec2pt.Vector)
pshift = ShiftPaths(Data=contour, Offset=-1)
cull_i = CullIndex(List=pshift, Indices=0, Wrap=True)
ext = ExtendCurve(Curve=cull_i, Type=0, Start="9.5", End="9.5")  # -> simplify(Curve)

path_mapper = PathMapper(ext, source="{A;B}", target="{Floor(B/2);A}")
trim = TrimWithRegion(Curve=path_mapper, Region=crv_2, Plane=xy)  # -> Inside, Outside
pshift_2 = ShiftPaths(Data=trim.Outside, Offset=-1)

filter_7 = StreamFilter(Gate=toggle, Stream0=pshift_2, Stream1=ext)
dispatch = Dispatch(List=filter_7, DispatchPattern=[True, False])  # -> ListA, ListB
flip = FlipCurve(Curve=dispatch.ListB)  # -> Curve, Flag
weave = Weave(Pattern=[0, 1], Stream0=dispatch.ListA, Stream1=flip.Curve, NullGaps=False)
eval_4 = EvaluateLength(Curve=weave, Length=0.5, Normalized=True)  # -> Point, Tangent, Parameter
disc_2 = Discontinuity(Curve=weave, Level=1)  # -> Points, Parameters
pshift_3 = ShiftPaths(Data=disc_2.Points, Offset=-1)
points = PointList(Points=eval_4.Point)
vdis_4 = VectorDisplay(Anchor=eval_4.Point, Vector=eval_4.Tangent)
pline = PolyLine(Vertices=pshift_3, Closed=False)
trim_2 = TrimWithRegion(Curve=pline, Region=offset_2, Plane=xy_3)  # -> Inside, Outside
filter_8 = StreamFilter(Gate=toggle, Stream0=trim_2.Outside, Stream1=pline)  # -> simplify(Stream)

item_5 = ListItem(List=weave, Index=0, Wrap=True)
flip_2 = FlipCurve(Curve=item_5)  # -> Curve, Flag
eval_5 = EvaluateLength(Curve=flip_2.Curve, Length=0.5, Normalized=True)  # -> Point, Tangent, Parameter
move = Move(Geometry=filter_8, Motion=amp)  # -> simplify(Geometry), Transform
vdis_5 = VectorDisplay(Anchor=eval_5.Point, Vector=eval_5.Tangent)
merge = Merge(Data1=move.Geometry, Data2=filter_8)
merge_2 = Merge(Data1=merge, Data2=flip_2.Curve)

crv_5 = Curve(merge_2)

lng = ListLength(List=crv_5)
dup_2 = DuplicateData(Data=srf_3, Number=lng, Order=True)

# ----
# GENERATE CAM DATA
crv_6 = Curve(flatten(crv_5))
srf_6 = Surface(flatten(dup_2))
clearance_plane_mm = Panel("100")
pln_2 = Plane(xy_2)
_5x_srf_contour = _5XSurfaceContour(Polyline=crv_6, Surface=srf_6, ClearanceOffset=clearance_plane_mm, Base=pln_2)  # -> Points, Vectors, Feed

item_6 = ListItem(List=merge_2, Index=Slider(0, range=0..10), Wrap=True)
pt_3 = Point(_5x_srf_contour.Points)
vec = Vector(_5x_srf_contour.Vectors)
pl_2 = PlaneNormal(Origin=pt_3, ZAxis=vec)
align = AlignPlane(Plane=pl_2, Direction=X)  # -> Plane, Angle
orient = Orient(Geometry=pt_3, Source=PlaneXY(0, 0, 0), Target=pln_2)  # -> Geometry, Transform
orient_2 = Orient(Geometry=brep_17, Source=pln_2, Target=sframe)  # -> Geometry, Transform
pline_2 = PolyLine(Vertices=flatten(orient.Geometry), Closed=False)
orient_3 = Orient(Geometry=align.Plane, Source=PlaneXY(0, 0, 0), Target=sframe)  # -> Geometry, Transform
deplane_2 = DeconstructPlane(Plane=orient_3.Geometry)  # -> Origin, XAxis, YAxis, ZAxis
avr = Average(Input=deplane_2.Origin)
preview = CustomPreview(Geometry=pline_2, Shader=ColourSwatch(SwatchColor=RGB(0, 255, 238)))
preview_2 = CustomPreview(Geometry=orient_2.Geometry, Shader=ColourSwatch(SwatchColor=RGBA(176, 176, 176, 148)))
pt_4 = Point(avr)
pdecon = Deconstruct(Point=pt_4)  # -> XComponent, YComponent, ZComponent
larger = LargerThan(FirstNumber=pdecon.YComponent, SecondNumber=y_threshold)  # -> LargerThan, OrEqualTo
dispatch_2 = Dispatch(List=avr, DispatchPattern=larger.LargerThan)  # -> ListA, ListB
lng_2 = ListLength(List=dispatch_2.ListB)
lng_3 = ListLength(List=dispatch_2.ListA)
bnd = Bounds(Numbers=flatten(pdecon.YComponent))
repeat = RepeatData(Data=Slider(90, range=-90..90), Length=lng_3)
repeat_2 = RepeatData(Data=Slider(-90, range=-90..90), Length=lng_2)
bnd_2 = Bounds(Numbers=flatten(pdecon.XComponent))
c_script_2 = CSharpScript(D=bnd)  # -> out, A
# ---------- c_script_2: C# ----------
    double t0 = D.T0;
    double t1 = D.T1;
    
    if (Math.Abs(t0) >= Math.Abs(t1)){
      Print("t0 larger or equal than t1");
      t1 = Math.Abs(t0);
    } else {
      Print("t1 larger than t0");
      t0 = Math.Abs(t1);
    }

    A = new Interval(t0, t1);
    //A = D.Mid;
# ---------- end c_script_2 ----------
merge_3 = Merge(Data1=repeat, Data2=repeat_2)  # -> simplify(Result)
remap = RemapNumbers(Value=pdecon.XComponent, Source=bnd_2, Target=Domain(1, 0))  # -> Mapped, Clipped
remap_2 = RemapNumbers(Value=pdecon.YComponent, Source=c_script_2.A, Target="-90 to 90")  # -> Mapped, Clipped
remap_3 = RemapNumbers(Value=pdecon.YComponent, Source=c_script_2.A, Target=Domain(0, 1))  # -> Mapped, Clipped
multiplication = Multiplication(A=remap_2.Mapped, B=remap_3.Mapped)
multiplication_2 = Multiplication(A=merge_3, B=remap.Mapped)
lng_4 = ListLength(List=orient_3.Geometry)
addition = Addition(A=multiplication_2, B=multiplication)
filter_9 = StreamFilter(Gate=Slider(2, range=0..2), Stream0=merge_3, Stream1=remap_2.Mapped, Stream2=addition)
dup_3 = DuplicateData(Data=filter_9, Number=lng_4, Order=True)
rad_2 = Radians(Degrees=dup_3)
panel_3 = Panel(filter_9)
prot = RotatePlane(Plane=orient_3.Geometry, Angle=rad_2)
deplane_3 = DeconstructPlane(Plane=prot)  # -> Origin, XAxis, YAxis, ZAxis
pt_5 = Point(deplane_3.Origin)
vec_2 = Vector(deplane_3.ZAxis)
num = Number(dup_3)
pline_3 = PolyLine(Vertices=flatten(prot), Closed=False)
preview_3 = CustomPreview(Geometry=pline_3, Shader=ColourSwatch(SwatchColor=RGB(0, 255, 238)))

ee = PredefinedSpindleEndEffector()
kuka_kr_125_2 = PredefinedKUKAKR1252(RobRootFrame=PlaneXY(0, 0, 0), EndEffectorOptional=ee)
iframe = InterpolateFrames(Frames=flatten(prot), Length=Slider(1, range=0..1), Step=10, Reset=Toggle(True))  # -> Frame, Percent, CurrentIndex

robot_ik = RobotInverseKinematics(Robot=kuka_kr_125_2, TargetTCPFrame=iframe.Frame, AxisToggles=[False, False, False], useColorPreview=True)  # -> PoseGeometry, AxisValues, AxisFrames

txt = Text(_5x_srf_contour.Feed)
nc = NCGeneration(Points=pt_5, Vectors=vec_2, Feed=txt, Settings=nc_settings)

nc_r = NCGenerationRobomove(Points=pt_5, Vectors=vec_2, Rotation=num, Feed=txt, Settings=nc_settings)

panel_4 = Panel(nc_r)
