# Grasshopper definition Shingle_shell-CAM-4-Islands-5X_surface.gh (Grasshopper 1.0.7)
# plug-ins: Sandbox, VirtualRobot.Grasshopper

# ---- group: Sheet-4
brep = Brep([<brep referenced from the Rhino model> x30])

# ---- group: Sheet-3
brep_2 = Brep([<brep referenced from the Rhino model> x32])

# ---- group: Sheet_5
brep_3 = Brep([<brep referenced from the Rhino model> x11])

# ---- group: Sheet-2
brep_4 = Brep([<brep referenced from the Rhino model> x31])

# ---- group: Sheet-1
brep_5 = Brep([<brep referenced from the Rhino model> x16])

# ----
# SELECT SURFACES TO WORK ON
brep_6 = Brep(brep_5)
debrep = DeconstructBrep(Brep=brep_6)  # -> Faces, Edges, Vertices
evalsrf = EvaluateSurface(Surface=debrep.Faces, Point=Point(0.5, 0.5, 0))  # -> Point, Normal, UDirection, VDirection, Frame
Z = UnitZ(Factor=1)
angle = Angle(VectorA=evalsrf.Normal, VectorB=Z)  # -> Angle, Reflex
smaller = SmallerThan(FirstNumber=angle.Angle, SecondNumber=Slider(0.25, range=0..1))  # -> SmallerThan, OrEqualTo
cull = CullPattern(List=debrep.Faces, CullPattern=smaller.SmallerThan)
area = Area(Geometry=cull)  # -> Area, Centroid
sort = SortList(Keys=area.Area, ValuesA=cull)  # -> Keys, ValuesA
panel = Panel("""1
2""")
item = ListItem(List=sort.ValuesA, Index=panel, Wrap=True)
item_2 = ListItem(List=sort.ValuesA, Index=0, Wrap=True)

srf = Surface(item)
c_script = CSharpScript(S=srf)  # -> out, A; inputs S: Brep
# ---------- c_script: C# ----------
    if (S.Faces.ShrinkFaces()){
      Print("Shrink, shrank, shrunk");
    }else{
      Print("Doo");
    }
    S.Faces.Flip(true);

    A = S;
# ---------- end c_script ----------
evalsrf_2 = EvaluateSurface(Surface=reparameterize(c_script.A), Point=Point(0.5, 0.5, 0))  # -> Point, Normal, Frame
area_2 = Area(Geometry=c_script.A)  # -> Area, Centroid
vdis = VectorDisplay(Anchor=area_2.Centroid, Vector=evalsrf_2.Normal)
pl_origin = PlaneOrigin(Base=evalsrf_2.Frame, Origin=area_2.Centroid)  # -> graft(Plane)
srf_2 = Surface(simplify(graft(c_script.A)))

explode = Explode(Curve=srf_2, Recursive=True)  # -> Segments, Vertices
pln = Plane(pl_origin)
join = JoinCurves(Curves=explode.Segments, Preserve=False)
disc = Discontinuity(Curve=join, Level=1)  # -> Points, Parameters
shatter = Shatter(Curve=join, Parameters=disc.Parameters)
# GENERATE TOOL PATHS
panel_2 = Panel("0.1")
c_script_2 = CSharpScript(C=shatter, tol=panel_2)  # -> out, A; inputs C: Curve, tol: Double
# ---------- c_script_2: C# ----------
    bool result = true;
    //double tol = 0.1;

    if (C.IsLinear(tol)) {
      result = false;
    }

    A = result;
# ---------- end c_script_2 ----------
cull_2 = CullPattern(List=shatter, CullPattern=c_script_2.A)  # -> simplify(List)
c_script_3 = CSharpScript(C=cull_2)  # -> out, A; inputs C: Curve
# ---------- c_script_3: C# ----------
    CurveOrientation myOrientation = CurveOrientation.CounterClockwise;

    if (C.ClosedCurveOrientation(Plane.WorldXY) == myOrientation) {
      C.Reverse();
    }

    A = C;
# ---------- end c_script_3 ----------
rad = Radians(Degrees=10)
offset = Offset(Curve=c_script_3.A, Distance="9.5", Plane=pln, Corners=1)  # -> simplify(Curve)
topoly = CurveToPolyline(Curve=offset, ToleranceDistance=0, ToleranceAngle=rad)  # -> Polyline, Segments
disc_2 = Discontinuity(Curve=topoly.Polyline, Level=1)  # -> simplify(Points), Parameters
deplane = DeconstructPlane(Plane=pln)  # -> Origin, XAxis, YAxis, ZAxis
pline = PolyLine(Vertices=disc_2.Points, Closed=False)
amp = Amplitude(Vector=deplane.ZAxis, Amplitude="2")  # -> simplify(Vector)
crv = Curve(pline)
move = Move(Geometry=crv, Motion=amp)  # -> Geometry, Transform
flip = FlipCurve(Curve=move.Geometry)  # -> Curve, Flag
weave = Weave(Pattern=[0, 1], Stream0=flip.Curve, Stream1=crv, NullGaps=False)
lng = ListLength(List=weave)
dup = DuplicateData(Data=srf_2, Number=lng, Order=True)  # -> simplify(Data)
pt = Point(Point(-366, -9961, 0))
xy = XYPlane(Origin=pt)

# ----
# GENERATE CAM DATA
clearance_plane_mm = Panel("100")
crv_2 = Curve(flatten(weave))
srf_3 = Surface(flatten(dup))
pln_2 = Plane(xy)
_5x_srf_contour = _5XSurfaceContour(Polyline=crv_2, Surface=srf_3, ClearanceOffset=clearance_plane_mm, Base=pln_2)  # -> Points, Vectors, Feed

pt_2 = Point(Point(892.057, -1496.839, 113))
panel_3 = Panel(pt_2)
pt_3 = Point(_5x_srf_contour.Points)
vec = Vector(_5x_srf_contour.Vectors)
brep_7 = Brep(brep_6)
orient = Orient(Geometry=pt_3, Source=PlaneXY(0, 0, 0), Target=pln_2)  # -> Geometry, Transform
X = UnitX(Factor=1)
sframe = SetFrame(XYZLocation="{976.06,-1406.37,135.86}", ABCOrientation="0,0,0")
pl = PlaneNormal(Origin=pt_3, ZAxis=vec)
orient_2 = Orient(Geometry=brep_7, Source=pln_2, Target=sframe)  # -> Geometry, Transform
pline_2 = PolyLine(Vertices=flatten(orient.Geometry), Closed=False)
align = AlignPlane(Plane=pl, Direction=X)  # -> Plane, Angle
preview = CustomPreview(Geometry=orient_2.Geometry, Shader=ColourSwatch(SwatchColor=RGBA(176, 176, 176, 148)))
preview_2 = CustomPreview(Geometry=pline_2, Shader=ColourSwatch(SwatchColor=RGB(0, 255, 238)))
orient_3 = Orient(Geometry=align.Plane, Source=PlaneXY(0, 0, 0), Target=sframe)  # -> Geometry, Transform
deplane_2 = DeconstructPlane(Plane=orient_3.Geometry)  # -> Origin, XAxis, YAxis, ZAxis
avr = Average(Input=deplane_2.Origin)
pt_4 = Point(avr)
y_threshold = Slider(200, range=-1000..1000)
pdecon = Deconstruct(Point=pt_4)  # -> XComponent, YComponent, ZComponent
larger = LargerThan(FirstNumber=pdecon.YComponent, SecondNumber=y_threshold)  # -> LargerThan, OrEqualTo
dispatch = Dispatch(List=avr, DispatchPattern=larger.LargerThan)  # -> ListA, ListB
lng_2 = ListLength(List=dispatch.ListB)
lng_3 = ListLength(List=dispatch.ListA)
bnd = Bounds(Numbers=flatten(pdecon.YComponent))
repeat = RepeatData(Data=Slider(90, range=-90..90), Length=lng_3)
repeat_2 = RepeatData(Data=Slider(-90, range=-90..90), Length=lng_2)
bnd_2 = Bounds(Numbers=flatten(pdecon.XComponent))
c_script_4 = CSharpScript(D=bnd)  # -> out, A
# ---------- c_script_4: C# ----------
    double t0 = D.T0;
    double t1 = D.T1;
    
    if (Math.Abs(t0) >= Math.Abs(t1)){
      Print("t0 larger or equal than t1");
      t1 = Math.Abs(t0);
    } else {
      Print("t1 larger than t0");
      t0 = Math.Abs(t1);
    }

    A = new Interval(t0, t1);
    //A = D.Mid;
# ---------- end c_script_4 ----------
merge = Merge(Data1=repeat, Data2=repeat_2)  # -> simplify(Result)
remap = RemapNumbers(Value=pdecon.XComponent, Source=bnd_2, Target=Domain(1, 0))  # -> Mapped, Clipped
remap_2 = RemapNumbers(Value=pdecon.YComponent, Source=c_script_4.A, Target="-90 to 90")  # -> Mapped, Clipped
remap_3 = RemapNumbers(Value=pdecon.YComponent, Source=c_script_4.A, Target=Domain(0, 1))  # -> Mapped, Clipped
multiplication = Multiplication(A=remap_2.Mapped, B=remap_3.Mapped)
multiplication_2 = Multiplication(A=merge, B=remap.Mapped)
lng_4 = ListLength(List=orient_3.Geometry)
addition = Addition(A=multiplication_2, B=multiplication)

tool_no = Panel("1")
spindle_speed_rpm = Panel("12000")
feed_mm_min = Panel("4000")
nc_settings = NCSettings(Tool=tool_no, Speed=spindle_speed_rpm, Feed=feed_mm_min)

filter = StreamFilter(Gate=Slider(2, range=0..2), Stream0=merge, Stream1=remap_2.Mapped, Stream2=addition)
dup_2 = DuplicateData(Data=filter, Number=lng_4, Order=True)
rad_2 = Radians(Degrees=dup_2)
panel_4 = Panel(filter)
prot = RotatePlane(Plane=orient_3.Geometry, Angle=rad_2)
num = Number(dup_2)
pline_3 = PolyLine(Vertices=flatten(prot), Closed=False)
preview_3 = CustomPreview(Geometry=pline_3, Shader=ColourSwatch(SwatchColor=RGB(0, 255, 238)))

# ----
# SIMULATION
number_slider = Slider(0, range=0..1)
ee = PredefinedSpindleEndEffector()
kuka_kr_125_2 = PredefinedKUKAKR1252(RobRootFrame=PlaneXY(0, 0, 0), EndEffectorOptional=ee)
iframe = InterpolateFrames(Frames=flatten(prot), Length=number_slider, Step=10, Reset=Toggle(True))  # -> Frame, Percent, CurrentIndex

robot_ik = RobotInverseKinematics(Robot=kuka_kr_125_2, TargetTCPFrame=iframe.Frame, AxisToggles=[False, False, False], useColorPreview=True)  # -> PoseGeometry, AxisValues, AxisFrames

deplane_3 = DeconstructPlane(Plane=prot)  # -> Origin, XAxis, YAxis, ZAxis
txt = Text(_5x_srf_contour.Feed)
nc = NCGeneration(Points=deplane_3.Origin, Vectors=deplane_3.ZAxis, Feed=txt, Settings=nc_settings)

nc_r = NCGenerationRobomove(Points=deplane_3.Origin, Vectors=deplane_3.ZAxis, Rotation=num, Feed=txt, Settings=nc_settings)

panel_5 = Panel(nc_r)
