# Grasshopper definition CDDF_Winding_Setup_DKP.gh (Grasshopper 1.0.7)
# plug-ins: Virtual Robot

panel = Panel("""0B
2A
4B
6A
8B
8A
6B
4A
2B
0A""")

pointsframea = Point([Point(199.4644784, -2511.943358, 1161.238025), Point(294.8431906, -2477.228163, 1161.238025), Point(372.5965672, -2411.985108, 1161.238025), Point(423.3464033, -2324.083469, 1161.238025), Point(440.9715177, -2224.125484, 1161.238025), Point(423.3460635, -2124.167558, 1161.238025), Point(372.5959299, -2036.266092, 1161.238025), Point(294.8423302, -1971.023301, 1161.238025), Point(199.4635006, -1936.308429, 1161.238025)])
pointsframeb = Point([Point(199.4644784, -2511.943358, 1502.438025), Point(294.8431906, -2477.228163, 1502.438025), Point(372.5965672, -2411.985108, 1502.438025), Point(423.3464033, -2324.083469, 1502.438025), Point(440.9715177, -2224.125484, 1502.438025), Point(423.3460635, -2124.167558, 1502.438025), Point(372.5959299, -2036.266092, 1502.438025), Point(294.8423302, -1971.023301, 1502.438025), Point(199.4635006, -1936.308429, 1502.438025)])
dkp_rotation_point = Point(Point(148.714005, -2224.12598, 947.538025))
dkp_plane_reference_point = Point(Point(398.6188608, -2223.964285, 947.538025))
travel_offset = Slider(30, range=-50..100)
hooking_radius = Slider(50, range=-30..100)

entwine = Entwine(Branch00=pointsframea, Branch01=pointsframeb, FlattenInputs=True)
yz = YZPlane(Origin=dkp_rotation_point)

# ----
# Path Planning
c_travel = CSharpScript(anchorPts=simplify(entwine), syntax=panel, travelOffset=travel_offset, orientation=yz)  # -> out, travelPlns, syntaxPts, anchorPlns; inputs anchorPts: tree of Point3d, syntax: list of String, travelOffset: Double, orientation: Plane
# ---------- c_travel: C# usings ----------
using System.Linq;
# ---------- c_travel: C# ----------
    // create Planes & Polyline
    List<Point3d> polyPoints = new List<Point3d>();
    List<Plane> anchorPlanes = new List<Plane>();

    for (int i = 0; i < syntax.Count - 1; i++)
    {
      // get both endpoints of segment
      string segStart = syntax[i];
      string segEnd = syntax[i + 1];

      //split string & cast to number
      var digitsStart = segStart.Where(c => Char.IsDigit(c));
      var digitsEnd = segEnd.Where(c => Char.IsDigit(c));

      // Execute the second query
      string digitStart = "";
      foreach (char c in digitsStart)
        digitStart += c;
      int indStart = int.Parse(digitStart);

      string digitEnd = "";
      foreach (char c in digitsEnd)
        digitEnd += c;
      int indEnd = int.Parse(digitEnd);

      //get points
      Point3d startPl = new Point3d();
      Point3d endPl = new Point3d();

      for(int j = 0; j < anchorPts.BranchCount; j++)
      {
        if(segStart.Contains(Number2Alphabet(j, true)))
        {
          startPl = anchorPts.Branch(j)[indStart];
        }
        if(segEnd.Contains(Number2Alphabet(j, true)))
        {
          endPl = anchorPts.Branch(j)[indEnd];
        }
      }

      polyPoints.Add(startPl);
      if (i == syntax.Count - 2)
        polyPoints.Add(endPl);
    }

    Surface s = null;

    if(anchorPts.BranchCount == 2)
    {
      // create expected surface
      List<Curve> edgeCurves = new List<Curve>();


      Curve a = Curve.CreateInterpolatedCurve(anchorPts.Branch(0), 3);
      edgeCurves.Add(a);
      Curve b = Curve.CreateInterpolatedCurve(anchorPts.Branch(1), 3);
      edgeCurves.Add(b);

      Brep brep = Brep.CreateFromLoft(edgeCurves, Point3d.Unset, Point3d.Unset, LoftType.Tight, false)[0];
      s = brep.Faces[0];
    }

    DataTree<Plane> windingPlanes = new DataTree<Plane>();


    for (int i = 0; i < syntax.Count - 1; i++)
    {
      Vector3d vec = polyPoints[i] - polyPoints[i + 1];
      LineCurve ln = new LineCurve(polyPoints[i], polyPoints[i + 1]);

      if(anchorPts.BranchCount == 2)
      {
        double u;
        double v;
        double u1;
        double v1;

        s.ClosestPoint(polyPoints[i], out u, out v);
        s.ClosestPoint(polyPoints[i + 1], out u1, out v1);
        Plane anchorPln = new Plane(polyPoints[i], s.NormalAt(u, v));

        anchorPlanes.Add(anchorPln);

        double[] crvParams = ln.DivideByCount(4, false);
        windingPlanes.Add(new Plane(ln.PointAt(crvParams[0]) + s.NormalAt(u, v) * -travelOffset, Plane.WorldXY.ZAxis, Vector3d.CrossProduct(Plane.WorldXY.ZAxis, s.NormalAt(u, v))), new GH_Path(i));
        windingPlanes.Add(new Plane(ln.PointAt(crvParams[2]) + s.NormalAt(u1, v1) * -travelOffset, Plane.WorldXY.ZAxis, Vector3d.CrossProduct(Plane.WorldXY.ZAxis, s.NormalAt(u1, v1))), new GH_Path(i));
      }
      else
      {
        Plane anchorPln = new Plane(polyPoints[i], Plane.WorldXY.ZAxis);

        anchorPlanes.Add(anchorPln);

        double[] crvParams = ln.DivideByCount(4, false);
        windingPlanes.Add(new Plane(ln.PointAt(crvParams[0]) + new Vector3d(0.0, 0.0, travelOffset), orientation.Normal), new GH_Path(i));
        windingPlanes.Add(new Plane(ln.PointAt(crvParams[2]) + new Vector3d(0.0, 0.0, travelOffset), orientation.Normal), new GH_Path(i));
      }
    }

    if(anchorPts.BranchCount == 2)
    {
      double u2;
      double v2;
      s.ClosestPoint(polyPoints[syntax.Count - 1], out u2, out v2);

      anchorPlanes.Add(new Plane(polyPoints[syntax.Count - 1], s.NormalAt(u2, v2)));
    }
    else
    {
      anchorPlanes.Add(new Plane(polyPoints[syntax.Count - 1], Plane.WorldXY.ZAxis));
    }

    //outputs
    travelPlns = windingPlanes;
    syntaxPts = polyPoints;
    anchorPlns = anchorPlanes;
# ---------- c_travel: C# additional code ----------
  public static string Number2Alphabet(int number, bool isCaps)
  {
    Char c = (Char) ((isCaps ? 65 : 97) + number);

    return c.ToString();
  }
# ---------- end c_travel ----------
lng = ListLength(List=panel)
dup = DuplicateData(Data="U", Number=lng, Order=True)
c_hooking = CSharpScript(
    syntaxPts=c_travel.syntaxPts,
    hookingTypes=dup,
    anchorPlns=c_travel.anchorPlns,
    hookingRadius=hooking_radius,
    travelPlns=c_travel.travelPlns)  # -> out, hookingPlns; inputs syntaxPts: list of Point3d, hookingTypes: list of String, anchorPlns: list of Plane, hookingRadius: Double, travelPlns: tree of Plane
# ---------- c_hooking: C# ----------
    DataTree<Plane> hookingPlanes = new DataTree<Plane>();

    for (int i = 0; i < syntaxPts.Count; i++)
    {
      hookingPlanes.AddRange(HookingMotion(syntaxPts[i], hookingTypes[i], anchorPlns[i], travelPlns, hookingRadius, i), new GH_Path(i));
    }

    hookingPlns = hookingPlanes;
# ---------- c_hooking: C# additional code ----------
  public List<Plane> HookingMotion(Point3d origin, string hookingType, Plane anchorPln, DataTree<Plane> travelSegments, double hookingRadius, int id)
  {
    List<Plane> hookingPlanes = new List<Plane>();

    Point3d startPt = Point3d.Unset;
    Point3d endPt = Point3d.Unset;
    Point3d startPtremapped;

    Plane xy = anchorPln;
    Vector3d start = new Vector3d();
    Vector3d end = new Vector3d();
    double angle = 0;


    if (id == 0)
    {
      endPt = travelSegments.Branch(id)[0].Origin;
      end = xy.Origin - endPt;
      start = new Vector3d(end);
      start.Reverse();
      angle = 2 * Math.PI;
    }

    else if (id > travelSegments.BranchCount - 1)
    {
      startPt = travelSegments.Branch(id - 1)[1].Origin;
      start = xy.Origin - startPt;
      end = new Vector3d(start);
      end.Reverse();
      angle = 2 * Math.PI;
    }

    if (id > 0 && id < travelSegments.BranchCount) {

      startPt = travelSegments.Branch(id - 1)[1].Origin;
      endPt = travelSegments.Branch(id)[0].Origin;

      start = xy.Origin - startPt;
      end = xy.Origin - endPt;
      angle = 2 * Math.PI - Vector3d.VectorAngle(start, end);
    }

    double _s;
    double _t;
    xy.ClosestParameter(startPt, out _s, out _t);
    startPtremapped = xy.PointAt(_s, _t);
    Vector3d xDir = startPtremapped - origin;
    Vector3d zDir = anchorPln.Normal;
    Vector3d yDir = Vector3d.CrossProduct(xDir, zDir);

    xy = new Plane(origin, xDir, yDir);

    //map endpoint - check y value, needs to be negative
    double sEnd;
    double tEnd;
    xy.ClosestParameter(endPt, out sEnd, out tEnd);

    if (tEnd > 0)
    {
      yDir = -1 * Vector3d.CrossProduct(xDir, zDir);
      xy = new Plane(origin, xDir, yDir);
    }

    int steps = 4;

    double increment = angle / steps;

    for (int i = 0; i < steps; i++)
    {
      // need to set correct starting point! rotate plane!
      double t = increment * i;

      double a = Math.Cos(t) * (hookingRadius);
      double b = Math.Sin(t) * (hookingRadius);

      Point3d pt = new Point3d(a * xy.XAxis + b * xy.YAxis) + origin;      //hookingPoints.Add(pt);

      Point3d centerPj = new Point3d(Plane.WorldXY.Origin.X, Plane.WorldXY.Origin.Y, pt.Z);

      // fix hardcoded vector
      Vector3d x = new Vector3d(0, 0, -1);
      Vector3d z = anchorPln.Normal;
      Vector3d offsetVec = new Vector3d(z);
      offsetVec.Unitize();
      offsetVec *= hookingRadius;
      Vector3d y = Vector3d.CrossProduct(x, z);

      Plane hookingPln = Plane.Unset;

      /*if(i == 1 || i == 2)
      {
        hookingPln = new Plane(pt, x, y);
      }
      else
      {
        hookingPln = new Plane(pt + z * 15 , x, y);
      }*/

      if(id == 0 && i == 0)
      {
        Plane approachPln = new Plane(pt + z * -120, x, y);
        hookingPlanes.Add(approachPln);
      }

      // fix hardcoded vectors
      if(id == 0 && i == 0)
      {
        hookingPln = new Plane(pt + y * hookingRadius, x, y);
      }
      else if(id == 0 && i == 1)
      {
        hookingPln = new Plane(pt - x * hookingRadius, x, y);
      }
      else if(id == 0 && i == 2)
      {
        hookingPln = new Plane(pt - y * hookingRadius, x, y);
      }
      else if(id == 0 && i == 3)
      {
        hookingPln = new Plane(pt + x * hookingRadius, x, y);
      }
      else
      {
        hookingPln = new Plane(pt, x, y);
      }

      hookingPlanes.Add(hookingPln);

      if(id == travelSegments.BranchCount && i == steps - 1)
      {
        Plane approachPln = new Plane(pt + z * -120, x, y);
        hookingPlanes.Add(approachPln);
      }
    }

    if(hookingType == "X") hookingPlanes.Reverse();

    return hookingPlanes;
  }
# ---------- end c_hooking ----------
split = SplitTree(Data=c_hooking.hookingPlns, Masks=flatten("{0,2,...}"))  # -> Positive, Negative
prot = RotatePlane(Plane=c_travel.travelPlns, Angle=degrees(Slider(90, range=-91..180)))
prot_2 = RotatePlane(Plane=split.Positive, Angle=degrees(Slider(-90, range=-90..180)))
prot_3 = RotatePlane(Plane=split.Negative, Angle=degrees(Slider(-90, range=-180..180)))
merge = Merge(Data1=prot_2, Data2=prot_3)
c_fiber_path = CSharpScript(travelPlns=prot, hookingPlns=merge)  # -> out, windingPlns, pathCurve; inputs travelPlns: tree of Plane, hookingPlns: tree of Plane
# ---------- c_fiber_path: C# ----------
    List<Plane> plns = new List<Plane>();

    for (int i = 0; i <= travelPlns.BranchCount; i++)
    {
      if(i < travelPlns.BranchCount)
      {
        plns.AddRange(hookingPlns.Branch(i));
        if(travelPlns.Branch(i)[0].Origin.DistanceTo(travelPlns.Branch(i)[1].Origin) > 150)
        {
          plns.AddRange(travelPlns.Branch(i));
        }
      }
      else if(i == travelPlns.BranchCount)
      {
        plns.AddRange(hookingPlns.Branch(i));
      }
    }

    // construct polyline
    List<Point3d> polyPoints = new List<Point3d>();

    foreach (Plane p in plns)
    {
      polyPoints.Add(p.Origin);
    }

    Polyline pl = new Polyline(polyPoints);

    windingPlns = plns;
    pathCurve = pl;
# ---------- end c_fiber_path ----------
c_dkp = CSharpScript(pathPlanes=c_fiber_path.windingPlns, rotationAxis=dkp_rotation_point, refPt=dkp_plane_reference_point)  # -> out, rotatedPlanes, angle; inputs pathPlanes: list of Plane, rotationAxis: Plane, refPt: Point3d
# ---------- c_dkp: C# ----------
    List<Plane> rotFiberPath = new List<Plane>();
    List<double> ext = new List<double>();

    bool isFirst = false;
    int id = 0;

    for (int i = 0; i < pathPlanes.Count; i++)
    {
      double ang;
      if (i == 0) // first plane, rotate around raw angle from 0 to ref
      {
        isFirst = true;
        ang = 0;
      } else
      {
        isFirst = false;
        ang = ext[i - 1];
      }

      id = i;
      Plane pln = pathPlanes[i];
      double angleDiff = Rhino.RhinoMath.ToDegrees(getRotValues(pln, rotationAxis.Origin, refPt, isFirst, pathPlanes, id));
      ang += angleDiff;
      ext.Add(ang);
      rotFiberPath.Add(rotatePlane(pln, rotationAxis.Origin, Rhino.RhinoMath.ToRadians(ang)));
    }

    //output
    rotatedPlanes = rotFiberPath;
    angle = ext;
# ---------- c_dkp: C# additional code ----------
  public double getRotValues(Plane pln, Point3d rotOrigin, Point3d dkpRef, bool isFirst, List<Plane> fiberPath, int ind)
  {

    Point3d plnProj = new Point3d(pln.Origin.X, pln.Origin.Y, rotOrigin.Z);
    Vector3d plnLoc = new Vector3d(rotOrigin) - new Vector3d(plnProj);
    Vector3d dkpPlane = new Vector3d(rotOrigin) - new Vector3d(dkpRef);
    Vector3d axis = new Vector3d(rotOrigin.X, rotOrigin.Y, 1);

    // create rotation plane
    Vector3d y = Vector3d.CrossProduct(dkpPlane, axis);
    Plane rotPlane = Plane.WorldXY;

    double angle;

    if (isFirst)
    {
      angle = minPi(Vector3d.VectorAngle(plnLoc, dkpPlane, rotPlane));

    }
    else
    {
      // get previous wp

      Plane prev = fiberPath[ind - 1];

      // get angle difference between previous and current wp

      Point3d prevPlnProj = new Point3d(prev.OriginX, prev.OriginY, rotOrigin.Z);
      Vector3d prevPlnLoc = new Vector3d(rotOrigin) - new Vector3d(prevPlnProj);

      angle = minPi(Vector3d.VectorAngle(plnLoc, prevPlnLoc, rotPlane));
    }
    return angle;
  }

  public Plane rotatePlane(Plane pln, Point3d rotAxis, double angle)
  {

    pln.Transform(Transform.Rotation(angle, rotAxis));

    return pln;
  }

  public double minPi(double angle)
  {
    if (angle > Math.PI)
    {
      angle = angle - 2 * Math.PI;
    }
    return angle;
  }
# ---------- end c_dkp ----------

# ----
# End Effector
pt = Point(Point(-15487.94509, -3949.973942, -2.96))
pt_2 = Point(Point(-15110.80273, -3940.73584, 739.5223999))
tool_abc = Panel("0,-90,0")
vec2pt = Vector2Pt(PointA=pt, PointB=pt_2, Unitize=False)  # -> Vector, Length
sframe = SetFrame(XYZLocation=vec2pt.Vector, ABCOrientation=tool_abc)
tool_xyz = Panel(vec2pt.Vector)
tcp = PlaneOrigin(Base=sframe, Origin=pt_2)
flange = XYPlane(Origin=pt)
mesh = Mesh(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)
coord_display = CoordinateFrameDisplay(
    CoordinateFrame=tcp,
    ArrowLengths=[120, 120, 120],
    ArrowWidths=[1, 1, 1],
    ArrowColors=[RGB(139, 0, 0), RGB(0, 100, 0), RGB(0, 0, 139)])
end_effector = DefineEndEffector(Geometry=mesh, TCPFrame=tcp, MountingFrame=flange)
ee = PredefinedFibrePlacementEndEffector()

sframe_2 = SetFrame(XYZLocation=tool_xyz, ABCOrientation=tool_abc)

# ----
# ROBOT SIMULATION (WITH DKP ROTATION)
number_slider = Slider(0, range=0..59)
entwine_2 = Entwine(
    Branch00=pointsframea,
    Branch01=pointsframeb,
    Branch02=c_fiber_path.pathCurve,
    Branch03=c_fiber_path.windingPlns,
    FlattenInputs=True)
item = ListItem(List=c_dkp.angle, Index=number_slider, Wrap=True)
rotate = Rotate(Geometry=entwine_2, Angle=degrees(item), Plane=dkp_rotation_point)  # -> Geometry, Transform
kuka_kr_125_2 = PredefinedKUKAKR1252(RobRootFrame=PlaneXY(0, 0, 0), EndEffectorOptional=end_effector)
item_2 = ListItem(List=c_dkp.rotatedPlanes, Index=number_slider, Wrap=False)
robot_ik = RobotInverseKinematics(Robot=kuka_kr_125_2, TargetTCPFrame=item_2, AxisToggles=[False, False, False], useColorPreview=True)  # -> PoseGeometry, AxisValues

xy = XYPlane(Origin=Point(0, 0, 0))

# ---- group: KRL Generation
write_file = Button()
panel_2 = Panel("C:\Users\Fabian\Desktop\KRL\")

# Enter the part (module) name. This will also be the name of the files. The name must be unique on the KUKA drive and not start with a number. Max. 21 characters allowed.
# KRL GENERATION
velocity_cp_m_s = Slider(0.4, range=0..2)
panel_3 = Panel("""90
-90
60
0
45
0""")
velocity_ptp = Slider(20, range=0..100)
c_script = CSharpScript(
    WindingPlanes=c_dkp.rotatedPlanes,
    Name="TestWindingCorner",
    Home=panel_3,
    E1=c_dkp.angle,
    Vel_CP=velocity_cp_m_s,
    Vel_PTP=velocity_ptp,
    iBase=xy,
    Tool=sframe_2,
    robRoot=xy,
    Folder=panel_2,
    Write=write_file)  # -> KRL; inputs WindingPlanes: list of Plane, Name: String, Home: list of Double, E1: list of Double, E2: list of Double, Vel_CP: Double, Vel_PTP: Double, iBase: Plane, Tool: Plane, robRoot: Plane, Folder: String, Write: Boolean
# ---------- c_script: C# ----------
    List<string> krlCode = new List<string>();

    krlCode.Add("DEF " + Name + "()");

    krlCode.Add(";------- Declaration section -------");
    krlCode.Add(";FOLD DECL");
    krlCode.Add("DECL E6AXIS HOME");
    krlCode.Add(";ENDFOLD");
    krlCode.Add(";------- Initialization ---------");
    krlCode.Add("BAS (#INITMOV,0)");
    krlCode.Add("BAS(#VEL_PTP, " + Vel_PTP + ")");
    krlCode.Add("$VEL.CP = " + Vel_CP);

    if(iBase == Plane.WorldXY)
    {
      krlCode.Add("$BASE = $NULLFRAME");
    }
    else
    {
      double[] baseXYZABC = ComputeXYZABCFromFrame(iBase, robRoot, 3);

      krlCode.Add("$BASE = {POS: X " + baseXYZABC[0] + ", Y " + baseXYZABC[1] + ", Z " + baseXYZABC[2] +
        ", A " + baseXYZABC[3] + ", B " + baseXYZABC[4] + ", C " + baseXYZABC[5] + "}   ;setting of the base coordinate system");
    }

    double[] toolXYZABC = ComputeXYZABCFromFrame(Tool, robRoot, 3);
    krlCode.Add("$TOOL = {POS: X " + toolXYZABC[0] + ", Y " + toolXYZABC[1] + ", Z " + toolXYZABC[2] +
      ", A " + toolXYZABC[3] + ", B " + toolXYZABC[4] + ", C " + toolXYZABC[5] + "}");

    krlCode.Add("HOME = {A1 " + Home[0] + ",A2 " + Home[1] + ",A3 " + Home[2] + ",A4 " + Home[3] + ",A5 " + Home[4] + ",A6 " + Home[5] + ",E1 0, E2 0, E3 0, E4 0, E5 0, E6 0}");

    krlCode.Add(";----------- Main section ----------");
    krlCode.Add("PTP HOME");

    if(E1.Count == 0)
    {
      for(int i = 0; i < WindingPlanes.Count; i++)
      {
        E1.Add(0);
      }
    }

    if(E2.Count == 0)
    {
      for(int i = 0; i < WindingPlanes.Count; i++)
      {
        E2.Add(0);
      }
    }

    for(int i = 0; i < WindingPlanes.Count; i++)
    {
      Plane wp = WindingPlanes[i];
      double[] XYZABC = ComputeXYZABCFromFrame(WindingPlanes[i], robRoot, 3);

      string motion = "LIN {E6POS: X " + XYZABC[0] + ", Y " + XYZABC[1] + ", Z " + XYZABC[2] + ", A " + XYZABC[3] + ", B " + XYZABC[4] + ", C " + XYZABC[5] + ", E1 " + Math.Round(E1[i], 3) + ", E2 " + Math.Round(E2[i], 3) + ", E3 0.0, E4 0.0, E5 0.0, E6 0.0}" + " C_VEL";

      krlCode.Add(motion);
    }

    krlCode.Add("END");

    if(Write)
    {
      System.IO.Directory.CreateDirectory(Folder);
      string pathString = System.IO.Path.Combine(Folder, Name);

      System.IO.File.WriteAllText(pathString + ".src", String.Join("\n", krlCode));
    }

    KRL = krlCode;
# ---------- c_script: C# additional code ----------
  public static double[] ComputeXYZABCFromFrame(Plane frame, Plane referenceFrame, int roundingDigitCount)
  {
    const double toDegree = 180.0 / Math.PI;
    Transform temp = Transform.PlaneToPlane(referenceFrame, frame);

    double c = toDegree * Math.Atan2(temp.M21, temp.M22);
    double b = toDegree * -Math.Atan2(temp.M20, Math.Sqrt(Math.Pow(temp.M21, 2) + Math.Pow(temp.M22, 2)));
    double a = toDegree * Math.Atan2(temp.M10, temp.M00);

    return new[] {
        Math.Round(frame.Origin.X, roundingDigitCount),
        Math.Round(frame.Origin.Y, roundingDigitCount),
        Math.Round(frame.Origin.Z, roundingDigitCount),
        Math.Round(a, roundingDigitCount),
        Math.Round(b, roundingDigitCount),
        Math.Round(c, roundingDigitCount)
        };
  }
# ---------- end c_script ----------

# ----
panel_4 = Panel(c_script)
