# Grasshopper definition kidsChair.gh (Grasshopper 1.0.7)

# ---- group: Parameters
shift = Slider(19, range=-1..50)
anchors_count = Slider(25, range=0..100)

shift_2 = Slider(19, range=-1..50)
anchors_count_2 = Slider(25, range=0..100)

anchors_count_3 = Slider(28, range=0..100)
shift_3 = Slider(25, range=-1..50)

# ----
crv = Curve(<curve referenced from the Rhino model>)
crv_2 = Curve(<curve referenced from the Rhino model>)
crv_3 = Curve(<curve referenced from the Rhino model>)
crv_4 = Curve(<curve referenced from the Rhino model>)
crv_5 = Curve(<curve referenced from the Rhino model>)
crv_6 = Curve(<curve referenced from the Rhino model>)
divide_curve = DivideCurve(Curve=crv_2, Count=anchors_count, Kinks=False)  # -> reverse(Points), Tangents, Parameters
divide_curve_2 = DivideCurve(Curve=crv, Count=anchors_count, Kinks=False)  # -> Points, Tangents, Parameters
divide_curve_3 = DivideCurve(Curve=crv_4, Count=anchors_count_2, Kinks=False)  # -> reverse(Points), Tangents, Parameters
divide_curve_4 = DivideCurve(Curve=crv_3, Count=anchors_count_2, Kinks=False)  # -> Points, Tangents, Parameters
division = Division(A=anchors_count, B=2)
divide_curve_5 = DivideCurve(Curve=crv_6, Count=anchors_count_3, Kinks=False)  # -> reverse(Points), Tangents, Parameters
divide_curve_6 = DivideCurve(Curve=crv_5, Count=anchors_count_3, Kinks=False)  # -> Points, Tangents, Parameters
division_2 = Division(A=anchors_count_2, B=2)
shift_4 = ShiftList(List=divide_curve.Points, Shift=expr("-x", shift), Wrap=True)
split = SplitList(List=divide_curve_2.Points, Index=division)  # -> ListA, ListB
shift_5 = ShiftList(List=divide_curve.Points, Shift=expr("-x+4", shift), Wrap=True)
division_3 = Division(A=anchors_count_3, B=2)
shift_6 = ShiftList(List=divide_curve_3.Points, Shift=expr("-x", shift_2), Wrap=True)
split_2 = SplitList(List=divide_curve_4.Points, Index=division_2)  # -> ListA, ListB
shift_7 = ShiftList(List=divide_curve_3.Points, Shift=expr("-x+4", shift_2), Wrap=True)
split_3 = SplitList(List=shift_5, Index=division)  # -> ListA, ListB
split_4 = SplitList(List=shift_4, Index=division)  # -> ListA, ListB
shift_8 = ShiftList(List=divide_curve_5.Points, Shift=expr("-x", shift_3), Wrap=True)
split_5 = SplitList(List=divide_curve_6.Points, Index=division_3)  # -> ListA, ListB
shift_9 = ShiftList(List=divide_curve_5.Points, Shift=expr("-x+4", shift_3), Wrap=True)
split_6 = SplitList(List=shift_7, Index=division_2)  # -> ListA, ListB
split_7 = SplitList(List=shift_6, Index=division_2)  # -> ListA, ListB
pt = Point(split_3.ListA)
pt_2 = Point(split_3.ListB)
pt_3 = Point(split.ListA)
pt_4 = Point(split.ListB)
pt_5 = Point(split_4.ListB)
pt_6 = Point(split_4.ListA)
split_8 = SplitList(List=shift_9, Index=division_3)  # -> ListA, ListB
split_9 = SplitList(List=shift_8, Index=division_3)  # -> ListA, ListB
pt_7 = Point(split_6.ListA)
pt_8 = Point(split_6.ListB)
pt_9 = Point(split_2.ListA)
pt_10 = Point(split_2.ListB)
pt_11 = Point(split_7.ListB)
pt_12 = Point(split_7.ListA)

# ---- group: Continuous Shift
c__shift_approach = CSharpScript(iShift=shift, iPointsA=flatten(divide_curve.Points), iPointsB=flatten(divide_curve_2.Points))  # -> out, oFinalPoints; inputs iShift: Int32, iPointsA: list of Point3d, iPointsB: list of Point3d
# ---------- c__shift_approach: C# ----------
    int iPointsACount = iPointsA.Count;
    int iPointsBCount = iPointsB.Count;
    int maxPoints = iPointsACount;

    // create frame objects

    Frame frameA = new Frame(iPointsA);
    Frame frameB = new Frame(iPointsB);


    // determine smaller frame

    if (iPointsACount < iPointsBCount){
      // a is smaller
      frameA.isSmaller = true;
      maxPoints = iPointsBCount;
      frameA.maxPoints = maxPoints;
      frameA.insertPoints();
      Print("Frame A is smaller");
    }

    else if (iPointsBCount < iPointsACount){
      // b is smaller
      frameB.isSmaller = true;
      maxPoints = iPointsACount;
      frameB.maxPoints = maxPoints;
      frameB.insertPoints();
      Print("Frame B is smaller");
    }

    // create selectors

    List < int > selectA = new List<int>(){0};
    List < int> selectB = new List<int>(){iShift};

    int selectorA = 0;
    int selectorB = 0;

    for (int i = 0; i < maxPoints; i++){

      selectorA = (selectorA + iShift * 2) % maxPoints; // % remainder: Computes the remainder after dividing its left operand by its right operand 

      if(selectA.Contains(selectorA))
        selectorA += 1;

      selectA.Add(selectorA);

      selectorB = (selectorA + iShift) % maxPoints;

      if(selectB.Contains(selectorB))
        selectorB += 1;

      selectB.Add(selectorB);

    }


    // select and weave points

    List<Point3d> finalPoints = new List<Point3d>();

    for (int i = 0; i < maxPoints; i++){

      finalPoints.Add(frameA.windingPins[selectA[i]]);
      finalPoints.Add(frameB.windingPins[selectB[i]]);
    }


    oFinalPoints = finalPoints;
# ---------- c__shift_approach: C# additional code ----------
  class Frame{

    public bool isSmaller;
    public int maxPoints;
    int length;
    public List<int>duplicatePositions;
    public List<Point3d> windingPins;

    // constructor
    public Frame(List<Point3d>_windingPins){

      isSmaller = false;
      windingPins = _windingPins;
      length = windingPins.Count;

    }

    public void insertPoints(){

      // generate list of positions

      int space = 5;
      duplicatePositions = new List<int>();

      for (int i = 0; i < length; i++){

        if(i % space == 0){
          duplicatePositions.Add(i);
        }
      }

      for(int i = 0; i < duplicatePositions.Count; i++){

        int pos = duplicatePositions[i] + i;
        Point3d dupValue = windingPins[pos];
        windingPins.Insert(pos, dupValue);

      }
    }
  }
# ---------- end c__shift_approach ----------
polyline = PolyLine(Vertices=flatten(c__shift_approach.oFinalPoints), Closed=True)

# ----
pt_13 = Point(split_8.ListA)
pt_14 = Point(split_8.ListB)

# ---- group: Continuous Shift
c__shift_approach_2 = CSharpScript(iShift=shift_2, iPointsA=flatten(divide_curve_3.Points), iPointsB=flatten(divide_curve_4.Points))  # -> out, oFinalPoints; inputs iShift: Int32, iPointsA: list of Point3d, iPointsB: list of Point3d; same code as c__shift_approach
polyline_2 = PolyLine(Vertices=flatten(c__shift_approach_2.oFinalPoints), Closed=True)

# ----
pt_15 = Point(split_5.ListA)
pt_16 = Point(split_5.ListB)
pt_17 = Point(split_9.ListB)
pt_18 = Point(split_9.ListA)
line = Line(StartPoint=pt_5, EndPoint=pt_4)

# ---- group: Continuous Shift
c__shift_approach_3 = CSharpScript(iShift=shift_3, iPointsA=flatten(divide_curve_5.Points), iPointsB=flatten(divide_curve_6.Points))  # -> out, oFinalPoints; inputs iShift: Int32, iPointsA: list of Point3d, iPointsB: list of Point3d; same code as c__shift_approach
polyline_3 = PolyLine(Vertices=flatten(c__shift_approach_3.oFinalPoints), Closed=True)

# ----
line_2 = Line(StartPoint=pt_11, EndPoint=pt_10)
line_3 = Line(StartPoint=pt_17, EndPoint=pt_16)
sub_curve = SubCurve(BaseCurve=reparameterize(polyline), Domain=Slider(1, range=0..1))
sub_curve_2 = SubCurve(BaseCurve=reparameterize(polyline_2), Domain=Slider(1, range=0..1))
sub_curve_3 = SubCurve(BaseCurve=reparameterize(polyline_3), Domain=Slider(1, range=0..1))
curve = Curve(polyline)
curve_2 = Curve(polyline_2)
curve_3 = Curve(polyline_3)
pt_19 = ConstructPoint(XCoordinate=0, YCoordinate=0, ZCoordinate=0)

# ---- group: Input Curves
curve_4 = Curve(<curve referenced from the Rhino model>)
curve_5 = Curve(<curve referenced from the Rhino model>)

# ---- group: Parameters
anchors_count_4 = Slider(30, range=0..1000)

# ---- group: Input Curves
# Gradient
curve_6 = Curve(<curve referenced from the Rhino model>)
# - Defines a gradient for the selection of
# anchors from an initial list.
# - Min % value defines how sparse the
# center is.
# - Number of sections defines in how many
#  percentage groups are you spliting your
# gradient.
# - The shift moves the gradient along the
# curve.
curve_7 = Curve(<curve referenced from the Rhino model>)

# ----
crv_7 = Curve([<curve referenced from the Rhino model> x8])

# ---- group: Input Curves
curve_8 = Curve(<curve referenced from the Rhino model>)
curve_9 = Curve(<curve referenced from the Rhino model>)

# ---- group: Parameters
anchors_count_5 = Slider(30, range=0..1000)

anchors_count_6 = Slider(30, range=0..1000)

# ----
pipe = Pipe(Curve=[curve_6, curve_7, curve_8, curve_9, crv_7], Radius=Slider(9, range=0..100), Caps=0)
preview = CustomPreview(Geometry=pipe, Material=ColourSwatch(SwatchColor=RGB(226, 238, 169)))

# ---- group: Double Way Shift (no crossing)
line_4 = Line(StartPoint=pt_2, EndPoint=pt_4)
explode = Explode(Curve=line, Recursive=True)  # -> Segments, Vertices

# ----
explode_2 = Explode(Curve=line_4, Recursive=True)  # -> Segments, Vertices

# ---- group: Double Way Shift (no crossing) (continued)
polyline_4 = PolyLine(Vertices=flatten(explode_2.Vertices), Closed=False)

# ----
polyline_5 = PolyLine(Vertices=flatten(explode.Vertices), Closed=False)
sub_curve_4 = SubCurve(BaseCurve=reparameterize(polyline_5), Domain=Slider(1, range=0..1))
curve_10 = Curve([polyline_4, polyline_5])

# ---- group: Double Way Shift (no crossing)
line_5 = Line(StartPoint=pt_8, EndPoint=pt_10)
explode_3 = Explode(Curve=line_2, Recursive=True)  # -> Segments, Vertices

# ----
explode_4 = Explode(Curve=line_5, Recursive=True)  # -> Segments, Vertices

# ---- group: Double Way Shift (no crossing) (continued)
polyline_6 = PolyLine(Vertices=flatten(explode_4.Vertices), Closed=False)

# ----
polyline_7 = PolyLine(Vertices=flatten(explode_3.Vertices), Closed=False)
sub_curve_5 = SubCurve(BaseCurve=reparameterize(polyline_7), Domain=Slider(1, range=0..1))
curve_11 = Curve([polyline_6, polyline_7])
crv_8 = Curve([curve_11, curve_10, curve_3])
pipe_2 = Pipe(Curve=crv_8, Radius=Slider(1, range=0..100), Caps=0)
preview_2 = CustomPreview(Geometry=pipe_2, Material=ColourSwatch(SwatchColor=RGB(89, 155, 190)))

# ---- group: Double Way Shift (no crossing)
line_6 = Line(StartPoint=pt_14, EndPoint=pt_16)
explode_5 = Explode(Curve=line_3, Recursive=True)  # -> Segments, Vertices

# ----
explode_6 = Explode(Curve=line_6, Recursive=True)  # -> Segments, Vertices

# ---- group: Double Way Shift (no crossing) (continued)
polyline_8 = PolyLine(Vertices=flatten(explode_6.Vertices), Closed=False)

# ----
polyline_9 = PolyLine(Vertices=flatten(explode_5.Vertices), Closed=False)
sub_curve_6 = SubCurve(BaseCurve=reparameterize(polyline_9), Domain=Slider(1, range=0..1))
curve_12 = Curve([polyline_8, polyline_9])

shift_list_to_move_along_curve = Slider(0, range=0..40)
min_value = Slider(0.4, range=0..1)
number_of_sections_defines_the_gradient = Slider(34, range=0..40)  # "Number of Sections (defines the gradient resolution)"
divide_curve_7 = DivideCurve(Curve=curve_4, Count=anchors_count_4, Kinks=False)  # -> simplify(Points), Tangents, Parameters
divide_curve_8 = DivideCurve(Curve=curve_5, Count=anchors_count_4, Kinks=False)  # -> simplify(Points), Tangents, Parameters

# ---- group: Creates the secList
construct_domain = ConstructDomain(DomainStart=1, DomainEnd=min_value)
range = Range(Domain=construct_domain, Steps=number_of_sections_defines_the_gradient)
reverse_list = ReverseList(List=range)
cull_index = CullIndex(List=reverse_list, Indices=0, Wrap=True)
merge = Merge(Data1=range, Data2=cull_index)  # -> flatten(Result)
shift_list = ShiftList(List=merge, Shift=shift_list_to_move_along_curve, Wrap=True)

# ----
c__gradientanchorselection = CSharpScript(initPointsA=divide_curve_7.Points, initPointsB=divide_curve_8.Points, secList=shift_list)  # -> out, oSelectedIndicesA, oSelectedPointsA, oSelectedIndicesB, oSelectedPointsB; inputs initPointsA: list of Point3d, initPointsB: list of Point3d, secList: list of Double
# ---------- c__gradientanchorselection: C# usings ----------
using System.IO;
using System.Text.RegularExpressions;
using System.Linq;
# ---------- c__gradientanchorselection: C# ----------
    //___________ This script selects two lists of points based on a gradient list defined by the user_________
    //___________ re_duque_11/04/22___________________________________________________________________________


    double numPoints = initPointsA.Count(); //total number of points in initPoints
    double numSection = secList.Count(); // total number of sections (gradient resolution)
    List<int> SelectedPointsIndicesA = new List<int>();
    List<Point3d> SelectedPointsA = new List<Point3d>();
    List<int> SelectedPointsIndicesB = new List<int>();
    List<Point3d> SelectedPointsB = new List<Point3d>();
    int i = 0;

    Print("numSection=" + numSection.ToString());

    while (i < numPoints) // go through the list until reaches its end without defining the step size
    {

      Print("i=" + i.ToString());

      // add the i to the list
      SelectedPointsA.Add(initPointsA[i]); //adds current Point in A
      SelectedPointsIndicesA.Add(i); // adds current index in A
      SelectedPointsB.Add(initPointsB[i]); //adds current Point in B
      SelectedPointsIndicesB.Add(i); // adds current index in B

      // which section are we in? Remap the indexes to their respective sections
      int mySection = (int) Math.Floor(i / numPoints * numSection); // i/numPoints gives the relative position of the index in the list. (Math.Floor rounds down the number)

      Print("mySection=" + mySection.ToString());

      //what is the section density? calculate the skip factor: Density/1
      int skip = (int) Math.Round(1 / secList[mySection]); // secList[mySection] gives the skip value based on the list you defined with the densitity ratios

      // gets i value

      i = i + skip;


    }


    oSelectedPointsA = SelectedPointsA;
    oSelectedIndicesA = SelectedPointsIndicesA;

    oSelectedPointsB = SelectedPointsB;
    oSelectedIndicesB = SelectedPointsIndicesB;
# ---------- end c__gradientanchorselection ----------
final_seclist = Panel(shift_list)

lng = ListLength(List=c__gradientanchorselection.oSelectedPointsA)
shift_10 = Slider(10, range=0..20)
# + X Approach
c__x_approach = CSharpScript(
    AnchorsCount=lng,
    Anchors_A=c__gradientanchorselection.oSelectedPointsA,
    Anchors_B=c__gradientanchorselection.oSelectedPointsB,
    shift=shift_10)  # -> out, finalList; inputs AnchorsCount: Int32, Anchors_A: list of Point3d, Anchors_B: list of Point3d, shift: Int32
# ---------- c__x_approach: C# ----------
    List<Point3d> FinalAnchors = new List<Point3d>();


    for (int i = 0; i < AnchorsCount - shift; i++){

      Point3d a = Anchors_A[i];
      Point3d b = Anchors_B[i + shift];
      Point3d c = Anchors_B[i];
      Point3d d = Anchors_A[i + shift];
      FinalAnchors.Add(a);
      FinalAnchors.Add(b);
      FinalAnchors.Add(c);
      FinalAnchors.Add(d);

    }

    finalList = FinalAnchors;
# ---------- end c__x_approach ----------
polyline_10 = PolyLine(Vertices=c__x_approach.finalList, Closed=False)
sub_curve_7 = SubCurve(BaseCurve=reparameterize(polyline_10), Domain=Slider(1, range=0..1))

number_slider = Slider(6, range=0..10)
panel = Panel("""0
1
1
0""")
# +Weaving
shift_list_2 = ShiftList(List=c__gradientanchorselection.oSelectedPointsB, Shift=number_slider, Wrap=False)
shift_list_3 = ShiftList(List=c__gradientanchorselection.oSelectedPointsA, Shift=number_slider, Wrap=False)
weave = Weave(Pattern=panel, Stream0=c__gradientanchorselection.oSelectedPointsA, Stream1=shift_list_2, NullGaps=False)
weave_2 = Weave(Pattern=panel, Stream0=shift_list_3, Stream1=c__gradientanchorselection.oSelectedPointsB, NullGaps=False)
polyline_11 = PolyLine(Vertices=weave, Closed=False)
polyline_12 = PolyLine(Vertices=weave_2, Closed=False)

curve_13 = Curve(polyline_10)
curve_14 = Curve([polyline_11, polyline_12])

shift_list_to_move_along_curve_2 = Slider(3, range=0..40)
min_value_2 = Slider(0.4, range=0..1)
number_of_sections_defines_the_gradient_2 = Slider(34, range=0..40)  # "Number of Sections (defines the gradient resolution)"
divide_curve_9 = DivideCurve(Curve=curve_6, Count=anchors_count_5, Kinks=False)  # -> simplify(Points), Tangents, Parameters
divide_curve_10 = DivideCurve(Curve=curve_7, Count=anchors_count_5, Kinks=False)  # -> simplify(Points), Tangents, Parameters

# ---- group: Creates the secList
construct_domain_2 = ConstructDomain(DomainStart=1, DomainEnd=min_value_2)
range_2 = Range(Domain=construct_domain_2, Steps=number_of_sections_defines_the_gradient_2)
reverse_list_2 = ReverseList(List=range_2)
cull_index_2 = CullIndex(List=reverse_list_2, Indices=0, Wrap=True)
merge_2 = Merge(Data1=range_2, Data2=cull_index_2)  # -> flatten(Result)
shift_list_4 = ShiftList(List=merge_2, Shift=shift_list_to_move_along_curve_2, Wrap=True)

# ----
c__gradientanchorselection_2 = CSharpScript(initPointsA=divide_curve_9.Points, initPointsB=divide_curve_10.Points, secList=shift_list_4)  # -> out, oSelectedIndicesA, oSelectedPointsA, oSelectedIndicesB, oSelectedPointsB; inputs initPointsA: list of Point3d, initPointsB: list of Point3d, secList: list of Double; same code as c__gradientanchorselection
final_seclist_2 = Panel(shift_list_4)

lng_2 = ListLength(List=c__gradientanchorselection_2.oSelectedPointsA)
shift_11 = Slider(8, range=0..20)
c__x_approach_2 = CSharpScript(
    AnchorsCount=lng_2,
    Anchors_A=c__gradientanchorselection_2.oSelectedPointsA,
    Anchors_B=c__gradientanchorselection_2.oSelectedPointsB,
    shift=shift_11)  # -> out, finalList; inputs AnchorsCount: Int32, Anchors_A: list of Point3d, Anchors_B: list of Point3d, shift: Int32; same code as c__x_approach
polyline_13 = PolyLine(Vertices=c__x_approach_2.finalList, Closed=False)
sub_curve_8 = SubCurve(BaseCurve=reparameterize(polyline_13), Domain=Slider(1, range=0..1))

number_slider_2 = Slider(6, range=0..10)
panel_2 = Panel("""0
1
1
0""")
# +Weaving
shift_list_5 = ShiftList(List=c__gradientanchorselection_2.oSelectedPointsB, Shift=number_slider_2, Wrap=False)
shift_list_6 = ShiftList(List=c__gradientanchorselection_2.oSelectedPointsA, Shift=number_slider_2, Wrap=False)
weave_3 = Weave(Pattern=panel_2, Stream0=c__gradientanchorselection_2.oSelectedPointsA, Stream1=shift_list_5, NullGaps=False)
weave_4 = Weave(Pattern=panel_2, Stream0=shift_list_6, Stream1=c__gradientanchorselection_2.oSelectedPointsB, NullGaps=False)
polyline_14 = PolyLine(Vertices=weave_3, Closed=False)
polyline_15 = PolyLine(Vertices=weave_4, Closed=False)

curve_15 = Curve(polyline_13)
curve_16 = Curve([polyline_14, polyline_15])

shift_list_to_move_along_curve_3 = Slider(3, range=0..40)
number_of_sections_defines_the_gradient_3 = Slider(34, range=0..40)  # "Number of Sections (defines the gradient resolution)"
min_value_3 = Slider(0.4, range=0..1)
divide_curve_11 = DivideCurve(Curve=curve_8, Count=anchors_count_6, Kinks=False)  # -> simplify(Points), Tangents, Parameters
divide_curve_12 = DivideCurve(Curve=curve_9, Count=anchors_count_6, Kinks=False)  # -> simplify(Points), Tangents, Parameters

# ---- group: Creates the secList
construct_domain_3 = ConstructDomain(DomainStart=1, DomainEnd=min_value_3)
range_3 = Range(Domain=construct_domain_3, Steps=number_of_sections_defines_the_gradient_3)
reverse_list_3 = ReverseList(List=range_3)
cull_index_3 = CullIndex(List=reverse_list_3, Indices=0, Wrap=True)
merge_3 = Merge(Data1=range_3, Data2=cull_index_3)  # -> flatten(Result)
shift_list_7 = ShiftList(List=merge_3, Shift=shift_list_to_move_along_curve_3, Wrap=True)

# ----
c__gradientanchorselection_3 = CSharpScript(initPointsA=divide_curve_11.Points, initPointsB=divide_curve_12.Points, secList=shift_list_7)  # -> out, oSelectedIndicesA, oSelectedPointsA, oSelectedIndicesB, oSelectedPointsB; inputs initPointsA: list of Point3d, initPointsB: list of Point3d, secList: list of Double; same code as c__gradientanchorselection
final_seclist_3 = Panel(shift_list_7)

lng_3 = ListLength(List=c__gradientanchorselection_3.oSelectedPointsA)
shift_12 = Slider(10, range=0..20)
# + X Approach
c__x_approach_3 = CSharpScript(
    AnchorsCount=lng_3,
    Anchors_A=c__gradientanchorselection_3.oSelectedPointsA,
    Anchors_B=c__gradientanchorselection_3.oSelectedPointsB,
    shift=shift_12)  # -> out, finalList; inputs AnchorsCount: Int32, Anchors_A: list of Point3d, Anchors_B: list of Point3d, shift: Int32; same code as c__x_approach
polyline_16 = PolyLine(Vertices=c__x_approach_3.finalList, Closed=False)
sub_curve_9 = SubCurve(BaseCurve=reparameterize(polyline_16), Domain=Slider(1, range=0..1))

number_slider_3 = Slider(6, range=0..10)
panel_3 = Panel("""0
1
1
0""")
# +Weaving
shift_list_8 = ShiftList(List=c__gradientanchorselection_3.oSelectedPointsB, Shift=number_slider_3, Wrap=False)
shift_list_9 = ShiftList(List=c__gradientanchorselection_3.oSelectedPointsA, Shift=number_slider_3, Wrap=False)
weave_5 = Weave(Pattern=panel_3, Stream0=c__gradientanchorselection_3.oSelectedPointsA, Stream1=shift_list_8, NullGaps=False)
weave_6 = Weave(Pattern=panel_3, Stream0=shift_list_9, Stream1=c__gradientanchorselection_3.oSelectedPointsB, NullGaps=False)
polyline_17 = PolyLine(Vertices=weave_5, Closed=False)
polyline_18 = PolyLine(Vertices=weave_6, Closed=False)

curve_17 = Curve(polyline_16)
curve_18 = Curve([polyline_17, polyline_18])

crv_9 = Curve([polyline_17, polyline_14])
pipe_3 = Pipe(Curve=crv_9, Radius=Slider(1, range=0..100), Caps=0)
preview_3 = CustomPreview(Geometry=pipe_3, Material=ColourSwatch(SwatchColor=RGB(177, 227, 190)))
